# Grasshopper definition Bridges_simple.gh (Grasshopper 1.0.7)

right_stair_height = Slider(25.724, range=0..100)
left_landing = Curve(<curve referenced from the Rhino model>)
number_slider = Slider(378, range=0..1000)
railing_width = Curve(<curve referenced from the Rhino model>)
bridge_length = Curve(<curve referenced from the Rhino model>)
right_stair_depth = Slider(37, range=0..200)
right_landing = Curve(<curve referenced from the Rhino model>)
right_stair_depth_2 = Curve(<curve referenced from the Rhino model>)
bridge_width = Curve(<curve referenced from the Rhino model>)
water_width = Curve(<curve referenced from the Rhino model>)
left_stair_hei = Slider(25, range=0..100)
left_stair_depth = Curve(<curve referenced from the Rhino model>)
len = Length(Curve=right_stair_depth_2)
len_2 = Length(Curve=right_landing)
len_3 = Length(Curve=left_landing)
len_4 = Length(Curve=bridge_width)
len_5 = Length(Curve=left_stair_depth)
_65 = Number(80)
len_6 = Length(Curve=railing_width)
len_7 = Length(Curve=bridge_length)
len_8 = Length(Curve=water_width)
_2 = Number(2)
_2_2 = Number(2)
panel = Panel(len_2)
panel_2 = Panel(len)
panel_3 = Panel(len_3)
panel_4 = Panel(len_8)
left_stair_depth_2 = Number(Slider(40, range=0..200))
panel_5 = Panel(len_4)
left_stair_number = Number(Slider(10, range=0..50))
multiplication = Multiplication(A=left_stair_number, B=left_stair_depth_2)
panel_6 = Panel(len_6)
panel_7 = Panel(len_7)
right_stair_number = Number(Slider(10, range=0..50))
panel_8 = Panel(len_5)
subtraction = Subtraction(A=_65, B=left_stair_depth_2)
division = Division(A=subtraction, B=_2_2)
right_stair_depth_3 = Number(right_stair_depth)
multiplication_2 = Multiplication(A=right_stair_number, B=right_stair_depth_3)
subtraction_2 = Subtraction(A=_65, B=right_stair_depth_3)
division_2 = Division(A=subtraction_2, B=_2)
addition = Addition(A=multiplication, B=multiplication_2)
stair_height = Number(division_2)
stair_height_2 = Number(division)
elevation_difference = Number(Slider(-5, range=-100..100))
panel_9 = Panel(stair_height)
railing_height = Number(Slider(121, range=0..500))
railing_width_2 = Number(Slider(6, range=0..100))
left_landing_2 = Number(Slider(97, range=0..1500))
bridge_width_2 = Number(number_slider)
right_landing_2 = Number(Slider(61, range=0..1500))
addition_2 = Addition(A=left_landing_2, B=right_landing_2)
arc_height = Number(Slider(203, range=0..1000))
bridge_length_2 = Number(Slider(929, range=0..5000))
subtraction_3 = Subtraction(A=bridge_length_2, B=addition)
subtraction_4 = Subtraction(A=bridge_length_2, B=addition_2)
left_stair_depth_3 = Number(left_stair_depth_2)
left_stair_number_2 = Number(left_stair_number)
left_stair_height = Number(left_stair_hei)
multiplication_3 = Multiplication(A=left_stair_number, B=left_stair_height)
plane_length = Number(subtraction_3)
right_stair_number_2 = Number(right_stair_number)
right_stair_height_2 = Number(right_stair_height)
right_stair_depth_4 = Number(right_stair_depth_3)
water_width_2 = Number(subtraction_4)
bridge_height = Number(multiplication_3)
panel_10 = Panel(water_width_2)

left_stair_height_2 = Number(left_stair_hei)
railing_width_3 = Number(Slider(27, range=0..100))
railing_height_2 = Number(Slider(121, range=0..500))

arc_height_2 = Number(arc_height)
water_width_3 = Number(water_width_2)
_3_point_arc_cluster = _3PointArcCluster(water_width=water_width_3, arc_height=arc_height_2)
normal_arc = Curve(_3_point_arc_cluster)

arc_height_3 = Number(arc_height)
water_width_4 = Number(water_width_2)
normal_arc_cluster = NormalArcCluster(factor=arc_height_3, x_component=water_width_4)
crv = Curve(normal_arc_cluster)

panel_11 = Panel("arc")
plane_width = Number(plane_length)
right_landing_3 = Number(right_landing_2)
street_width = Number(bridge_width_2)
water_width_5 = Number(water_width_2)
elevation_difference_2 = Number(elevation_difference)
left_landing_3 = Number(left_landing_2)
left_stair_depth_4 = Number(left_stair_depth_3)
left_stair_depth_5 = Number(right_stair_depth_4)
railing_height_3 = Number(railing_height)
left_stair_num = Number(left_stair_number_2)
right_stair_height_3 = Number(right_stair_height_2)
left_stair_height_3 = Number(left_stair_height)
negative = Negative(Value=left_landing_3)
construct_point = ConstructPoint(XCoordinate=0, YCoordinate=0, ZCoordinate=0)
number_slider_2 = Slider(13, range=0..100)

arc_crv = Curve(normal_arc)

curve = Curve(<curve referenced from the Rhino model>)
_3 = Number(0)
_3_2 = Number(0)
vector_xyz = VectorXYZ(XComponent=water_width_5, YComponent=Slider(0, range=0..10), ZComponent=Slider(0, range=0..50))  # -> Vector, Length
vector_xyz_2 = VectorXYZ(XComponent=negative, YComponent=Slider(0, range=0..10), ZComponent=Slider(0, range=0..10))  # -> Vector, Length
multiplication_4 = Multiplication(A=left_stair_depth_3, B=_3)
length = Length(Curve=curve)
multiplication_5 = Multiplication(A=right_stair_depth_4, B=_3_2)
vector_xyz_3 = VectorXYZ(XComponent=right_landing_3, YComponent=Slider(0, range=0..10), ZComponent=elevation_difference_2)  # -> Vector, Length
point = Point(construct_point)
multiplication_6 = Multiplication(A=left_stair_height_3, B=left_stair_num)
_2_3 = Number(2)
negative_2 = Negative(Value=number_slider_2)
addition_3 = Addition(A=multiplication_4, B=multiplication_5)
division_3 = Division(A=plane_width, B=_2_3)
move = Move(Geometry=point, Motion=vector_xyz.Vector)  # -> Geometry, Transform
move_2 = Move(Geometry=point, Motion=vector_xyz_2.Vector)  # -> Geometry, Transform
_1 = Number(4)
number = Number(multiplication_6)
vector_xyz_4 = VectorXYZ(XComponent=length, YComponent=0, ZComponent=negative_2)  # -> Vector, Length
_3_3 = Number(4)
subtraction_5 = Subtraction(A=water_width_2, B=addition_3)
line = Line(StartPoint=point, EndPoint=move.Geometry)
multiplication_7 = Multiplication(A=left_stair_depth_4, B=_1)
multiplication_8 = Multiplication(A=left_stair_height_3, B=_3_3)
unit_z = UnitZ(Factor=number)
move_3 = Move(Geometry=move.Geometry, Motion=vector_xyz_3.Vector)  # -> Geometry, Transform
right_stair_height_4 = Number(right_stair_height)
right_stair_depth_5 = Number(right_stair_depth_3)
arch_height = Slider(15, range=0..30)
X = UnitX(Factor=multiplication_7)
unit_x = UnitX(Factor=division_3)
bridge_width_3 = Number(number_slider)
Z = UnitZ(Factor=multiplication_8)
curve_middle = CurveMiddle(Curve=line)

right_landing_4 = Number(right_landing_2)
elevation_difference_3 = Number(elevation_difference)
water_width_6 = Number(water_width_2)
stairs_number = Number(right_stair_number_2)
stair_height_3 = Number(right_stair_height_2)
stair_length = Number(right_stair_depth_4)
street_width_2 = Number(bridge_width_2)
right_stairs_cluster = RightStairsCluster(
    water_width=water_width_6,
    right_landing=right_landing_4,
    elevation_difference=elevation_difference_3,
    stair_length=stair_length,
    stair_height=stair_height_3,
    stairs_number=stairs_number,
    street_width=street_width_2)
brep = Brep(right_stairs_cluster)

move_4 = Move(Geometry=move_2.Geometry, Motion=X)  # -> Geometry, Transform
move_5 = Move(Geometry=curve_middle, Motion=unit_z)  # -> Geometry, Transform
_3_4 = Number(3)
negative_3 = Negative(Value=unit_x)
unit_z_2 = UnitZ(Factor=arch_height)
move_6 = Move(Geometry=move_4.Geometry, Motion=Z)  # -> Geometry, Transform
multiplication_9 = Multiplication(A=right_stair_height_3, B=_3_4)

left_landing_4 = Number(left_landing_2)
stair_length_2 = Number(left_stair_depth_3)
stair_height_4 = Number(left_stair_height)
stairs_number_2 = Number(left_stair_number_2)
street_width_3 = Number(bridge_width_2)
left_stairs_cluster = LeftStairsCluster(
    left_landing=left_landing_4,
    stair_length=stair_length_2,
    stair_height=stair_height_4,
    stairs_number=stairs_number_2,
    street_width=street_width_3)
brep_2 = Brep(left_stairs_cluster)

move_7 = Move(Geometry=move_5.Geometry, Motion=unit_x)  # -> Geometry, Transform
Z_2 = UnitZ(Factor=multiplication_9)
move_8 = Move(Geometry=move_5.Geometry, Motion=negative_3)  # -> Geometry, Transform
_3_5 = Number(3)
move_9 = Move(Geometry=unit_z_2, Motion=curve_middle)  # -> Geometry, Transform
multiplication_10 = Multiplication(A=left_stair_depth_5, B=_3_5)
move_10 = Move(Geometry=move_3.Geometry, Motion=Z_2)  # -> Geometry, Transform
neg = Negative(Value=multiplication_10)
X_2 = UnitX(Factor=neg)
line_2 = Line(StartPoint=move_3.Geometry, EndPoint=move_7.Geometry)
move_11 = Move(Geometry=move_10.Geometry, Motion=X_2)  # -> Geometry, Transform
right_down_point = Point(move_11.Geometry)
move_12 = Move(Geometry=right_down_point, Motion=vector_xyz_4.Vector)  # -> Geometry, Transform

round_step_number = Slider(2, range=0..5)
step_height = Number(number_slider_2)
step_length = Number(right_stair_depth_5)
right_front_stairs_generator = RightFrontStairsGenerator(bottom_start_pt=move_12.Geometry, step_height=step_height, round_step_num=round_step_number, step_length=step_length)
brep_3 = Brep(right_front_stairs_generator)

line_3 = Line(StartPoint=move_8.Geometry, EndPoint=move_2.Geometry)
line_4 = Line(StartPoint=point, EndPoint=move_2.Geometry)
line_5 = Line(StartPoint=move_8.Geometry, EndPoint=move_7.Geometry)
line_6 = Line(StartPoint=move.Geometry, EndPoint=move_3.Geometry)
arc_3pt = Arc3Pt(PointA=point, PointB=move_9.Geometry, PointC=move.Geometry)  # -> Arc, Plane, Radius
join_curves = JoinCurves(Curves=[line_5, line_3, line_2, arc_3pt.Arc, line_4, line_6], Preserve=False)
unit_y = UnitY(Factor=street_width)

street_width_4 = Number(bridge_width_2)
bridge_height_2 = Number(bridge_height)
elevation_difference_4 = Number(elevation_difference)
water_width_7 = Number(water_width_2)
plane_width_2 = Number(plane_length)
left_landing_5 = Number(left_landing_2)
right_landing_5 = Number(right_landing_2)
bridge_body_cluster = BridgeBodyCluster(
    bridge_width=street_width_4,
    plane_width=plane_width_2,
    bridgw_height=bridge_height_2,
    arc_crv=crv,
    water_width=water_width_7,
    left_landing=left_landing_5,
    right_landing=right_landing_5,
    elevation_difference=elevation_difference_4)  # -> extrusion, bridge_body_crv_2
bridge_body_crv = Curve(bridge_body_cluster.bridge_body_crv_2)
brep_4 = Brep(bridge_body_cluster.extrusion)

boundary_surfaces = BoundarySurfaces(Edges=join_curves)
right_down_point_2 = Point(move_11.Geometry)
left_down_point = Point(move_6.Geometry)
right_top_point = Point(move_7.Geometry)
left_top_point = Point(move_8.Geometry)
railing_width_4 = Number(railing_width_2)
point_2 = Point(move_2.Geometry)
point_3 = Point(move_3.Geometry)
number_2 = Number(railing_height_3)
brep_5 = Brep(flatten([brep, brep_2, brep_4]))

line_7 = Line(StartPoint=left_top_point, EndPoint=right_top_point)
line_8 = Line(StartPoint=left_down_point, EndPoint=left_top_point)
line_9 = Line(StartPoint=right_down_point_2, EndPoint=right_top_point)
unit_z_3 = UnitZ(Factor=number_2)
unit_z_4 = UnitZ(Factor=number_2)
unit_z_5 = UnitZ(Factor=number_2)
move_13 = Move(Geometry=line_7, Motion=unit_z_3)  # -> Geometry, Transform
move_14 = Move(Geometry=line_9, Motion=unit_z_5)  # -> Geometry, Transform
move_15 = Move(Geometry=line_8, Motion=unit_z_4)  # -> Geometry, Transform
end_points = EndPoints(Curve=move_13.Geometry)  # -> Start, End
end_points_2 = EndPoints(Curve=move_15.Geometry)  # -> Start, End
end_points_3 = EndPoints(Curve=move_14.Geometry)  # -> Start, End
line_10 = Line(StartPoint=end_points.Start, EndPoint=left_top_point)
line_11 = Line(StartPoint=end_points_3.Start, EndPoint=right_down_point_2)
line_12 = Line(StartPoint=left_down_point, EndPoint=end_points_2.Start)
join_curves_2 = JoinCurves(Curves=[move_13.Geometry, line_10], Preserve=False)
pipe = Pipe(Curve=line_10, Radius=railing_width_4, Caps=0)
join_curves_3 = JoinCurves(Curves=[move_15.Geometry, line_12], Preserve=False)
join_curves_4 = JoinCurves(Curves=[move_14.Geometry, line_11], Preserve=False)
pipe_2 = Pipe(Curve=line_12, Radius=railing_width_4, Caps=0)
pipe_3 = Pipe(Curve=line_11, Radius=railing_width_4, Caps=0)
curve_array = CurveArray(Geometry=pipe, Curve=move_13.Geometry, Count=10)  # -> Geometry, Transform
curve_array_2 = CurveArray(Geometry=pipe_2, Curve=move_15.Geometry, Count=10)  # -> Geometry, Transform
curve_array_3 = CurveArray(Geometry=pipe_3, Curve=move_14.Geometry, Count=10)  # -> Geometry, Transform
pipe_4 = Pipe(Curve=join_curves_2, Radius=railing_width_4, Caps=0)
pipe_5 = Pipe(Curve=join_curves_3, Radius=railing_width_4, Caps=0)
pipe_6 = Pipe(Curve=join_curves_4, Radius=railing_width_4, Caps=0)

preview = CustomPreview(Geometry=brep_5, Material=ColourSwatch(SwatchColor=RGB(186, 130, 65)))
curve_2 = Curve(<curve referenced from the Rhino model>)
right_down_point_3 = Point(move_11.Geometry)
left_down_point_2 = Point(move_6.Geometry)
right_top_point_2 = Point(move_7.Geometry)
left_top_point_2 = Point(move_8.Geometry)
railing_width_5 = Number(railing_width_2)
ralling_height = Number(railing_height_3)

right_down_point_4 = Point(move_11.Geometry)
left_down_point_3 = Point(move_6.Geometry)
right_top_point_3 = Point(move_7.Geometry)
left_top_point_3 = Point(move_8.Geometry)
railing_width_6 = Number(railing_width_2)
ralling_height_2 = Number(railing_height_3)
line_13 = Line(StartPoint=left_down_point_3, EndPoint=left_top_point_3)
line_14 = Line(StartPoint=left_top_point_3, EndPoint=right_top_point_3)
line_15 = Line(StartPoint=right_down_point_4, EndPoint=right_top_point_3)
unit_z_6 = UnitZ(Factor=ralling_height_2)
curve_3 = Curve([line_14, line_13, line_15])
unit_y_2 = UnitY(Factor=railing_width_6)
extrude = Extrude(Base=curve_3, Direction=unit_z_6)
extrude_2 = Extrude(Base=extrude, Direction=unit_y_2)

right_down_point_5 = Point(point_3)
left_down_point_4 = Point(point_2)
right_top_point_4 = Point(move_7.Geometry)
left_top_point_4 = Point(move_8.Geometry)
railing_width_7 = Number(railing_width_2)
ralling_height_3 = Number(railing_height_3)
line_16 = Line(StartPoint=left_down_point_4, EndPoint=left_top_point_4)
line_17 = Line(StartPoint=left_top_point_4, EndPoint=right_top_point_4)
line_18 = Line(StartPoint=right_down_point_5, EndPoint=right_top_point_4)
unit_z_7 = UnitZ(Factor=ralling_height_3)
curve_4 = Curve([line_17, line_16, line_18])
unit_y_3 = UnitY(Factor=railing_width_7)
extrude_3 = Extrude(Base=curve_4, Direction=unit_z_7)
extrude_4 = Extrude(Base=extrude_3, Direction=unit_y_3)

length_2 = Length(Curve=curve_2)
extrude_5 = Extrude(Base=boundary_surfaces, Direction=unit_y)
left_down_point_5 = Point(move_6.Geometry)
negative_4 = Negative(Value=length_2)
panel_12 = Panel(length_2)
line_19 = Line(StartPoint=left_down_point_2, EndPoint=left_top_point_2)
line_20 = Line(StartPoint=left_top_point_2, EndPoint=right_top_point_2)
line_21 = Line(StartPoint=right_down_point_3, EndPoint=right_top_point_2)

street_width_5 = Number(bridge_width_2)
plane_width_3 = Number(plane_length)
left_stair_height_4 = Number(left_stair_height)
railing_height_4 = Number(railing_height)
left_stair_num_2 = Number(left_stair_number_2)
railing_width_8 = Number(railing_width_2)
elevation_difference_5 = Number(elevation_difference)
right_landing_6 = Number(right_landing_2)
water_width_8 = Number(subtraction_5)
left_landing_6 = Number(left_landing_2)
railing_cluster = RailingCluster(
    street_width=street_width_5,
    plane_width=plane_width_3,
    water_width=water_width_8,
    left_landing=left_landing_6,
    right_landing=right_landing_6,
    elevation_difference=elevation_difference_5,
    railing_height=railing_height_4,
    left_stair_height=left_stair_height_4,
    left_stair_num=left_stair_num_2,
    railing_width=railing_width_8)
brep_6 = Brep(railing_cluster)

unit_x_2 = UnitX(Factor=negative_4)
move_16 = Move(Geometry=left_down_point_5, Motion=unit_x_2)  # -> Geometry, Transform
unit_z_8 = UnitZ(Factor=ralling_height)

street_width_6 = Number(bridge_width_2)
railding_width = Number(railing_width_2)
bridge_body_crv_2 = Curve(bridge_body_crv)
rialing_height = Number(railing_height)
railing_wall_cluster = RailingWallCluster(
    street_width=street_width_6,
    bridge_body_crv=bridge_body_crv_2,
    rialing_height=rialing_height,
    railding_width=railding_width)
railing_brep = Brep(railing_wall_cluster)

curve_5 = Curve([line_20, line_19, line_21])
line_22 = Line(StartPoint=left_down_point_5, EndPoint=move_16.Geometry)
unit_y_4 = UnitY(Factor=railing_width_5)
unit_z_9 = UnitZ(Factor=ralling_height_3)
area = Area(Geometry=extrude_5)  # -> Area, Centroid
extrude_6 = Extrude(Base=curve_5, Direction=unit_z_8)
unit_y_5 = UnitY(Factor=railing_width_7)
extrude_7 = Extrude(Base=line_22, Direction=unit_z_9)
extrude_8 = Extrude(Base=extrude_6, Direction=unit_y_4)
extrude_9 = Extrude(Base=extrude_7, Direction=unit_y_5)
brep_7 = Brep([curve_array.Geometry, pipe_4, curve_array_2.Geometry, pipe_5, curve_array_3.Geometry, pipe_6])
preview_2 = CustomPreview(Geometry=railing_brep, Material=ColourSwatch(SwatchColor=RGB(102, 39, 7)))
xz_plane = XZPlane(Origin=area.Centroid)
preview_3 = CustomPreview(Geometry=brep_6, Material=ColourSwatch(SwatchColor=RGB(153, 153, 153)))
mirror = Mirror(Geometry=extrude_2, Plane=xz_plane)  # -> Geometry, Transform
mirror_2 = Mirror(Geometry=brep_7, Plane=xz_plane)  # -> Geometry, Transform
brep_8 = Brep([extrude_4, mirror.Geometry])
brep_9 = Brep([mirror_2.Geometry, brep_7])
brep_10 = Brep(brep_9)
preview_4 = CustomPreview(Geometry=brep_8, Material=ColourSwatch(SwatchColor=RGB(181, 133, 56)))
preview_5 = CustomPreview(Geometry=brep_10, Material=ColourSwatch(SwatchColor=RGB(189, 189, 189)))

# ==== cluster RightFrontStairsGenerator
step_height = ClusterInput()
round_step_num = ClusterInput()
step_length = ClusterInput()
step_height_2 = Number(step_height)
round_step_num_2 = Number(round_step_num)
number = Number(1)
step_length_2 = Number(step_length)
subtraction = Subtraction(A=round_step_num_2, B=number)
multiplication = Multiplication(A=round_step_num_2, B=step_length_2)
multiplication_2 = Multiplication(A=subtraction, B=step_height_2)
Z = UnitZ(Factor=step_height_2)
neg = Negative(Value=multiplication)
Z_2 = UnitZ(Factor=multiplication_2)
neg_2 = Negative(Value=step_length_2)
X = UnitX(Factor=neg)
Y = UnitY(Factor=neg)
Y_2 = UnitY(Factor=neg_2)
X_2 = UnitX(Factor=step_length_2)
bottom_start_pt = ClusterInput()
multiplication_3 = Multiplication(A=Z, B=round_step_num_2)
bottom_start_pt_2 = Point(bottom_start_pt)
move = Move(Geometry=bottom_start_pt_2, Motion=X)  # -> Geometry, Transform
pt = Point(move.Geometry)
move_2 = Move(Geometry=pt, Motion=Z_2)  # -> Geometry, Transform
move_3 = Move(Geometry=pt, Motion=Y)  # -> Geometry, Transform
bottom_endpt = Point(move_3.Geometry)
move_4 = Move(Geometry=pt, Motion=multiplication_3)  # -> Geometry, Transform
pt_2 = Point(move_2.Geometry)
move_5 = Move(Geometry=pt_2, Motion=Y_2)  # -> Geometry, Transform
move_6 = Move(Geometry=pt_2, Motion=X_2)  # -> Geometry, Transform
pt_3 = Point(move_5.Geometry)
pt_4 = Point(move_6.Geometry)
arc = ArcSED(Start=bottom_start_pt_2, End=bottom_endpt, Direction=Y)  # -> Arc, Plane, Radius
arc_2 = ArcSED(Start=pt_4, End=pt_3, Direction=Y)  # -> Arc, Plane, Radius
top_pt = Point(move_4.Geometry)
move_7 = Move(Geometry=top_pt, Motion=X_2)  # -> Geometry, Transform
move_8 = Move(Geometry=top_pt, Motion=Y_2)  # -> Geometry, Transform
top_end_pt = Point(move_8.Geometry)
top_start_pt = Point(move_7.Geometry)
second_crv = Curve(arc_2.Arc)
bottom_crv = Curve(arc.Arc)
arc_3 = ArcSED(Start=top_start_pt, End=top_end_pt, Direction=Y)  # -> Arc, Plane, Radius
range = Range(Domain=Domain(0, 1), Steps=subtraction)
ln = Line(StartPoint=top_start_pt, EndPoint=top_pt)
ln_2 = Line(StartPoint=top_pt, EndPoint=top_end_pt)
ln_3 = Line(StartPoint=pt, EndPoint=top_pt)
ln_4 = Line(StartPoint=pt, EndPoint=bottom_endpt)
ln_5 = Line(StartPoint=bottom_start_pt_2, EndPoint=pt)
ln_6 = Line(StartPoint=pt, EndPoint=bottom_endpt)
crv = Curve(arc_3.Arc)
tweencrv = TweenCurve(CurveA=second_crv, CurveB=bottom_crv, Factor=range, BlendType=0)  # -> flatten(Tween)
street_width = Number(177)
extr = Extrude(Base=tweencrv, Direction=Z)
join = JoinCurves(Curves=[ln_2, ln, crv], Preserve=False)
join_2 = JoinCurves(Curves=[ln_6, bottom_crv, ln_5], Preserve=False)
num = Number(2)
debrep = DeconstructBrep(Brep=extr)  # -> Faces, Edges, Vertices
item = ListItem(List=debrep.Edges, Index=0, Wrap=True)  # -> Item, Item1, Item2, Item3, Item4
crv_2 = Curve(flatten(item.Item4))
division = Division(A=street_width, B=num)
crv_3 = Curve(flatten(item.Item2))
crv_4 = Curve(flatten(item.Item3))
crv_5 = Curve(flatten(item.Item1))
Y_3 = UnitY(Factor=division)
boundary_surfaces = BoundarySurfaces(Edges=join)
cull_i = CullIndex(List=flatten(crv_4), Indices="-1", Wrap=True)  # -> graft(List)
boundary_surfaces_2 = BoundarySurfaces(Edges=join_2)
cull_i_2 = CullIndex(List=flatten(crv_5), Indices="0", Wrap=True)  # -> graft(List)
flip = FlipCurve(Curve=cull_i)  # -> Curve, Flag
crv_6 = Curve([cull_i_2, flip.Curve])
loft = Loft(Curves=crv_6, Options={Adjust=False, Closed=False, LoftEnds=0, LoftSimp=0, LoftType=0, Rebuild=10, Refit=0.01})
debrep_2 = DeconstructBrep(Brep=loft)  # -> Faces, Edges, Vertices
item_2 = ListItem(List=debrep_2.Edges, Index=0, Wrap=True)  # -> Item, Item1, Item2, Item3, Item4
crv_7 = Curve(flatten(item_2.Item4))
join_3 = JoinCurves(Curves=[crv_7, crv_2], Preserve=False)  # -> flatten(Curves)
crv_8 = Curve(join_3)
join_4 = JoinCurves(Curves=[crv_8, ln_5, ln_3, ln], Preserve=False)
crv_9 = Curve(flatten(item_2.Item2))
join_5 = JoinCurves(Curves=[crv_9, crv_3], Preserve=False)
crv_10 = Curve(join_5)
join_6 = JoinCurves(Curves=[ln_3, crv_10, ln_4, ln_2], Preserve=False)
boundary_surfaces_3 = BoundarySurfaces(Edges=join_6)
boundary_surfaces_4 = BoundarySurfaces(Edges=join_4)
extr_2 = Extrude(Base=boundary_surfaces_4, Direction=Y_3)
move_9 = Move(Geometry=boundary_surfaces_4, Motion=Y_3)  # -> Geometry, Transform
brep = Brep([extr, boundary_surfaces_3, loft, boundary_surfaces, boundary_surfaces_2])
mirror = Mirror(Geometry=[extr_2, brep], Plane=move_9.Geometry)  # -> Geometry, Transform
brep_2 = Brep(mirror.Geometry)
brep_3 = Brep([brep, brep_2, extr_2])
brep_4 = ClusterOutput(brep_3)

# ==== cluster RailingWallCluster
bridge_body_crv = ClusterInput()
railding_width = ClusterInput()
rialing_height = ClusterInput()
street_width = ClusterInput()
bridge_body_crv_2 = Curve(bridge_body_crv)
railding_width_2 = Number(railding_width)
rialing_height_2 = Number(rialing_height)
street_width_2 = Number(street_width)
unit_z = UnitZ(Factor=rialing_height_2)
unit_y = UnitY(Factor=railding_width_2)
extrude = Extrude(Base=bridge_body_crv_2, Direction=unit_z)
subtraction = Subtraction(A=street_width_2, B=railding_width_2)
extrude_2 = Extrude(Base=extrude, Direction=unit_y)
unit_y_2 = UnitY(Factor=subtraction)
move = Move(Geometry=extrude_2, Motion=unit_y_2)  # -> Geometry, Transform
brep = Brep([move.Geometry, extrude_2])
brep_2 = ClusterOutput(brep)

# ==== cluster _3PointArcCluster
water_width = ClusterInput()
arc_height = ClusterInput()
water_width_2 = Number(water_width)
arc_height_2 = Number(arc_height)
construct_point = ConstructPoint(XCoordinate=0, YCoordinate=0, ZCoordinate=0)
_2 = Number(2)
unit_x = UnitX(Factor=water_width_2)
unit_z = UnitZ(Factor=arc_height_2)
division = Division(A=water_width_2, B=_2)
A = Point(construct_point)
move = Move(Geometry=A, Motion=unit_x)  # -> Geometry, Transform
unit_z_2 = UnitZ(Factor=division)
B = Point(move.Geometry)
line = Line(StartPoint=A, EndPoint=B)
curve_middle = CurveMiddle(Curve=line)
H = Point(curve_middle)
move_2 = Move(Geometry=curve_middle, Motion=unit_z)  # -> Geometry, Transform
move_3 = Move(Geometry=curve_middle, Motion=unit_z_2)  # -> Geometry, Transform
yz_plane = YZPlane(Origin=H)
C = Point(move_2.Geometry)
distance = Distance(PointA=C, PointB=move_3.Geometry)
xz_plane = XZPlane(Origin=C)
line_2 = Line(StartPoint=B, EndPoint=C)
line_3 = Line(StartPoint=A, EndPoint=C)
circle = Circle(Plane=xz_plane, Radius=distance)
curve_line = CurveLine(Curve=circle, Line=line_3)  # -> Points, Params, Count
curve_line_2 = CurveLine(Curve=circle, Line=line_2)  # -> Points, Params, Count
_1 = Number(1)
list_item = ListItem(List=curve_line.Points, Index=_1, Wrap=True)
list_item_2 = ListItem(List=curve_line_2.Points, Index=_1, Wrap=True)
M = Point(list_item)
N = Point(list_item_2)
line_4 = Line(StartPoint=N, EndPoint=B)
line_5 = Line(StartPoint=M, EndPoint=A)
curve_middle_2 = CurveMiddle(Curve=line_4)
curve_middle_3 = CurveMiddle(Curve=line_5)
curve_closest_point = CurveClosestPoint(Point=curve_middle_3, Curve=line)  # -> Point, Parameter, Distance
distance_2 = Distance(PointA=M, PointB=curve_middle_3)
square = Square(Value=curve_closest_point.Distance)
square_2 = Square(Value=distance_2)
subtraction = Subtraction(A=square_2, B=square)
square_root = SquareRoot(Value=subtraction)
division_2 = Division(A=square_2, B=square_root)
negative = Negative(Value=division_2)
unit_x_2 = UnitX(Factor=negative)
unit_x_3 = UnitX(Factor=division_2)
move_4 = Move(Geometry=A, Motion=unit_x_3)  # -> Geometry, Transform
move_5 = Move(Geometry=B, Motion=unit_x_2)  # -> Geometry, Transform
E = Point(move_4.Geometry)
line_6 = Line(StartPoint=move_4.Geometry, EndPoint=curve_middle_3)
line_7 = Line(StartPoint=move_5.Geometry, EndPoint=curve_middle_2)
xz_plane_2 = XZPlane(Origin=move_4.Geometry)
F = Point(move_5.Geometry)
line_line = LineLine(Line1=line_6, Line2=line_7)  # -> ParamA, ParamB, PointA, PointB
G = Point(line_line.PointA)
distance_3 = Distance(PointA=C, PointB=line_line.PointA)
xz_plane_3 = XZPlane(Origin=line_line.PointA)
circle_2 = Circle(Plane=xz_plane_2, Radius=division_2)
circle_3 = Circle(Plane=xz_plane_3, Radius=distance_3)
curve_curve = CurveCurve(CurveA=circle_2, CurveB=circle_3)  # -> Points, ParamsA, ParamsB
negative_2 = Negative(Value=Slider(1, range=0..1))
unit_x_4 = UnitX(Factor=negative_2)
unit_z_3 = UnitZ(Factor=1)
point = Point(curve_curve.Points)
arc_sed = ArcSED(Start=C, End=point, Direction=unit_x_4)  # -> Arc, Plane, Radius
arc_sed_2 = ArcSED(Start=A, End=point, Direction=unit_z_3)  # -> Arc, Plane, Radius
join_curves = JoinCurves(Curves=[arc_sed.Arc, arc_sed_2.Arc], Preserve=False)
mirror = Mirror(Geometry=join_curves, Plane=yz_plane)  # -> Geometry, Transform
join_curves_2 = JoinCurves(Curves=[join_curves, mirror.Geometry], Preserve=False)
curves = ClusterOutput(join_curves_2)

# ==== cluster LeftStairsCluster
left_landing = ClusterInput()
left_landing_2 = Number(left_landing)
construct_point = ConstructPoint(XCoordinate=0, YCoordinate=0, ZCoordinate=0)
negative = Negative(Value=left_landing_2)
num = Number(0)
num_2 = Number(0)
vector_xyz = VectorXYZ(XComponent=negative, YComponent=num, ZComponent=num_2)  # -> Vector, Length
stair_length = ClusterInput()
stair_height = ClusterInput()
stairs_number = ClusterInput()
point = Point(construct_point)
street_width = ClusterInput()
stair_length_2 = Number(stair_length)
stair_height_2 = Number(stair_height)
stairs_number_2 = Number(stairs_number)
street_width_2 = Number(street_width)
unit_x = UnitX(Factor=stair_length_2)
move = Move(Geometry=point, Motion=vector_xyz.Vector)  # -> Geometry, Transform
Y = UnitY(Factor=street_width_2)
unit_z = UnitZ(Factor=stair_height_2)
point_2 = Point(move.Geometry)
move_2 = Move(Geometry=point_2, Motion=unit_z)  # -> Geometry, Transform
series = Series(Start=0, Step=unit_x, Count=stairs_number_2)  # -> graft(Series)
series_2 = Series(Start=0, Step=unit_z, Count=stairs_number_2)  # -> graft(Series)
move_3 = Move(Geometry=move_2.Geometry, Motion=unit_x)  # -> Geometry, Transform
vector_xyz_2 = VectorXYZ(XComponent=series, YComponent=0, ZComponent=series_2)  # -> Vector, Length
polyline = PolyLine(Vertices=[point_2, move_2.Geometry, move_3.Geometry], Closed=False)
move_4 = Move(Geometry=polyline, Motion=vector_xyz_2.Vector)  # -> Geometry, Transform
join_curves = JoinCurves(Curves=flatten(move_4.Geometry), Preserve=False)
end_points = EndPoints(Curve=join_curves)  # -> Start, End
pt = Point(end_points.Start)
pt_2 = Point(end_points.End)
line = Line(StartPoint=pt, EndPoint=pt_2)
join_curves_2 = JoinCurves(Curves=[join_curves, line], Preserve=False)
boundary_surfaces = BoundarySurfaces(Edges=join_curves_2)
extrude = Extrude(Base=boundary_surfaces, Direction=Y)
extrusion = ClusterOutput(extrude)

# ==== cluster RightStairsCluster
water_width = ClusterInput()
right_landing = ClusterInput()
elevation_difference = ClusterInput()
water_width_2 = Number(water_width)
right_landing_2 = Number(right_landing)
elevation_difference_2 = Number(elevation_difference)
num = Number(0)
construct_point = ConstructPoint(XCoordinate=0, YCoordinate=0, ZCoordinate=0)
num_2 = Number(0)
vector_xyz = VectorXYZ(XComponent=water_width_2, YComponent=num, ZComponent=num)  # -> Vector, Length
vector_xyz_2 = VectorXYZ(XComponent=right_landing_2, YComponent=num_2, ZComponent=elevation_difference_2)  # -> Vector, Length
point = Point(construct_point)
move = Move(Geometry=point, Motion=vector_xyz.Vector)  # -> Geometry, Transform
stair_length = ClusterInput()
stairs_number = ClusterInput()
stair_height = ClusterInput()
stair_length_2 = Number(stair_length)
street_width = ClusterInput()
stairs_number_2 = Number(stairs_number)
stair_height_2 = Number(stair_height)
unit_x = UnitX(Factor=stair_length_2)
street_width_2 = Number(street_width)
move_2 = Move(Geometry=move.Geometry, Motion=vector_xyz_2.Vector)  # -> Geometry, Transform
unit_z = UnitZ(Factor=stair_height_2)
negative = Negative(Value=unit_x)
point_2 = Point(move_2.Geometry)
panel = Panel("stairs")
move_3 = Move(Geometry=point_2, Motion=unit_z)  # -> Geometry, Transform
Y = UnitY(Factor=street_width_2)
series = Series(Start=0, Step=unit_x, Count=stairs_number_2)  # -> graft(Series)
series_2 = Series(Start=0, Step=unit_z, Count=stairs_number_2)  # -> graft(Series)
move_4 = Move(Geometry=move_3.Geometry, Motion=negative)  # -> Geometry, Transform
negative_2 = Negative(Value=series)
polyline = PolyLine(Vertices=[point_2, move_3.Geometry, move_4.Geometry], Closed=False)
vector_xyz_3 = VectorXYZ(XComponent=negative_2, YComponent=0, ZComponent=series_2)  # -> Vector, Length
move_5 = Move(Geometry=polyline, Motion=vector_xyz_3.Vector)  # -> Geometry, Transform
join_curves = JoinCurves(Curves=flatten(move_5.Geometry), Preserve=False)
end_points = EndPoints(Curve=join_curves)  # -> Start, End
pt = Point(end_points.Start)
pt_2 = Point(end_points.End)
line = Line(StartPoint=pt, EndPoint=pt_2)
join_curves_2 = JoinCurves(Curves=[join_curves, line], Preserve=False)
boundary_surfaces = BoundarySurfaces(Edges=join_curves_2)
extrude = Extrude(Base=boundary_surfaces, Direction=Y)
extrusion = ClusterOutput(extrude)

# ==== cluster RailingCluster
elevation_difference = ClusterInput()
left_landing = ClusterInput()
right_landing = ClusterInput()
water_width = ClusterInput()
left_landing_2 = Number(left_landing)
left_stair_height = ClusterInput()
left_stair_num = ClusterInput()
plane_width = ClusterInput()
railing_height = ClusterInput()
water_width_2 = Number(water_width)
negative = Negative(Value=left_landing_2)
elevation_difference_2 = Number(elevation_difference)
construct_point = ConstructPoint(XCoordinate=0, YCoordinate=0, ZCoordinate=0)
right_landing_2 = Number(right_landing)
left_stair_height_2 = Number(left_stair_height)
left_stair_num_2 = Number(left_stair_num)
railing_height_2 = Number(railing_height)
street_width = ClusterInput()
vector_xyz = VectorXYZ(XComponent=water_width_2, YComponent=Slider(0, range=0..10), ZComponent=Slider(0, range=0..50))  # -> Vector, Length
plane_width_2 = Number(plane_width)
vector_xyz_2 = VectorXYZ(XComponent=negative, YComponent=Slider(0, range=0..10), ZComponent=Slider(0, range=0..10))  # -> Vector, Length
vector_xyz_3 = VectorXYZ(XComponent=right_landing_2, YComponent=Slider(0, range=0..10), ZComponent=elevation_difference_2)  # -> Vector, Length
street_width_2 = Number(street_width)
point = Point(construct_point)
_2 = Number(2)
multiplication = Multiplication(A=left_stair_height_2, B=left_stair_num_2)
division = Division(A=plane_width_2, B=_2)
move = Move(Geometry=point, Motion=vector_xyz.Vector)  # -> Geometry, Transform
move_2 = Move(Geometry=point, Motion=vector_xyz_2.Vector)  # -> Geometry, Transform
number = Number(multiplication)
line = Line(StartPoint=point, EndPoint=move.Geometry)
move_3 = Move(Geometry=move.Geometry, Motion=vector_xyz_3.Vector)  # -> Geometry, Transform
unit_z = UnitZ(Factor=number)
arch_height = Slider(15, range=0..30)
unit_x = UnitX(Factor=division)
curve_middle = CurveMiddle(Curve=line)
move_4 = Move(Geometry=curve_middle, Motion=unit_z)  # -> Geometry, Transform
negative_2 = Negative(Value=unit_x)
unit_z_2 = UnitZ(Factor=arch_height)
move_5 = Move(Geometry=move_4.Geometry, Motion=unit_x)  # -> Geometry, Transform
move_6 = Move(Geometry=move_4.Geometry, Motion=negative_2)  # -> Geometry, Transform
move_7 = Move(Geometry=unit_z_2, Motion=curve_middle)  # -> Geometry, Transform
right_down_point = Point(move_3.Geometry)
left_down_point = Point(move_2.Geometry)
right_top_point = Point(move_5.Geometry)
left_top_point = Point(move_6.Geometry)
number_2 = Number(railing_height_2)
line_2 = Line(StartPoint=move_3.Geometry, EndPoint=move_5.Geometry)
line_3 = Line(StartPoint=move_6.Geometry, EndPoint=move_2.Geometry)
line_4 = Line(StartPoint=point, EndPoint=move_2.Geometry)
line_5 = Line(StartPoint=move_6.Geometry, EndPoint=move_5.Geometry)
line_6 = Line(StartPoint=move.Geometry, EndPoint=move_3.Geometry)
arc_3pt = Arc3Pt(PointA=point, PointB=move_7.Geometry, PointC=move.Geometry)  # -> Arc, Plane, Radius
join_curves = JoinCurves(Curves=[line_5, line_3, line_2, arc_3pt.Arc, line_4, line_6], Preserve=False)
unit_y = UnitY(Factor=street_width_2)
boundary_surfaces = BoundarySurfaces(Edges=join_curves)
railing_width = ClusterInput()
railing_width_2 = Number(railing_width)
line_7 = Line(StartPoint=left_top_point, EndPoint=right_top_point)
line_8 = Line(StartPoint=left_down_point, EndPoint=left_top_point)
line_9 = Line(StartPoint=right_down_point, EndPoint=right_top_point)
extrude = Extrude(Base=boundary_surfaces, Direction=unit_y)
unit_z_3 = UnitZ(Factor=number_2)
unit_z_4 = UnitZ(Factor=number_2)
unit_z_5 = UnitZ(Factor=number_2)
move_8 = Move(Geometry=line_7, Motion=unit_z_3)  # -> Geometry, Transform
move_9 = Move(Geometry=line_9, Motion=unit_z_5)  # -> Geometry, Transform
move_10 = Move(Geometry=line_8, Motion=unit_z_4)  # -> Geometry, Transform
end_points = EndPoints(Curve=move_8.Geometry)  # -> Start, End
end_points_2 = EndPoints(Curve=move_10.Geometry)  # -> Start, End
end_points_3 = EndPoints(Curve=move_9.Geometry)  # -> Start, End
area = Area(Geometry=extrude)  # -> Area, Centroid
line_10 = Line(StartPoint=end_points.Start, EndPoint=left_top_point)
line_11 = Line(StartPoint=end_points_3.Start, EndPoint=right_down_point)
line_12 = Line(StartPoint=left_down_point, EndPoint=end_points_2.Start)
join_curves_2 = JoinCurves(Curves=[move_8.Geometry, line_10], Preserve=False)
pipe = Pipe(Curve=line_10, Radius=railing_width_2, Caps=0)
join_curves_3 = JoinCurves(Curves=[move_10.Geometry, line_12], Preserve=False)
join_curves_4 = JoinCurves(Curves=[move_9.Geometry, line_11], Preserve=False)
pipe_2 = Pipe(Curve=line_12, Radius=railing_width_2, Caps=0)
pipe_3 = Pipe(Curve=line_11, Radius=railing_width_2, Caps=0)
curve_array = CurveArray(Geometry=pipe, Curve=move_8.Geometry, Count=10)  # -> Geometry, Transform
curve_array_2 = CurveArray(Geometry=pipe_2, Curve=move_10.Geometry, Count=10)  # -> Geometry, Transform
curve_array_3 = CurveArray(Geometry=pipe_3, Curve=move_9.Geometry, Count=10)  # -> Geometry, Transform
pipe_4 = Pipe(Curve=join_curves_2, Radius=railing_width_2, Caps=0)
pipe_5 = Pipe(Curve=join_curves_3, Radius=railing_width_2, Caps=0)
pipe_6 = Pipe(Curve=join_curves_4, Radius=railing_width_2, Caps=0)
brep = Brep([curve_array.Geometry, pipe_4, curve_array_2.Geometry, pipe_5, curve_array_3.Geometry, pipe_6])
xz_plane = XZPlane(Origin=area.Centroid)
mirror = Mirror(Geometry=brep, Plane=xz_plane)  # -> Geometry, Transform
brep_2 = Brep([mirror.Geometry, brep])
brep_3 = ClusterOutput(brep_2)

# ==== cluster BridgeBodyCluster
elevation_difference = ClusterInput()
right_landing = ClusterInput()
plane_width = ClusterInput()
bridgw_height = ClusterInput()
water_width = ClusterInput()
bridge_width = ClusterInput()
left_landing = ClusterInput()
elevation_difference_2 = Number(elevation_difference)
right_landing_2 = Number(right_landing)
plane_width_2 = Number(plane_width)
bridgw_height_2 = Number(bridgw_height)
water_width_2 = Number(water_width)
bridge_width_2 = Number(bridge_width)
left_landing_2 = Number(left_landing)
_2 = Number(2)
negative = Negative(Value=left_landing_2)
num = Number(0)
num_2 = Number(0)
num_3 = Number(0)
num_4 = Number(0)
num_5 = Number(0)
construct_point = ConstructPoint(XCoordinate=0, YCoordinate=0, ZCoordinate=0)
num_6 = Number(0)
vector_xyz = VectorXYZ(XComponent=water_width_2, YComponent=num, ZComponent=0)  # -> Vector, Length
division = Division(A=plane_width_2, B=_2)
vector_xyz_2 = VectorXYZ(XComponent=negative, YComponent=num_4, ZComponent=num_5)  # -> Vector, Length
vector_xyz_3 = VectorXYZ(XComponent=right_landing_2, YComponent=num_6, ZComponent=elevation_difference_2)  # -> Vector, Length
point = Point(construct_point)
move = Move(Geometry=point, Motion=vector_xyz.Vector)  # -> Geometry, Transform
move_2 = Move(Geometry=point, Motion=vector_xyz_2.Vector)  # -> Geometry, Transform
line = Line(StartPoint=point, EndPoint=move.Geometry)
unit_z = UnitZ(Factor=bridgw_height_2)
curve_middle = CurveMiddle(Curve=line)
move_3 = Move(Geometry=move.Geometry, Motion=vector_xyz_3.Vector)  # -> Geometry, Transform
unit_x = UnitX(Factor=division)
move_4 = Move(Geometry=curve_middle, Motion=unit_z)  # -> Geometry, Transform
negative_2 = Negative(Value=unit_x)
move_5 = Move(Geometry=move_4.Geometry, Motion=unit_x)  # -> Geometry, Transform
move_6 = Move(Geometry=move_4.Geometry, Motion=negative_2)  # -> Geometry, Transform
arc_crv = ClusterInput()
line_2 = Line(StartPoint=move_3.Geometry, EndPoint=move_5.Geometry)
line_3 = Line(StartPoint=move_6.Geometry, EndPoint=move_2.Geometry)
arc_crv_2 = Curve(arc_crv)
line_4 = Line(StartPoint=point, EndPoint=move_2.Geometry)
line_5 = Line(StartPoint=move.Geometry, EndPoint=move_3.Geometry)
line_6 = Line(StartPoint=move_6.Geometry, EndPoint=move_5.Geometry)
join_curves = JoinCurves(Curves=[line_6, line_2, line_3], Preserve=False)
unit_y = UnitY(Factor=bridge_width_2)
join_curves_2 = JoinCurves(Curves=[join_curves, line_4, line_5, arc_crv_2], Preserve=False)  # -> flatten(Curves)
boundary_surfaces = BoundarySurfaces(Edges=join_curves_2)
bridge_body_crv = Curve(join_curves)
extrude = Extrude(Base=boundary_surfaces, Direction=unit_y)
bridge_body_crv_2 = ClusterOutput(bridge_body_crv)
extrusion = ClusterOutput(extrude)

# ==== cluster NormalArcCluster
construct_point = ConstructPoint(XCoordinate=0, YCoordinate=0, ZCoordinate=0)
x_component = ClusterInput()
vector_xyz = VectorXYZ(XComponent=x_component, YComponent=Slider(0, range=0..10), ZComponent=Slider(0, range=0..10))  # -> Vector, Length
point = Point(construct_point)
move = Move(Geometry=point, Motion=vector_xyz.Vector)  # -> Geometry, Transform
factor = ClusterInput()
line = Line(StartPoint=point, EndPoint=move.Geometry)
unit_z = UnitZ(Factor=factor)
curve_middle = CurveMiddle(Curve=line)
move_2 = Move(Geometry=unit_z, Motion=curve_middle)  # -> Geometry, Transform
arc_3pt = Arc3Pt(PointA=point, PointB=move_2.Geometry, PointC=move.Geometry)  # -> Arc, Plane, Radius
arc = ClusterOutput(arc_3pt.Arc)
