# Grasshopper definition Stair_different_direction.gh (Grasshopper 1.0.7)

left_stair_hei = Slider(15.517, range=0..100)
right_stair_depth = Number(Slider(32, range=0..200))
elevation_difference = Number(Slider(0, range=-100..100))
left_landing = Number(Slider(102, range=0..1500))
right_landing = Number(Slider(108, range=0..1500))
addition = Addition(A=left_landing, B=right_landing)
bridge_length = Number(Slider(704, range=0..5000))
subtraction = Subtraction(A=bridge_length, B=addition)
left_stair_height = Number(left_stair_hei)
right_stair_depth_2 = Number(right_stair_depth)
water_width = Number(subtraction)
crv = Curve(<curve referenced from the Rhino model>)
_3 = Number(3)
len = Length(Curve=crv)
stairs_number = Number(_3)
newstreet_width = Number(len)
_2 = Number(2)
right_landing_2 = Number(right_landing)
water_width_2 = Number(water_width)
elevation_difference_2 = Number(elevation_difference)
left_stair_depth = Number(right_stair_depth_2)
stair_length = Number(left_stair_depth)
X = UnitX(Factor=stair_length)
neg = Negative(Value=X)
unit_x = UnitX(Factor=stair_length)
Y = UnitY(Factor=stair_length)
multiplication = Multiplication(A=stair_length, B=_2)
left_stair_height_2 = Number(left_stair_height)
stair_height = Number(left_stair_height_2)
Z = UnitZ(Factor=stair_height)
multiplication_2 = Multiplication(A=stair_height, B=stairs_number)
neg_2 = Negative(Value=multiplication_2)
Z_2 = UnitZ(Factor=neg_2)
neg_3 = Negative(Value=multiplication)
X_2 = UnitX(Factor=newstreet_width)
Y_2 = UnitY(Factor=neg_3)
unit_z = UnitZ(Factor=stair_height)
construct_point = ConstructPoint(XCoordinate=0, YCoordinate=0, ZCoordinate=0)
series = Series(Start=0, Step=unit_x, Count=stairs_number)  # -> graft(Series)
vector_xyz = VectorXYZ(XComponent=water_width_2, YComponent=Slider(0, range=0..10), ZComponent=Slider(0, range=0..50))  # -> Vector, Length
series_2 = Series(Start=0, Step=unit_z, Count=stairs_number)  # -> graft(Series)
vector_xyz_2 = VectorXYZ(XComponent=right_landing_2, YComponent=Slider(0, range=0..10), ZComponent=elevation_difference_2)  # -> Vector, Length
point = Point(construct_point)
move = Move(Geometry=point, Motion=vector_xyz.Vector)  # -> Geometry, Transform
vector_xyz_3 = VectorXYZ(XComponent=0, YComponent=series, ZComponent=series_2)  # -> Vector, Length
move_2 = Move(Geometry=move.Geometry, Motion=vector_xyz_2.Vector)  # -> Geometry, Transform
pt = Point(move_2.Geometry)
move_3 = Move(Geometry=pt, Motion=neg)  # -> Geometry, Transform
move_4 = Move(Geometry=move_3.Geometry, Motion=Z)  # -> Geometry, Transform
move_5 = Move(Geometry=move_4.Geometry, Motion=Z_2)  # -> Geometry, Transform
move_6 = Move(Geometry=move_5.Geometry, Motion=Y_2)  # -> Geometry, Transform
point_2 = Point(move_6.Geometry)
move_7 = Move(Geometry=point_2, Motion=unit_z)  # -> Geometry, Transform
move_8 = Move(Geometry=move_7.Geometry, Motion=Y)  # -> Geometry, Transform
polyline = PolyLine(Vertices=[point_2, move_7.Geometry, move_8.Geometry], Closed=False)
move_9 = Move(Geometry=polyline, Motion=vector_xyz_3.Vector)  # -> Geometry, Transform
join_curves = JoinCurves(Curves=flatten(move_9.Geometry), Preserve=False)
end_points = EndPoints(Curve=join_curves)  # -> Start, End
pt_2 = Point(end_points.Start)
pt_3 = Point(end_points.End)
line = Line(StartPoint=pt_2, EndPoint=pt_3)
join_curves_2 = JoinCurves(Curves=[join_curves, line], Preserve=False)
boundary_surfaces = BoundarySurfaces(Edges=join_curves_2)
extrude = Extrude(Base=boundary_surfaces, Direction=X_2)
brep = Brep(extrude)
