# Grasshopper definition SC028.gh (Grasshopper 1.0.7)

right_stair_height = Slider(35.6, range=0..100)
number_slider = Slider(10, range=0..100)
number_slider_2 = Slider(289, range=0..1000)
left_landing = Curve(<curve referenced from the Rhino model>)
right_stair_depth = Slider(38, range=0..200)
railing_width = Curve(<curve referenced from the Rhino model>)
right_stair_depth_2 = Curve(<curve referenced from the Rhino model>)
number_slider_3 = Slider(265, range=0..1500)
bridge_length = Curve(<curve referenced from the Rhino model>)
right_landing = Curve(<curve referenced from the Rhino model>)
bridge_width = Curve(<curve referenced from the Rhino model>)
water_width = Curve(<curve referenced from the Rhino model>)
left_stair_depth = Curve(<curve referenced from the Rhino model>)
left_stair_hei = Slider(35, range=0..100)
len = Length(Curve=right_stair_depth_2)
len_2 = Length(Curve=right_landing)
len_3 = Length(Curve=left_landing)
len_4 = Length(Curve=bridge_width)
len_5 = Length(Curve=left_stair_depth)
len_6 = Length(Curve=railing_width)
_65 = Number(80)
len_7 = Length(Curve=bridge_length)
len_8 = Length(Curve=water_width)
_2 = Number(2)
left_stair_depth_2 = Number(Slider(38, range=0..200))
left_stair_number = Number(Slider(13, range=0..50))
_2_2 = Number(2)
panel = Panel(len)
panel_2 = Panel(len_2)
panel_3 = Panel(len_3)
panel_4 = Panel(len_8)
panel_5 = Panel(len_4)
right_stair_depth_3 = Number(right_stair_depth)
subtraction = Subtraction(A=_65, B=right_stair_depth_3)
division = Division(A=subtraction, B=_2)
multiplication = Multiplication(A=left_stair_number, B=left_stair_depth_2)
panel_6 = Panel(len_6)
panel_7 = Panel(len_7)
subtraction_2 = Subtraction(A=_65, B=left_stair_depth_2)
right_stair_number = Number(Slider(13, range=0..50))
multiplication_2 = Multiplication(A=right_stair_number, B=right_stair_depth_3)
number_slider_4 = Slider(115, range=0..500)
bridge_length_2 = Number(Slider(1233, range=0..5000))
panel_8 = Panel(len_5)
right_landing_2 = Number(number_slider_3)
addition = Addition(A=multiplication, B=multiplication_2)
division_2 = Division(A=subtraction_2, B=_2_2)
stair_height = Number(division)
elevation_difference = Number(Slider(0, range=-100..100))
railing_width_2 = Number(number_slider)
railing_height = Number(number_slider_4)
bridge_width_2 = Number(number_slider_2)
left_landing_2 = Number(Slider(265, range=0..1500))
addition_2 = Addition(A=left_landing_2, B=right_landing_2)
subtraction_3 = Subtraction(A=bridge_length_2, B=addition_2)
arc_height = Number(Slider(274, range=0..1000))
panel_9 = Panel(stair_height)
subtraction_4 = Subtraction(A=bridge_length_2, B=addition)
water_width_2 = Number(subtraction_3)
right_stair_height_2 = Number(right_stair_height)
left_stair_number_2 = Number(left_stair_number)
right_stair_number_2 = Number(right_stair_number)
left_stair_height = Number(left_stair_hei)
multiplication_3 = Multiplication(A=left_stair_number, B=left_stair_height)
left_stair_depth_3 = Number(left_stair_depth_2)
right_stair_depth_4 = Number(right_stair_depth_3)
bridge_height = Number(multiplication_3)
panel_10 = Panel(water_width_2)
stair_height_2 = Number(division_2)
plane_length = Number(subtraction_4)

right_plain_width = Curve(<curve referenced from the Rhino model>)
left_plain_width = Curve(<curve referenced from the Rhino model>)
len_9 = Length(Curve=left_plain_width)
len_10 = Length(Curve=right_plain_width)
right_stair_plain_wid = Number(Slider(62, range=0..200))
left_stair_plain_wid = Number(Slider(62, range=0..252))
left_stair_height_2 = Number(left_stair_hei)
panel_11 = Panel(len_9)
panel_12 = Panel(len_10)
subtraction_5 = Subtraction(A=left_stair_plain_wid, B=left_stair_depth_2)
subtraction_6 = Subtraction(A=right_stair_plain_wid, B=right_stair_depth_3)
left_landing_3 = Number(left_landing_2)
addition_3 = Addition(A=subtraction_5, B=subtraction_6)
addition_4 = Addition(A=addition, B=addition_3)
number_slider_5 = Slider(0, range=0..100)
neg = Negative(Value=left_landing_3)
railing_width_3 = Number(Slider(27, range=0..100))
railing_height_2 = Number(Slider(121, range=0..500))
left_landing_4 = Number(left_landing_2)
number_slider_6 = Slider(100, range=0..100)
subtraction_7 = Subtraction(A=neg, B=number_slider_5)
neg_2 = Negative(Value=left_landing_4)
num = Number(0)
num_2 = Number(0)
pt = ConstructPoint(XCoordinate=0, YCoordinate=0, ZCoordinate=0)
water_width_3 = Number(subtraction_3)
right_landing_3 = Number(number_slider_3)
number_slider_7 = Slider(100, range=0..100)
subtraction_8 = Subtraction(A=neg_2, B=number_slider_6)
vec = VectorXYZ(XComponent=subtraction_7, YComponent=num, ZComponent=num_2)  # -> Vector, Length
pt_2 = Point(pt)
stairs_number = Number(Slider(7, range=0..10))
addition_5 = Addition(A=right_landing_3, B=water_width_3)
water_width_4 = Number(subtraction_3)
right_landing_4 = Number(number_slider_3)
stair_height_3 = Number(left_stair_height)
stair_length = Number(left_stair_depth_3)
num_3 = Number(0)
num_4 = Number(0)
number_slider_8 = Slider(0, range=0..100)
pt_3 = ConstructPoint(XCoordinate=0, YCoordinate=0, ZCoordinate=0)
stairs_number_2 = Number(Slider(7, range=0..10))
stair_height_4 = Number(left_stair_height)
stair_length_2 = Number(left_stair_depth_3)
addition_6 = Addition(A=right_landing_4, B=water_width_4)
vec_2 = VectorXYZ(XComponent=subtraction_8, YComponent=num_3, ZComponent=num_4)  # -> Vector, Length
addition_7 = Addition(A=addition_5, B=number_slider_7)
multiplication_4 = Multiplication(A=stair_length, B=stairs_number)
multiplication_5 = Multiplication(A=stair_height_3, B=stairs_number)
pt_4 = Point(pt_3)
multiplication_6 = Multiplication(A=stair_length_2, B=stairs_number_2)
multiplication_7 = Multiplication(A=stair_height_4, B=stairs_number_2)
num_5 = Number(0)
num_6 = Number(0)
addition_8 = Addition(A=addition_6, B=number_slider_8)
pt_5 = ConstructPoint(XCoordinate=0, YCoordinate=0, ZCoordinate=0)
move = Move(Geometry=pt_2, Motion=vec.Vector)  # -> Geometry, Transform
vec_3 = VectorXYZ(XComponent=multiplication_4, YComponent=0, ZComponent=multiplication_5)  # -> Vector, Length
num_7 = Number(0)
num_8 = Number(0)
vec_4 = VectorXYZ(XComponent=addition_7, YComponent=num_5, ZComponent=num_6)  # -> Vector, Length
neg_3 = Negative(Value=multiplication_6)
pt_6 = Point(pt_5)
pt_7 = ConstructPoint(XCoordinate=0, YCoordinate=0, ZCoordinate=0)

move_2 = Move(Geometry=pt_4, Motion=vec_2.Vector)  # -> Geometry, Transform
stairs_number_3 = Number(Slider(7, range=0..10))
railing_height_3 = Number(number_slider_4)
street_width = Number(bridge_width_2)
stair_length_3 = Number(left_stair_depth_3)
stair_height_5 = Number(left_stair_height)
thick = Number(number_slider_6)

vec_5 = VectorXYZ(XComponent=addition_8, YComponent=num_7, ZComponent=num_8)  # -> Vector, Length
vec_6 = VectorXYZ(XComponent=neg_3, YComponent=0, ZComponent=multiplication_7)  # -> Vector, Length
pt_8 = Point(pt_7)
railing_width_4 = Number(number_slider)
pt_9 = Point(vec_5.Vector)

move_3 = Move(Geometry=pt_6, Motion=vec_4.Vector)  # -> Geometry, Transform
stairs_number_4 = Number(Slider(7, range=0..10))
railing_height_4 = Number(number_slider_4)
street_width_2 = Number(bridge_width_2)
stair_length_4 = Number(left_stair_depth_3)
stair_height_6 = Number(left_stair_height)
thick_2 = Number(number_slider_7)

railing_width_5 = Number(number_slider)

stairs_number_5 = Number(Slider(6, range=0..10))
street_width_3 = Number(bridge_width_2)
stair_length_5 = Number(left_stair_depth_3)
move_4 = Move(Geometry=move.Geometry, Motion=vec_3.Vector)  # -> Geometry, Transform
stair_height_7 = Number(left_stair_height)
railing_height_5 = Number(number_slider_4)
thick_3 = Number(number_slider_5)

railing_width_6 = Number(number_slider)

move_5 = Move(Geometry=pt_9, Motion=vec_6.Vector)  # -> Geometry, Transform
stairs_number_6 = Number(Slider(6, range=0..10))
street_width_4 = Number(bridge_width_2)
stair_length_6 = Number(left_stair_depth_3)
stair_height_8 = Number(left_stair_height)
railing_height_6 = Number(number_slider_4)
thick_4 = Number(number_slider_8)
railing_width_7 = Number(number_slider)

railing_width_8 = Number(number_slider)
neg_4 = Negative(Value=stair_length_4)
neg_5 = Negative(Value=stair_length_6)

Z = UnitZ(Factor=stair_height_5)
X = UnitX(Factor=stair_length_3)
Y = UnitY(Factor=street_width)
pt_10 = Point(move_2.Geometry)
move_6 = Move(Geometry=pt_10, Motion=Z)  # -> Geometry, Transform
series = Series(Start=0, Step=X, Count=stairs_number_3)  # -> graft(Series)
series_2 = Series(Start=0, Step=Z, Count=stairs_number_3)  # -> graft(Series)
move_7 = Move(Geometry=move_6.Geometry, Motion=X)  # -> Geometry, Transform
pline = PolyLine(Vertices=[pt_10, move_6.Geometry, move_7.Geometry], Closed=False)
vec_7 = VectorXYZ(XComponent=series, YComponent=0, ZComponent=series_2)  # -> Vector, Length
move_8 = Move(Geometry=pline, Motion=vec_7.Vector)  # -> Geometry, Transform
join = JoinCurves(Curves=flatten(move_8.Geometry), Preserve=False)  # -> flatten(Curves)
X_2 = UnitX(Factor=thick)
end = EndPoints(Curve=join)  # -> Start, End
pt_11 = Point(pt_10)
pt_12 = Point(end.End)
move_9 = Move(Geometry=pt_12, Motion=X_2)  # -> Geometry, Transform
move_10 = Move(Geometry=pt_11, Motion=X_2)  # -> Geometry, Transform
ln = Line(StartPoint=pt_11, EndPoint=pt_12)
ln_2 = Line(StartPoint=pt_12, EndPoint=move_9.Geometry)
ln_3 = Line(StartPoint=pt_11, EndPoint=move_10.Geometry)
ln_4 = Line(StartPoint=move_10.Geometry, EndPoint=move_9.Geometry)
join_2 = JoinCurves(Curves=[join, ln_3, ln_2, ln_4], Preserve=False)
boundary = BoundarySurfaces(Edges=join_2)
extr = Extrude(Base=boundary, Direction=Y)

Z_2 = UnitZ(Factor=stair_height_7)
X_3 = UnitX(Factor=stair_length_5)
Y_2 = UnitY(Factor=street_width_3)
pt_13 = Point(move_4.Geometry)
move_11 = Move(Geometry=pt_13, Motion=Z_2)  # -> Geometry, Transform
series_3 = Series(Start=0, Step=X_3, Count=stairs_number_5)  # -> graft(Series)
series_4 = Series(Start=0, Step=Z_2, Count=stairs_number_5)  # -> graft(Series)
move_12 = Move(Geometry=move_11.Geometry, Motion=X_3)  # -> Geometry, Transform
pline_2 = PolyLine(Vertices=[pt_13, move_11.Geometry, move_12.Geometry], Closed=False)
vec_8 = VectorXYZ(XComponent=series_3, YComponent=0, ZComponent=series_4)  # -> Vector, Length
move_13 = Move(Geometry=pline_2, Motion=vec_8.Vector)  # -> Geometry, Transform
join_3 = JoinCurves(Curves=flatten(move_13.Geometry), Preserve=False)  # -> flatten(Curves)
X_4 = UnitX(Factor=thick_3)
end_2 = EndPoints(Curve=join_3)  # -> Start, End
pt_14 = Point(pt_13)
pt_15 = Point(end_2.End)
move_14 = Move(Geometry=pt_15, Motion=X_4)  # -> Geometry, Transform
move_15 = Move(Geometry=pt_14, Motion=X_4)  # -> Geometry, Transform
ln_5 = Line(StartPoint=pt_14, EndPoint=pt_15)
ln_6 = Line(StartPoint=pt_15, EndPoint=move_14.Geometry)
ln_7 = Line(StartPoint=pt_14, EndPoint=move_15.Geometry)
ln_8 = Line(StartPoint=move_15.Geometry, EndPoint=move_14.Geometry)
join_4 = JoinCurves(Curves=[join_3, ln_7, ln_6, ln_8], Preserve=False)
boundary_2 = BoundarySurfaces(Edges=join_4)
extr_2 = Extrude(Base=boundary_2, Direction=Y_2)

arc_height_2 = Number(arc_height)
water_width_5 = Number(water_width_2)
_3_point_arc_cluster = _3PointArcCluster(water_width=water_width_5, arc_height=arc_height_2)
normal_arc = Curve(_3_point_arc_cluster)

arc_height_3 = Number(arc_height)
water_width_6 = Number(water_width_2)
normal_arc_cluster = NormalArcCluster(factor=arc_height_3, x_component=water_width_6)
crv = Curve(normal_arc_cluster)

panel_13 = Panel("arc")
number_slider_9 = Slider(13, range=0..100)

arc_crv = Curve(normal_arc)

crv_2 = Curve(<curve referenced from the Rhino model>)
_3 = Number(0)
_3_2 = Number(0)
multiplication_8 = Multiplication(A=left_stair_depth_3, B=_3)
multiplication_9 = Multiplication(A=right_stair_depth_4, B=_3_2)
len_11 = Length(Curve=crv_2)
right_down_point = Point()
neg_6 = Negative(Value=number_slider_9)
neg_7 = Negative(Value=thick_2)
addition_9 = Addition(A=multiplication_8, B=multiplication_9)
neg_8 = Negative(Value=thick_4)
subtraction_9 = Subtraction(A=water_width_2, B=addition_9)
vec_9 = VectorXYZ(XComponent=len_11, YComponent=0, ZComponent=neg_6)  # -> Vector, Length
right_stair_height_3 = Number(right_stair_height)
right_stair_depth_5 = Number(right_stair_depth_3)
bridge_width_3 = Number(number_slider_2)
move_16 = Move(Geometry=right_down_point, Motion=vec_9.Vector)  # -> Geometry, Transform

right_landing_5 = Number(right_landing_2)
elevation_difference_2 = Number(elevation_difference)
water_width_7 = Number(water_width_2)
stairs_number_7 = Number(right_stair_number_2)
stair_height_9 = Number(right_stair_height_2)
stair_length_7 = Number(right_stair_depth_4)
street_width_5 = Number(bridge_width_2)
right_stairs_cluster = RightStairsCluster(
    water_width=water_width_7,
    right_landing=right_landing_5,
    elevation_difference=elevation_difference_2,
    stair_length=stair_length_7,
    stair_height=stair_height_9,
    stairs_number=stairs_number_7,
    street_width=street_width_5)
brep = Brep(right_stairs_cluster)

round_step_number = Slider(2, range=0..5)
step_height = Number(number_slider_9)
step_length = Number(right_stair_depth_5)
right_front_stairs_generator = RightFrontStairsGenerator(bottom_start_pt=move_16.Geometry, step_height=step_height, round_step_num=round_step_number, step_length=step_length)
brep_2 = Brep(right_front_stairs_generator)

Z_3 = UnitZ(Factor=railing_height_3)

left_landing_5 = Number(left_landing_2)
stair_length_8 = Number(left_stair_depth_3)
stair_height_10 = Number(left_stair_height)
stairs_number_8 = Number(left_stair_number_2)
street_width_6 = Number(bridge_width_2)
left_stairs_cluster = LeftStairsCluster(
    left_landing=left_landing_5,
    stair_length=stair_length_8,
    stair_height=stair_height_10,
    stairs_number=stairs_number_8,
    street_width=street_width_6)
brep_3 = Brep(left_stairs_cluster)

Z_4 = UnitZ(Factor=railing_height_5)
Z_5 = UnitZ(Factor=railing_height_4)
join_5 = JoinCurves(Curves=ln, Preserve=False)
Z_6 = UnitZ(Factor=railing_height_6)
join_6 = JoinCurves(Curves=ln_2, Preserve=False)
move_17 = Move(Geometry=join_5, Motion=Z_3)  # -> Geometry, Transform
join_7 = JoinCurves(Curves=ln_5, Preserve=False)
move_18 = Move(Geometry=join_6, Motion=Z_3)  # -> Geometry, Transform
move_19 = Move(Geometry=join_7, Motion=Z_4)  # -> Geometry, Transform
end_3 = EndPoints(Curve=move_17.Geometry)  # -> Start, End
end_4 = EndPoints(Curve=move_18.Geometry)  # -> Start, End
ln_9 = Line(StartPoint=end_3.Start, EndPoint=pt_11)
end_5 = EndPoints(Curve=move_19.Geometry)  # -> Start, End
ln_10 = Line(StartPoint=end_4.Start, EndPoint=pt_12)

street_width_7 = Number(bridge_width_2)
bridge_height_2 = Number(bridge_height)
elevation_difference_3 = Number(elevation_difference)
water_width_8 = Number(water_width_2)
plane_width = Number(plane_length)
left_landing_6 = Number(left_landing_2)
right_landing_6 = Number(right_landing_2)
bridge_body_cluster = BridgeBodyCluster(
    bridge_width=street_width_7,
    plane_width=plane_width,
    bridgw_height=bridge_height_2,
    arc_crv=crv,
    water_width=water_width_8,
    left_landing=left_landing_6,
    right_landing=right_landing_6,
    elevation_difference=elevation_difference_3)  # -> extrusion, bridge_body_crv_2
bridge_body_crv = Curve(bridge_body_cluster.bridge_body_crv_2)
brep_4 = Brep(bridge_body_cluster.extrusion)

ln_11 = Line(StartPoint=end_5.Start, EndPoint=pt_14)
arrcurve = CurveArray(Geometry=ln_9, Curve=join_5, Count=10)  # -> Geometry, Transform
arrcurve_2 = CurveArray(Geometry=ln_10, Curve=join_6, Count=10)  # -> Geometry, Transform
arrcurve_3 = CurveArray(Geometry=ln_11, Curve=join_7, Count=10)  # -> Geometry, Transform
pipe = Pipe(Curve=move_18.Geometry, Radius=railing_width_4, Caps=0)
pipe_2 = Pipe(Curve=arrcurve_2.Geometry, Radius=railing_width_4, Caps=0)
pipe_3 = Pipe(Curve=move_17.Geometry, Radius=railing_width_4, Caps=0)
pipe_4 = Pipe(Curve=arrcurve.Geometry, Radius=railing_width_4, Caps=0)
pipe_5 = Pipe(Curve=move_19.Geometry, Radius=railing_width_6, Caps=0)
pipe_6 = Pipe(Curve=arrcurve_3.Geometry, Radius=railing_width_6, Caps=0)
area = Area(Geometry=brep_4)  # -> Area, Centroid
xz = XZPlane(Origin=area.Centroid)

street_width_8 = Number(bridge_width_2)
plane_width_2 = Number(plane_length)
left_stair_height_3 = Number(left_stair_height)
railing_height_7 = Number(railing_height)
left_stair_num = Number(left_stair_number_2)
railing_width_9 = Number(railing_width_2)
elevation_difference_4 = Number(elevation_difference)
right_landing_7 = Number(right_landing_2)
water_width_9 = Number(subtraction_9)
left_landing_7 = Number(left_landing_2)
railing_cluster = RailingCluster(
    street_width=street_width_8,
    plane_width=plane_width_2,
    water_width=water_width_9,
    left_landing=left_landing_7,
    right_landing=right_landing_7,
    elevation_difference=elevation_difference_4,
    railing_height=railing_height_7,
    left_stair_height=left_stair_height_3,
    left_stair_num=left_stair_num,
    railing_width=railing_width_9)
brep_5 = Brep(railing_cluster)

street_width_9 = Number(bridge_width_2)
railding_width = Number(railing_width_2)
bridge_body_crv_2 = Curve(bridge_body_crv)
rialing_height = Number(railing_height)
railing_wall_cluster = RailingWallCluster(
    street_width=street_width_9,
    bridge_body_crv=bridge_body_crv_2,
    rialing_height=rialing_height,
    railding_width=railding_width)
railing_brep = Brep(railing_wall_cluster)

preview = CustomPreview(Geometry=railing_brep, Material=ColourSwatch(SwatchColor=RGB(102, 39, 7)))

Z_7 = UnitZ(Factor=stair_height_6)
X_5 = UnitX(Factor=neg_4)
Y_3 = UnitY(Factor=street_width_2)
pt_16 = Point(move_3.Geometry)
move_20 = Move(Geometry=pt_16, Motion=Z_7)  # -> Geometry, Transform
series_5 = Series(Start=0, Step=X_5, Count=stairs_number_4)  # -> graft(Series)
series_6 = Series(Start=0, Step=Z_7, Count=stairs_number_4)  # -> graft(Series)
move_21 = Move(Geometry=move_20.Geometry, Motion=X_5)  # -> Geometry, Transform
pline_3 = PolyLine(Vertices=[pt_16, move_20.Geometry, move_21.Geometry], Closed=False)
X_6 = UnitX(Factor=neg_7)
pt_17 = Point(pt_16)
move_22 = Move(Geometry=pt_17, Motion=X_6)  # -> Geometry, Transform
ln_12 = Line(StartPoint=pt_17, EndPoint=move_22.Geometry)

neg_9 = Negative(Value=series_5)

vec_10 = VectorXYZ(XComponent=neg_9, YComponent=0, ZComponent=series_6)  # -> Vector, Length
move_23 = Move(Geometry=pline_3, Motion=vec_10.Vector)  # -> Geometry, Transform
join_8 = JoinCurves(Curves=flatten(move_23.Geometry), Preserve=False)  # -> flatten(Curves)
end_6 = EndPoints(Curve=join_8)  # -> Start, End
pt_18 = Point(end_6.End)
move_24 = Move(Geometry=pt_18, Motion=X_6)  # -> Geometry, Transform
ln_13 = Line(StartPoint=pt_17, EndPoint=pt_18)
ln_14 = Line(StartPoint=pt_18, EndPoint=move_24.Geometry)
ln_15 = Line(StartPoint=move_22.Geometry, EndPoint=move_24.Geometry)
join_9 = JoinCurves(Curves=[join_8, ln_12, ln_14, ln_15], Preserve=False)
boundary_3 = BoundarySurfaces(Edges=join_9)
extr_3 = Extrude(Base=boundary_3, Direction=Y_3)

join_10 = JoinCurves(Curves=ln_13, Preserve=False)
join_11 = JoinCurves(Curves=ln_14, Preserve=False)
move_25 = Move(Geometry=join_10, Motion=Z_5)  # -> Geometry, Transform
move_26 = Move(Geometry=join_11, Motion=Z_5)  # -> Geometry, Transform
end_7 = EndPoints(Curve=move_25.Geometry)  # -> Start, End
end_8 = EndPoints(Curve=move_26.Geometry)  # -> Start, End
ln_16 = Line(StartPoint=end_7.Start, EndPoint=pt_17)
ln_17 = Line(StartPoint=end_8.Start, EndPoint=pt_18)
arrcurve_4 = CurveArray(Geometry=ln_16, Curve=join_10, Count=10)  # -> Geometry, Transform
arrcurve_5 = CurveArray(Geometry=ln_17, Curve=join_11, Count=10)  # -> Geometry, Transform
pipe_7 = Pipe(Curve=move_26.Geometry, Radius=railing_width_5, Caps=0)
pipe_8 = Pipe(Curve=arrcurve_5.Geometry, Radius=railing_width_5, Caps=0)
pipe_9 = Pipe(Curve=move_25.Geometry, Radius=railing_width_5, Caps=0)
pipe_10 = Pipe(Curve=arrcurve_4.Geometry, Radius=railing_width_5, Caps=0)

Z_8 = UnitZ(Factor=stair_height_8)
X_7 = UnitX(Factor=neg_5)
Y_4 = UnitY(Factor=street_width_4)
pt_19 = Point(move_5.Geometry)
move_27 = Move(Geometry=pt_19, Motion=Z_8)  # -> Geometry, Transform
series_7 = Series(Start=0, Step=X_7, Count=stairs_number_6)  # -> graft(Series)
series_8 = Series(Start=0, Step=Z_8, Count=stairs_number_6)  # -> graft(Series)
move_28 = Move(Geometry=move_27.Geometry, Motion=X_7)  # -> Geometry, Transform
pline_4 = PolyLine(Vertices=[pt_19, move_27.Geometry, move_28.Geometry], Closed=False)
X_8 = UnitX(Factor=neg_8)
pt_20 = Point(pt_19)
move_29 = Move(Geometry=pt_20, Motion=X_8)  # -> Geometry, Transform
ln_18 = Line(StartPoint=pt_20, EndPoint=move_29.Geometry)

neg_10 = Negative(Value=series_7)

vec_11 = VectorXYZ(XComponent=neg_10, YComponent=0, ZComponent=series_8)  # -> Vector, Length
move_30 = Move(Geometry=pline_4, Motion=vec_11.Vector)  # -> Geometry, Transform
join_12 = JoinCurves(Curves=flatten(move_30.Geometry), Preserve=False)  # -> flatten(Curves)
end_9 = EndPoints(Curve=join_12)  # -> Start, End
pt_21 = Point(end_9.End)
move_31 = Move(Geometry=pt_21, Motion=X_8)  # -> Geometry, Transform
ln_19 = Line(StartPoint=pt_20, EndPoint=pt_21)
ln_20 = Line(StartPoint=pt_21, EndPoint=move_31.Geometry)
ln_21 = Line(StartPoint=move_29.Geometry, EndPoint=move_31.Geometry)
join_13 = JoinCurves(Curves=[join_12, ln_18, ln_20, ln_21], Preserve=False)
boundary_4 = BoundarySurfaces(Edges=join_13)
extr_4 = Extrude(Base=boundary_4, Direction=Y_4)

join_14 = JoinCurves(Curves=ln_19, Preserve=False)
move_32 = Move(Geometry=join_14, Motion=Z_6)  # -> Geometry, Transform
end_10 = EndPoints(Curve=move_32.Geometry)  # -> Start, End
ln_22 = Line(StartPoint=end_10.Start, EndPoint=pt_20)
arrcurve_6 = CurveArray(Geometry=ln_22, Curve=join_14, Count=10)  # -> Geometry, Transform
brep_6 = Brep([extr_2, extr, extr_3, extr_4])
pipe_11 = Pipe(Curve=move_32.Geometry, Radius=railing_width_8, Caps=0)
pipe_12 = Pipe(Curve=arrcurve_6.Geometry, Radius=railing_width_8, Caps=0)
brep_7 = Brep(flatten([brep_6, brep_4]))
preview_2 = CustomPreview(Geometry=brep_7, Material=ColourSwatch(SwatchColor=RGB(186, 130, 65)))
brep_8 = Brep([pipe_3, pipe, pipe_2, pipe_4, pipe_5, pipe_6, pipe_7, pipe_8, pipe_9, pipe_10, pipe_11, pipe_12])
mirror = Mirror(Geometry=brep_8, Plane=xz)  # -> Geometry, Transform
brep_9 = Brep([mirror.Geometry, brep_8, brep_5])
preview_3 = CustomPreview(Geometry=brep_9, Material=ColourSwatch(SwatchColor=RGB(102, 39, 7)))

# ==== cluster RightFrontStairsGenerator
step_height = ClusterInput()
round_step_num = ClusterInput()
step_length = ClusterInput()
step_height_2 = Number(step_height)
round_step_num_2 = Number(round_step_num)
number = Number(1)
step_length_2 = Number(step_length)
subtraction = Subtraction(A=round_step_num_2, B=number)
multiplication = Multiplication(A=round_step_num_2, B=step_length_2)
multiplication_2 = Multiplication(A=subtraction, B=step_height_2)
Z = UnitZ(Factor=step_height_2)
neg = Negative(Value=multiplication)
Z_2 = UnitZ(Factor=multiplication_2)
neg_2 = Negative(Value=step_length_2)
X = UnitX(Factor=neg)
Y = UnitY(Factor=neg)
Y_2 = UnitY(Factor=neg_2)
X_2 = UnitX(Factor=step_length_2)
bottom_start_pt = ClusterInput()
multiplication_3 = Multiplication(A=Z, B=round_step_num_2)
bottom_start_pt_2 = Point(bottom_start_pt)
move = Move(Geometry=bottom_start_pt_2, Motion=X)  # -> Geometry, Transform
pt = Point(move.Geometry)
move_2 = Move(Geometry=pt, Motion=Z_2)  # -> Geometry, Transform
move_3 = Move(Geometry=pt, Motion=Y)  # -> Geometry, Transform
bottom_endpt = Point(move_3.Geometry)
move_4 = Move(Geometry=pt, Motion=multiplication_3)  # -> Geometry, Transform
pt_2 = Point(move_2.Geometry)
move_5 = Move(Geometry=pt_2, Motion=Y_2)  # -> Geometry, Transform
move_6 = Move(Geometry=pt_2, Motion=X_2)  # -> Geometry, Transform
pt_3 = Point(move_5.Geometry)
pt_4 = Point(move_6.Geometry)
arc = ArcSED(Start=bottom_start_pt_2, End=bottom_endpt, Direction=Y)  # -> Arc, Plane, Radius
arc_2 = ArcSED(Start=pt_4, End=pt_3, Direction=Y)  # -> Arc, Plane, Radius
top_pt = Point(move_4.Geometry)
move_7 = Move(Geometry=top_pt, Motion=X_2)  # -> Geometry, Transform
move_8 = Move(Geometry=top_pt, Motion=Y_2)  # -> Geometry, Transform
top_end_pt = Point(move_8.Geometry)
top_start_pt = Point(move_7.Geometry)
second_crv = Curve(arc_2.Arc)
bottom_crv = Curve(arc.Arc)
arc_3 = ArcSED(Start=top_start_pt, End=top_end_pt, Direction=Y)  # -> Arc, Plane, Radius
range = Range(Domain=Domain(0, 1), Steps=subtraction)
ln = Line(StartPoint=top_start_pt, EndPoint=top_pt)
ln_2 = Line(StartPoint=top_pt, EndPoint=top_end_pt)
ln_3 = Line(StartPoint=pt, EndPoint=top_pt)
ln_4 = Line(StartPoint=pt, EndPoint=bottom_endpt)
ln_5 = Line(StartPoint=bottom_start_pt_2, EndPoint=pt)
ln_6 = Line(StartPoint=pt, EndPoint=bottom_endpt)
crv = Curve(arc_3.Arc)
tweencrv = TweenCurve(CurveA=second_crv, CurveB=bottom_crv, Factor=range, BlendType=0)  # -> flatten(Tween)
street_width = Number(177)
extr = Extrude(Base=tweencrv, Direction=Z)
join = JoinCurves(Curves=[ln_2, ln, crv], Preserve=False)
join_2 = JoinCurves(Curves=[ln_6, bottom_crv, ln_5], Preserve=False)
num = Number(2)
debrep = DeconstructBrep(Brep=extr)  # -> Faces, Edges, Vertices
item = ListItem(List=debrep.Edges, Index=0, Wrap=True)  # -> Item, Item1, Item2, Item3, Item4
crv_2 = Curve(flatten(item.Item4))
division = Division(A=street_width, B=num)
crv_3 = Curve(flatten(item.Item2))
crv_4 = Curve(flatten(item.Item3))
crv_5 = Curve(flatten(item.Item1))
Y_3 = UnitY(Factor=division)
boundary_surfaces = BoundarySurfaces(Edges=join)
cull_i = CullIndex(List=flatten(crv_4), Indices="-1", Wrap=True)  # -> graft(List)
boundary_surfaces_2 = BoundarySurfaces(Edges=join_2)
cull_i_2 = CullIndex(List=flatten(crv_5), Indices="0", Wrap=True)  # -> graft(List)
flip = FlipCurve(Curve=cull_i)  # -> Curve, Flag
crv_6 = Curve([cull_i_2, flip.Curve])
loft = Loft(Curves=crv_6, Options={Adjust=False, Closed=False, LoftEnds=0, LoftSimp=0, LoftType=0, Rebuild=10, Refit=0.01})
debrep_2 = DeconstructBrep(Brep=loft)  # -> Faces, Edges, Vertices
item_2 = ListItem(List=debrep_2.Edges, Index=0, Wrap=True)  # -> Item, Item1, Item2, Item3, Item4
crv_7 = Curve(flatten(item_2.Item4))
join_3 = JoinCurves(Curves=[crv_7, crv_2], Preserve=False)  # -> flatten(Curves)
crv_8 = Curve(join_3)
join_4 = JoinCurves(Curves=[crv_8, ln_5, ln_3, ln], Preserve=False)
crv_9 = Curve(flatten(item_2.Item2))
join_5 = JoinCurves(Curves=[crv_9, crv_3], Preserve=False)
crv_10 = Curve(join_5)
join_6 = JoinCurves(Curves=[ln_3, crv_10, ln_4, ln_2], Preserve=False)
boundary_surfaces_3 = BoundarySurfaces(Edges=join_6)
boundary_surfaces_4 = BoundarySurfaces(Edges=join_4)
extr_2 = Extrude(Base=boundary_surfaces_4, Direction=Y_3)
move_9 = Move(Geometry=boundary_surfaces_4, Motion=Y_3)  # -> Geometry, Transform
brep = Brep([extr, boundary_surfaces_3, loft, boundary_surfaces, boundary_surfaces_2])
mirror = Mirror(Geometry=[extr_2, brep], Plane=move_9.Geometry)  # -> Geometry, Transform
brep_2 = Brep(mirror.Geometry)
brep_3 = Brep([brep, brep_2, extr_2])
brep_4 = ClusterOutput(brep_3)

# ==== cluster RailingWallCluster
bridge_body_crv = ClusterInput()
railding_width = ClusterInput()
rialing_height = ClusterInput()
street_width = ClusterInput()
bridge_body_crv_2 = Curve(bridge_body_crv)
railding_width_2 = Number(railding_width)
rialing_height_2 = Number(rialing_height)
street_width_2 = Number(street_width)
unit_z = UnitZ(Factor=rialing_height_2)
unit_y = UnitY(Factor=railding_width_2)
extrude = Extrude(Base=bridge_body_crv_2, Direction=unit_z)
subtraction = Subtraction(A=street_width_2, B=railding_width_2)
extrude_2 = Extrude(Base=extrude, Direction=unit_y)
unit_y_2 = UnitY(Factor=subtraction)
move = Move(Geometry=extrude_2, Motion=unit_y_2)  # -> Geometry, Transform
brep = Brep([move.Geometry, extrude_2])
brep_2 = ClusterOutput(brep)

# ==== cluster _3PointArcCluster
water_width = ClusterInput()
arc_height = ClusterInput()
water_width_2 = Number(water_width)
arc_height_2 = Number(arc_height)
construct_point = ConstructPoint(XCoordinate=0, YCoordinate=0, ZCoordinate=0)
_2 = Number(2)
unit_x = UnitX(Factor=water_width_2)
unit_z = UnitZ(Factor=arc_height_2)
division = Division(A=water_width_2, B=_2)
A = Point(construct_point)
move = Move(Geometry=A, Motion=unit_x)  # -> Geometry, Transform
unit_z_2 = UnitZ(Factor=division)
B = Point(move.Geometry)
line = Line(StartPoint=A, EndPoint=B)
curve_middle = CurveMiddle(Curve=line)
H = Point(curve_middle)
move_2 = Move(Geometry=curve_middle, Motion=unit_z)  # -> Geometry, Transform
move_3 = Move(Geometry=curve_middle, Motion=unit_z_2)  # -> Geometry, Transform
yz_plane = YZPlane(Origin=H)
C = Point(move_2.Geometry)
distance = Distance(PointA=C, PointB=move_3.Geometry)
xz_plane = XZPlane(Origin=C)
line_2 = Line(StartPoint=B, EndPoint=C)
line_3 = Line(StartPoint=A, EndPoint=C)
circle = Circle(Plane=xz_plane, Radius=distance)
curve_line = CurveLine(Curve=circle, Line=line_3)  # -> Points, Params, Count
curve_line_2 = CurveLine(Curve=circle, Line=line_2)  # -> Points, Params, Count
_1 = Number(1)
list_item = ListItem(List=curve_line.Points, Index=_1, Wrap=True)
list_item_2 = ListItem(List=curve_line_2.Points, Index=_1, Wrap=True)
M = Point(list_item)
N = Point(list_item_2)
line_4 = Line(StartPoint=N, EndPoint=B)
line_5 = Line(StartPoint=M, EndPoint=A)
curve_middle_2 = CurveMiddle(Curve=line_4)
curve_middle_3 = CurveMiddle(Curve=line_5)
curve_closest_point = CurveClosestPoint(Point=curve_middle_3, Curve=line)  # -> Point, Parameter, Distance
distance_2 = Distance(PointA=M, PointB=curve_middle_3)
square = Square(Value=curve_closest_point.Distance)
square_2 = Square(Value=distance_2)
subtraction = Subtraction(A=square_2, B=square)
square_root = SquareRoot(Value=subtraction)
division_2 = Division(A=square_2, B=square_root)
negative = Negative(Value=division_2)
unit_x_2 = UnitX(Factor=negative)
unit_x_3 = UnitX(Factor=division_2)
move_4 = Move(Geometry=A, Motion=unit_x_3)  # -> Geometry, Transform
move_5 = Move(Geometry=B, Motion=unit_x_2)  # -> Geometry, Transform
E = Point(move_4.Geometry)
line_6 = Line(StartPoint=move_4.Geometry, EndPoint=curve_middle_3)
line_7 = Line(StartPoint=move_5.Geometry, EndPoint=curve_middle_2)
xz_plane_2 = XZPlane(Origin=move_4.Geometry)
F = Point(move_5.Geometry)
line_line = LineLine(Line1=line_6, Line2=line_7)  # -> ParamA, ParamB, PointA, PointB
G = Point(line_line.PointA)
distance_3 = Distance(PointA=C, PointB=line_line.PointA)
xz_plane_3 = XZPlane(Origin=line_line.PointA)
circle_2 = Circle(Plane=xz_plane_2, Radius=division_2)
circle_3 = Circle(Plane=xz_plane_3, Radius=distance_3)
curve_curve = CurveCurve(CurveA=circle_2, CurveB=circle_3)  # -> Points, ParamsA, ParamsB
negative_2 = Negative(Value=Slider(1, range=0..1))
unit_x_4 = UnitX(Factor=negative_2)
unit_z_3 = UnitZ(Factor=1)
point = Point(curve_curve.Points)
arc_sed = ArcSED(Start=C, End=point, Direction=unit_x_4)  # -> Arc, Plane, Radius
arc_sed_2 = ArcSED(Start=A, End=point, Direction=unit_z_3)  # -> Arc, Plane, Radius
join_curves = JoinCurves(Curves=[arc_sed.Arc, arc_sed_2.Arc], Preserve=False)
mirror = Mirror(Geometry=join_curves, Plane=yz_plane)  # -> Geometry, Transform
join_curves_2 = JoinCurves(Curves=[join_curves, mirror.Geometry], Preserve=False)
curves = ClusterOutput(join_curves_2)

# ==== cluster LeftStairsCluster
left_landing = ClusterInput()
left_landing_2 = Number(left_landing)
construct_point = ConstructPoint(XCoordinate=0, YCoordinate=0, ZCoordinate=0)
negative = Negative(Value=left_landing_2)
num = Number(0)
num_2 = Number(0)
vector_xyz = VectorXYZ(XComponent=negative, YComponent=num, ZComponent=num_2)  # -> Vector, Length
stair_length = ClusterInput()
stair_height = ClusterInput()
stairs_number = ClusterInput()
point = Point(construct_point)
street_width = ClusterInput()
stair_length_2 = Number(stair_length)
stair_height_2 = Number(stair_height)
stairs_number_2 = Number(stairs_number)
street_width_2 = Number(street_width)
unit_x = UnitX(Factor=stair_length_2)
move = Move(Geometry=point, Motion=vector_xyz.Vector)  # -> Geometry, Transform
Y = UnitY(Factor=street_width_2)
unit_z = UnitZ(Factor=stair_height_2)
point_2 = Point(move.Geometry)
move_2 = Move(Geometry=point_2, Motion=unit_z)  # -> Geometry, Transform
series = Series(Start=0, Step=unit_x, Count=stairs_number_2)  # -> graft(Series)
series_2 = Series(Start=0, Step=unit_z, Count=stairs_number_2)  # -> graft(Series)
move_3 = Move(Geometry=move_2.Geometry, Motion=unit_x)  # -> Geometry, Transform
vector_xyz_2 = VectorXYZ(XComponent=series, YComponent=0, ZComponent=series_2)  # -> Vector, Length
polyline = PolyLine(Vertices=[point_2, move_2.Geometry, move_3.Geometry], Closed=False)
move_4 = Move(Geometry=polyline, Motion=vector_xyz_2.Vector)  # -> Geometry, Transform
join_curves = JoinCurves(Curves=flatten(move_4.Geometry), Preserve=False)
end_points = EndPoints(Curve=join_curves)  # -> Start, End
pt = Point(end_points.Start)
pt_2 = Point(end_points.End)
line = Line(StartPoint=pt, EndPoint=pt_2)
join_curves_2 = JoinCurves(Curves=[join_curves, line], Preserve=False)
boundary_surfaces = BoundarySurfaces(Edges=join_curves_2)
extrude = Extrude(Base=boundary_surfaces, Direction=Y)
extrusion = ClusterOutput(extrude)

# ==== cluster RightStairsCluster
water_width = ClusterInput()
right_landing = ClusterInput()
elevation_difference = ClusterInput()
water_width_2 = Number(water_width)
right_landing_2 = Number(right_landing)
elevation_difference_2 = Number(elevation_difference)
num = Number(0)
construct_point = ConstructPoint(XCoordinate=0, YCoordinate=0, ZCoordinate=0)
num_2 = Number(0)
vector_xyz = VectorXYZ(XComponent=water_width_2, YComponent=num, ZComponent=num)  # -> Vector, Length
vector_xyz_2 = VectorXYZ(XComponent=right_landing_2, YComponent=num_2, ZComponent=elevation_difference_2)  # -> Vector, Length
point = Point(construct_point)
move = Move(Geometry=point, Motion=vector_xyz.Vector)  # -> Geometry, Transform
stair_length = ClusterInput()
stairs_number = ClusterInput()
stair_height = ClusterInput()
stair_length_2 = Number(stair_length)
street_width = ClusterInput()
stairs_number_2 = Number(stairs_number)
stair_height_2 = Number(stair_height)
unit_x = UnitX(Factor=stair_length_2)
street_width_2 = Number(street_width)
move_2 = Move(Geometry=move.Geometry, Motion=vector_xyz_2.Vector)  # -> Geometry, Transform
unit_z = UnitZ(Factor=stair_height_2)
negative = Negative(Value=unit_x)
point_2 = Point(move_2.Geometry)
panel = Panel("stairs")
move_3 = Move(Geometry=point_2, Motion=unit_z)  # -> Geometry, Transform
Y = UnitY(Factor=street_width_2)
series = Series(Start=0, Step=unit_x, Count=stairs_number_2)  # -> graft(Series)
series_2 = Series(Start=0, Step=unit_z, Count=stairs_number_2)  # -> graft(Series)
move_4 = Move(Geometry=move_3.Geometry, Motion=negative)  # -> Geometry, Transform
negative_2 = Negative(Value=series)
polyline = PolyLine(Vertices=[point_2, move_3.Geometry, move_4.Geometry], Closed=False)
vector_xyz_3 = VectorXYZ(XComponent=negative_2, YComponent=0, ZComponent=series_2)  # -> Vector, Length
move_5 = Move(Geometry=polyline, Motion=vector_xyz_3.Vector)  # -> Geometry, Transform
join_curves = JoinCurves(Curves=flatten(move_5.Geometry), Preserve=False)
end_points = EndPoints(Curve=join_curves)  # -> Start, End
pt = Point(end_points.Start)
pt_2 = Point(end_points.End)
line = Line(StartPoint=pt, EndPoint=pt_2)
join_curves_2 = JoinCurves(Curves=[join_curves, line], Preserve=False)
boundary_surfaces = BoundarySurfaces(Edges=join_curves_2)
extrude = Extrude(Base=boundary_surfaces, Direction=Y)
extrusion = ClusterOutput(extrude)

# ==== cluster RailingCluster
elevation_difference = ClusterInput()
left_landing = ClusterInput()
right_landing = ClusterInput()
water_width = ClusterInput()
left_landing_2 = Number(left_landing)
left_stair_height = ClusterInput()
left_stair_num = ClusterInput()
plane_width = ClusterInput()
railing_height = ClusterInput()
water_width_2 = Number(water_width)
negative = Negative(Value=left_landing_2)
elevation_difference_2 = Number(elevation_difference)
construct_point = ConstructPoint(XCoordinate=0, YCoordinate=0, ZCoordinate=0)
right_landing_2 = Number(right_landing)
left_stair_height_2 = Number(left_stair_height)
left_stair_num_2 = Number(left_stair_num)
railing_height_2 = Number(railing_height)
street_width = ClusterInput()
vector_xyz = VectorXYZ(XComponent=water_width_2, YComponent=Slider(0, range=0..10), ZComponent=Slider(0, range=0..50))  # -> Vector, Length
plane_width_2 = Number(plane_width)
vector_xyz_2 = VectorXYZ(XComponent=negative, YComponent=Slider(0, range=0..10), ZComponent=Slider(0, range=0..10))  # -> Vector, Length
vector_xyz_3 = VectorXYZ(XComponent=right_landing_2, YComponent=Slider(0, range=0..10), ZComponent=elevation_difference_2)  # -> Vector, Length
street_width_2 = Number(street_width)
point = Point(construct_point)
_2 = Number(2)
multiplication = Multiplication(A=left_stair_height_2, B=left_stair_num_2)
division = Division(A=plane_width_2, B=_2)
move = Move(Geometry=point, Motion=vector_xyz.Vector)  # -> Geometry, Transform
move_2 = Move(Geometry=point, Motion=vector_xyz_2.Vector)  # -> Geometry, Transform
number = Number(multiplication)
line = Line(StartPoint=point, EndPoint=move.Geometry)
move_3 = Move(Geometry=move.Geometry, Motion=vector_xyz_3.Vector)  # -> Geometry, Transform
unit_z = UnitZ(Factor=number)
arch_height = Slider(15, range=0..30)
unit_x = UnitX(Factor=division)
curve_middle = CurveMiddle(Curve=line)
move_4 = Move(Geometry=curve_middle, Motion=unit_z)  # -> Geometry, Transform
negative_2 = Negative(Value=unit_x)
unit_z_2 = UnitZ(Factor=arch_height)
move_5 = Move(Geometry=move_4.Geometry, Motion=unit_x)  # -> Geometry, Transform
move_6 = Move(Geometry=move_4.Geometry, Motion=negative_2)  # -> Geometry, Transform
move_7 = Move(Geometry=unit_z_2, Motion=curve_middle)  # -> Geometry, Transform
right_down_point = Point(move_3.Geometry)
left_down_point = Point(move_2.Geometry)
right_top_point = Point(move_5.Geometry)
left_top_point = Point(move_6.Geometry)
number_2 = Number(railing_height_2)
line_2 = Line(StartPoint=move_3.Geometry, EndPoint=move_5.Geometry)
line_3 = Line(StartPoint=move_6.Geometry, EndPoint=move_2.Geometry)
line_4 = Line(StartPoint=point, EndPoint=move_2.Geometry)
line_5 = Line(StartPoint=move_6.Geometry, EndPoint=move_5.Geometry)
line_6 = Line(StartPoint=move.Geometry, EndPoint=move_3.Geometry)
arc_3pt = Arc3Pt(PointA=point, PointB=move_7.Geometry, PointC=move.Geometry)  # -> Arc, Plane, Radius
join_curves = JoinCurves(Curves=[line_5, line_3, line_2, arc_3pt.Arc, line_4, line_6], Preserve=False)
unit_y = UnitY(Factor=street_width_2)
boundary_surfaces = BoundarySurfaces(Edges=join_curves)
railing_width = ClusterInput()
railing_width_2 = Number(railing_width)
line_7 = Line(StartPoint=left_top_point, EndPoint=right_top_point)
line_8 = Line(StartPoint=left_down_point, EndPoint=left_top_point)
line_9 = Line(StartPoint=right_down_point, EndPoint=right_top_point)
extrude = Extrude(Base=boundary_surfaces, Direction=unit_y)
unit_z_3 = UnitZ(Factor=number_2)
unit_z_4 = UnitZ(Factor=number_2)
unit_z_5 = UnitZ(Factor=number_2)
move_8 = Move(Geometry=line_7, Motion=unit_z_3)  # -> Geometry, Transform
move_9 = Move(Geometry=line_9, Motion=unit_z_5)  # -> Geometry, Transform
move_10 = Move(Geometry=line_8, Motion=unit_z_4)  # -> Geometry, Transform
end_points = EndPoints(Curve=move_8.Geometry)  # -> Start, End
end_points_2 = EndPoints(Curve=move_10.Geometry)  # -> Start, End
end_points_3 = EndPoints(Curve=move_9.Geometry)  # -> Start, End
area = Area(Geometry=extrude)  # -> Area, Centroid
line_10 = Line(StartPoint=end_points.Start, EndPoint=left_top_point)
line_11 = Line(StartPoint=end_points_3.Start, EndPoint=right_down_point)  # disabled
line_12 = Line(StartPoint=left_down_point, EndPoint=end_points_2.Start)  # disabled
join_curves_2 = JoinCurves(Curves=[move_8.Geometry, line_10], Preserve=False)
pipe = Pipe(Curve=line_10, Radius=railing_width_2, Caps=0)
join_curves_3 = JoinCurves(Curves=[move_10.Geometry, line_12], Preserve=False)  # disabled
join_curves_4 = JoinCurves(Curves=[move_9.Geometry, line_11], Preserve=False)  # disabled
pipe_2 = Pipe(Curve=line_12, Radius=railing_width_2, Caps=0)  # disabled
pipe_3 = Pipe(Curve=line_11, Radius=railing_width_2, Caps=0)  # disabled
curve_array = CurveArray(Geometry=pipe, Curve=move_8.Geometry, Count=10)  # -> Geometry, Transform
curve_array_2 = CurveArray(Geometry=pipe_2, Curve=move_10.Geometry, Count=10)  # -> Geometry, Transform; disabled
curve_array_3 = CurveArray(Geometry=pipe_3, Curve=move_9.Geometry, Count=10)  # -> Geometry, Transform; disabled
pipe_4 = Pipe(Curve=join_curves_2, Radius=railing_width_2, Caps=0)
pipe_5 = Pipe(Curve=join_curves_3, Radius=railing_width_2, Caps=0)  # disabled
pipe_6 = Pipe(Curve=join_curves_4, Radius=railing_width_2, Caps=0)  # disabled
brep = Brep([curve_array.Geometry, pipe_4, curve_array_2.Geometry, pipe_5, curve_array_3.Geometry, pipe_6])
xz_plane = XZPlane(Origin=area.Centroid)
mirror = Mirror(Geometry=brep, Plane=xz_plane)  # -> Geometry, Transform
brep_2 = Brep([mirror.Geometry, brep])
brep_3 = ClusterOutput(brep_2)

# ==== cluster BridgeBodyCluster
elevation_difference = ClusterInput()
right_landing = ClusterInput()
plane_width = ClusterInput()
bridgw_height = ClusterInput()
water_width = ClusterInput()
bridge_width = ClusterInput()
left_landing = ClusterInput()
elevation_difference_2 = Number(elevation_difference)
right_landing_2 = Number(right_landing)
plane_width_2 = Number(plane_width)
bridgw_height_2 = Number(bridgw_height)
water_width_2 = Number(water_width)
bridge_width_2 = Number(bridge_width)
left_landing_2 = Number(left_landing)
_2 = Number(2)
negative = Negative(Value=left_landing_2)
num = Number(0)
num_2 = Number(0)
num_3 = Number(0)
num_4 = Number(0)
num_5 = Number(0)
construct_point = ConstructPoint(XCoordinate=0, YCoordinate=0, ZCoordinate=0)
num_6 = Number(0)
vector_xyz = VectorXYZ(XComponent=water_width_2, YComponent=num, ZComponent=0)  # -> Vector, Length
division = Division(A=plane_width_2, B=_2)
vector_xyz_2 = VectorXYZ(XComponent=negative, YComponent=num_4, ZComponent=num_5)  # -> Vector, Length
vector_xyz_3 = VectorXYZ(XComponent=right_landing_2, YComponent=num_6, ZComponent=elevation_difference_2)  # -> Vector, Length
point = Point(construct_point)
move = Move(Geometry=point, Motion=vector_xyz.Vector)  # -> Geometry, Transform
move_2 = Move(Geometry=point, Motion=vector_xyz_2.Vector)  # -> Geometry, Transform
line = Line(StartPoint=point, EndPoint=move.Geometry)
unit_z = UnitZ(Factor=bridgw_height_2)
curve_middle = CurveMiddle(Curve=line)
move_3 = Move(Geometry=move.Geometry, Motion=vector_xyz_3.Vector)  # -> Geometry, Transform
unit_x = UnitX(Factor=division)
move_4 = Move(Geometry=curve_middle, Motion=unit_z)  # -> Geometry, Transform
negative_2 = Negative(Value=unit_x)
move_5 = Move(Geometry=move_4.Geometry, Motion=unit_x)  # -> Geometry, Transform
move_6 = Move(Geometry=move_4.Geometry, Motion=negative_2)  # -> Geometry, Transform
arc_crv = ClusterInput()
line_2 = Line(StartPoint=move_3.Geometry, EndPoint=move_5.Geometry)
line_3 = Line(StartPoint=move_6.Geometry, EndPoint=move_2.Geometry)
arc_crv_2 = Curve(arc_crv)
line_4 = Line(StartPoint=point, EndPoint=move_2.Geometry)
line_5 = Line(StartPoint=move.Geometry, EndPoint=move_3.Geometry)
line_6 = Line(StartPoint=move_6.Geometry, EndPoint=move_5.Geometry)
join_curves = JoinCurves(Curves=[line_6, line_2, line_3], Preserve=False)
unit_y = UnitY(Factor=bridge_width_2)
join_curves_2 = JoinCurves(Curves=[join_curves, line_4, line_5, arc_crv_2], Preserve=False)  # -> flatten(Curves)
boundary_surfaces = BoundarySurfaces(Edges=join_curves_2)
bridge_body_crv = Curve(join_curves)
extrude = Extrude(Base=boundary_surfaces, Direction=unit_y)
bridge_body_crv_2 = ClusterOutput(bridge_body_crv)
extrusion = ClusterOutput(extrude)

# ==== cluster NormalArcCluster
construct_point = ConstructPoint(XCoordinate=0, YCoordinate=0, ZCoordinate=0)
x_component = ClusterInput()
vector_xyz = VectorXYZ(XComponent=x_component, YComponent=Slider(0, range=0..10), ZComponent=Slider(0, range=0..10))  # -> Vector, Length
point = Point(construct_point)
move = Move(Geometry=point, Motion=vector_xyz.Vector)  # -> Geometry, Transform
factor = ClusterInput()
line = Line(StartPoint=point, EndPoint=move.Geometry)
unit_z = UnitZ(Factor=factor)
curve_middle = CurveMiddle(Curve=line)
move_2 = Move(Geometry=unit_z, Motion=curve_middle)  # -> Geometry, Transform
arc_3pt = Arc3Pt(PointA=point, PointB=move_2.Geometry, PointC=move.Geometry)  # -> Arc, Plane, Radius
arc = ClusterOutput(arc_3pt.Arc)
