# Grasshopper definition SC038.gh (Grasshopper 1.0.7)

right_stair_height = Slider(16, range=0..100)
left_landing = Curve(<curve referenced from the Rhino model>)
bridge_length = Curve(<curve referenced from the Rhino model>)
railing_width = Curve(<curve referenced from the Rhino model>)
right_stair_depth = Curve(<curve referenced from the Rhino model>)
right_landing = Curve(<curve referenced from the Rhino model>)
bridge_width = Curve(<curve referenced from the Rhino model>)
water_width = Curve(<curve referenced from the Rhino model>)
left_stair_hei = Slider(16, range=0..100)
left_stair_depth = Curve(<curve referenced from the Rhino model>)
len = Length(Curve=right_stair_depth)
len_2 = Length(Curve=right_landing)
len_3 = Length(Curve=left_landing)
len_4 = Length(Curve=bridge_width)
len_5 = Length(Curve=left_stair_depth)
_65 = Number(80)
len_6 = Length(Curve=railing_width)
len_7 = Length(Curve=bridge_length)
len_8 = Length(Curve=water_width)
_2 = Number(2)
_2_2 = Number(2)
panel = Panel(len_2)
panel_2 = Panel(len)
panel_3 = Panel(len_3)
panel_4 = Panel(len_8)
left_stair_depth_2 = Number(Slider(33, range=0..200))
panel_5 = Panel(len_4)
left_stair_number = Number(Slider(9, range=0..50))
multiplication = Multiplication(A=left_stair_number, B=left_stair_depth_2)
panel_6 = Panel(len_6)
panel_7 = Panel(len_7)
right_stair_number = Number(Slider(9, range=0..50))
panel_8 = Panel(len_5)
subtraction = Subtraction(A=_65, B=left_stair_depth_2)
division = Division(A=subtraction, B=_2_2)
right_stair_depth_2 = Number(Slider(34, range=0..200))
multiplication_2 = Multiplication(A=right_stair_number, B=right_stair_depth_2)
subtraction_2 = Subtraction(A=_65, B=right_stair_depth_2)
division_2 = Division(A=subtraction_2, B=_2)
addition = Addition(A=multiplication, B=multiplication_2)
stair_height = Number(division_2)
stair_height_2 = Number(division)
elevation_difference = Number(Slider(0, range=-100..100))
panel_9 = Panel(stair_height)
railing_height = Number(Slider(121, range=0..500))
railing_width_2 = Number(Slider(4, range=0..100))
left_landing_2 = Number(Slider(102, range=0..1500))
bridge_width_2 = Number(Slider(244, range=0..1000))
right_landing_2 = Number(Slider(108, range=0..1500))
addition_2 = Addition(A=left_landing_2, B=right_landing_2)
arc_height = Number(Slider(132, range=0..1000))
bridge_length_2 = Number(Slider(704, range=0..5000))
subtraction_3 = Subtraction(A=bridge_length_2, B=addition)
subtraction_4 = Subtraction(A=bridge_length_2, B=addition_2)
left_stair_depth_3 = Number(left_stair_depth_2)
left_stair_number_2 = Number(left_stair_number)
left_stair_height = Number(left_stair_hei)
multiplication_3 = Multiplication(A=left_stair_number, B=left_stair_height)
plane_length = Number(subtraction_3)
right_stair_number_2 = Number(right_stair_number)
right_stair_height_2 = Number(right_stair_height)
right_stair_depth_3 = Number(right_stair_depth_2)
water_width_2 = Number(subtraction_4)
bridge_height = Number(multiplication_3)
panel_10 = Panel(water_width_2)

panel_11 = Panel(stair_height_2)
crv = Curve(<curve referenced from the Rhino model>)
_3 = Number(3)
len_9 = Length(Curve=crv)
stairs_number = Number(_3)
newstreet_width = Number(len_9)

arc_height_2 = Number(arc_height)
water_width_3 = Number(water_width_2)
circle_arc_cluster = CircleArcCluster(water_width=water_width_3, arc_height=arc_height_2)
normal_arc = Curve(circle_arc_cluster)

arc_height_3 = Number(arc_height)
water_width_4 = Number(water_width_2)
_3_point_arc_cluster = _3PointArcCluster(factor=arc_height_3, x_component=water_width_4)
crv_2 = Curve(_3_point_arc_cluster)

panel_12 = Panel("arc")
plane_width = Number(plane_length)
right_landing_3 = Number(right_landing_2)
street_width = Number(bridge_width_2)
water_width_5 = Number(water_width_2)
elevation_difference_2 = Number(elevation_difference)
left_landing_3 = Number(left_landing_2)
left_stair_depth_4 = Number(left_stair_depth_3)
left_stair_depth_5 = Number(right_stair_depth_3)
stair_length = Number(left_stair_depth_5)
X = UnitX(Factor=stair_length)
neg = Negative(Value=X)
railing_height_2 = Number(railing_height)
left_stair_num = Number(left_stair_number_2)
railing_width_3 = Number(railing_width_2)
right_stair_height_3 = Number(right_stair_height_2)
left_stair_height_2 = Number(left_stair_height)
stair_height_3 = Number(left_stair_height_2)
Z = UnitZ(Factor=stair_height_3)
multiplication_4 = Multiplication(A=stair_height_3, B=stairs_number)
unit_x = UnitX(Factor=stair_length)
neg_2 = Negative(Value=multiplication_4)
negative = Negative(Value=left_landing_3)
construct_point = ConstructPoint(XCoordinate=0, YCoordinate=0, ZCoordinate=0)
_2_3 = Number(2)
Y = UnitY(Factor=stair_length)
multiplication_5 = Multiplication(A=stair_length, B=_2_3)
Z_2 = UnitZ(Factor=neg_2)
vector_xyz = VectorXYZ(XComponent=water_width_5, YComponent=Slider(0, range=0..10), ZComponent=Slider(0, range=0..50))  # -> Vector, Length
vector_xyz_2 = VectorXYZ(XComponent=negative, YComponent=Slider(0, range=0..10), ZComponent=Slider(0, range=0..10))  # -> Vector, Length

arc_crv = Curve(crv_2)

vector_xyz_3 = VectorXYZ(XComponent=right_landing_3, YComponent=Slider(0, range=0..10), ZComponent=elevation_difference_2)  # -> Vector, Length
neg_3 = Negative(Value=multiplication_5)
X_2 = UnitX(Factor=newstreet_width)
point = Point(construct_point)
multiplication_6 = Multiplication(A=left_stair_height_2, B=left_stair_num)
_2_4 = Number(2)
Y_2 = UnitY(Factor=neg_3)
X_3 = UnitX(Factor=newstreet_width)
division_3 = Division(A=plane_width, B=_2_4)
move = Move(Geometry=point, Motion=vector_xyz.Vector)  # -> Geometry, Transform
unit_z = UnitZ(Factor=stair_height_3)
move_2 = Move(Geometry=point, Motion=vector_xyz_2.Vector)  # -> Geometry, Transform
_2_5 = Number(2)
number = Number(multiplication_6)
series = Series(Start=0, Step=unit_x, Count=stairs_number)  # -> graft(Series)
_2_6 = Number(2)
line = Line(StartPoint=point, EndPoint=move.Geometry)
multiplication_7 = Multiplication(A=left_stair_depth_4, B=_2_5)
multiplication_8 = Multiplication(A=left_stair_height_2, B=_2_6)
series_2 = Series(Start=0, Step=unit_z, Count=stairs_number)  # -> graft(Series)
unit_z_2 = UnitZ(Factor=number)
move_3 = Move(Geometry=move.Geometry, Motion=vector_xyz_3.Vector)  # -> Geometry, Transform
pt = Point(move_3.Geometry)
move_4 = Move(Geometry=pt, Motion=neg)  # -> Geometry, Transform
move_5 = Move(Geometry=move_4.Geometry, Motion=Z)  # -> Geometry, Transform

_2_7 = Number(2)
Y_3 = UnitY(Factor=street_width)
multiplication_9 = Multiplication(A=left_stair_depth_4, B=_2_7)
move_6 = Move(Geometry=move_3.Geometry, Motion=Y_3)  # -> Geometry, Transform
Y_4 = UnitY(Factor=multiplication_9)
pt_2 = Point(move_6.Geometry)
neg_4 = Negative(Value=multiplication_9)
_2_8 = Number(2)
X_4 = UnitX(Factor=neg_4)
move_7 = Move(Geometry=move_6.Geometry, Motion=Y_4)  # -> Geometry, Transform
multiplication_10 = Multiplication(A=left_stair_height_2, B=_2_8)
move_8 = Move(Geometry=move_7.Geometry, Motion=X_4)  # -> Geometry, Transform
Z_3 = UnitZ(Factor=multiplication_10)
move_9 = Move(Geometry=move_8.Geometry, Motion=Z_3)  # -> Geometry, Transform
X_5 = UnitX(Factor=railing_width_3)
Z_4 = UnitZ(Factor=railing_height_2)
neg_5 = Negative(Value=X_5)
move_10 = Move(Geometry=move_9.Geometry, Motion=Z_4)  # -> Geometry, Transform
move_11 = Move(Geometry=move_10.Geometry, Motion=neg_5)  # -> Geometry, Transform
pt_3 = Point(move_11.Geometry)
box = Box2Pt(PointA=pt_2, PointB=pt_3, Plane=PlaneXY(0, 0, 0))
brep = Brep(box)

move_12 = Move(Geometry=move_5.Geometry, Motion=Z_2)  # -> Geometry, Transform
move_13 = Move(Geometry=move_12.Geometry, Motion=Y_2)  # -> Geometry, Transform
point_2 = Point(move_13.Geometry)
move_14 = Move(Geometry=point_2, Motion=unit_z)  # -> Geometry, Transform
move_15 = Move(Geometry=move_4.Geometry, Motion=X_3)  # -> Geometry, Transform
pt_4 = Point(move_5.Geometry)
arch_height = Slider(15, range=0..30)
X_6 = UnitX(Factor=multiplication_7)
unit_x_2 = UnitX(Factor=division_3)
Z_5 = UnitZ(Factor=multiplication_8)
Y_5 = UnitY(Factor=street_width)
curve_middle = CurveMiddle(Curve=line)
move_16 = Move(Geometry=move_14.Geometry, Motion=Y)  # -> Geometry, Transform

right_landing_4 = Number(right_landing_2)
elevation_difference_3 = Number(elevation_difference)
water_width_6 = Number(water_width_2)
stairs_number_2 = Number(right_stair_number_2)
stair_height_4 = Number(right_stair_height_2)
stair_length_2 = Number(right_stair_depth_3)
street_width_2 = Number(bridge_width_2)
right_stairs_cluster = RightStairsCluster(
    water_width=water_width_6,
    right_landing=right_landing_4,
    elevation_difference=elevation_difference_3,
    stair_length=stair_length_2,
    stair_height=stair_height_4,
    stairs_number=stairs_number_2,
    street_width=street_width_2)
brep_2 = Brep(right_stairs_cluster)

move_17 = Move(Geometry=move_15.Geometry, Motion=Y_5)  # -> Geometry, Transform
move_18 = Move(Geometry=move_2.Geometry, Motion=X_6)  # -> Geometry, Transform
move_19 = Move(Geometry=curve_middle, Motion=unit_z_2)  # -> Geometry, Transform
_2_9 = Number(2)

round_step_number = Slider(4, range=0..5)
step_height = Number()
step_length = Number()
right_front_stairs_generator = RightFrontStairsGenerator(step_height=step_height, round_step_num=round_step_number, step_length=step_length)
brep_3 = Brep(right_front_stairs_generator)

negative_2 = Negative(Value=unit_x_2)
pt_5 = Point(move_17.Geometry)
vector_xyz_4 = VectorXYZ(XComponent=0, YComponent=series, ZComponent=series_2)  # -> Vector, Length
unit_z_3 = UnitZ(Factor=arch_height)
move_20 = Move(Geometry=move_18.Geometry, Motion=Z_5)  # -> Geometry, Transform
polyline = PolyLine(Vertices=[point_2, move_14.Geometry, move_16.Geometry], Closed=False)
multiplication_11 = Multiplication(A=right_stair_height_3, B=_2_9)

left_landing_4 = Number(left_landing_2)
stair_length_3 = Number(left_stair_depth_3)
stair_height_5 = Number(left_stair_height)
stairs_number_3 = Number(left_stair_number_2)
street_width_3 = Number(bridge_width_2)
left_stairs_cluster = LeftStairsCluster(
    left_landing=left_landing_4,
    stair_length=stair_length_3,
    stair_height=stair_height_5,
    stairs_number=stairs_number_3,
    street_width=street_width_3)
brep_4 = Brep(left_stairs_cluster)

move_21 = Move(Geometry=move_19.Geometry, Motion=unit_x_2)  # -> Geometry, Transform
Z_6 = UnitZ(Factor=multiplication_11)
move_22 = Move(Geometry=move_19.Geometry, Motion=negative_2)  # -> Geometry, Transform
box_2 = Box2Pt(PointA=pt_4, PointB=pt_5, Plane=PlaneXY(0, 0, 0))

_2_10 = Number(2)
left_round_stair_railing_cluster = LeftRoundStairRailingCluster(
    bottom_start_pt=move_2.Geometry,
    step_height=left_stair_height_2,
    round_step_num=_2_10,
    step_depth=left_stair_depth_5,
    street_width=street_width,
    railing_height=railing_height_2,
    railing_width=railing_width_2)
brep_5 = Brep(left_round_stair_railing_cluster)

_2_11 = Number(2)

_4 = Number(4)
left_round_stair_wall_railing = LeftRoundStairWallRailing(
    bottom_start_pt=move_2.Geometry,
    step_height=left_stair_height,
    round_step_num=_4,
    step_depth=left_stair_depth_3,
    street_width=bridge_width_2,
    ralling_height=railing_height,
    railing_width=railing_width_2)
brep_6 = Brep(left_round_stair_wall_railing)

move_23 = Move(Geometry=polyline, Motion=vector_xyz_4.Vector)  # -> Geometry, Transform

_2_12 = Number(2)
right_round_stair_wall_railing = RightRoundStairWallRailing(
    bottom_start_pt=move_3.Geometry,
    step_height=right_stair_height_2,
    round_step_num=_2_12,
    step_length=right_stair_depth_3,
    street_width=bridge_width_2,
    ralling_height=railing_height,
    railing_width=railing_width_2)
brep_7 = Brep(right_round_stair_wall_railing)

move_24 = Move(Geometry=unit_z_3, Motion=curve_middle)  # -> Geometry, Transform
multiplication_12 = Multiplication(A=left_stair_depth_5, B=_2_11)
move_25 = Move(Geometry=move_3.Geometry, Motion=Z_6)  # -> Geometry, Transform
brep_8 = Brep(box_2)
join_curves = JoinCurves(Curves=flatten(move_23.Geometry), Preserve=False)
neg_6 = Negative(Value=multiplication_12)
X_7 = UnitX(Factor=neg_6)
end_points = EndPoints(Curve=join_curves)  # -> Start, End
line_2 = Line(StartPoint=move_3.Geometry, EndPoint=move_21.Geometry)
move_26 = Move(Geometry=move_25.Geometry, Motion=X_7)  # -> Geometry, Transform
line_3 = Line(StartPoint=move_22.Geometry, EndPoint=move_2.Geometry)
line_4 = Line(StartPoint=point, EndPoint=move_2.Geometry)
line_5 = Line(StartPoint=move_22.Geometry, EndPoint=move_21.Geometry)
line_6 = Line(StartPoint=move.Geometry, EndPoint=move_3.Geometry)
arc_3pt = Arc3Pt(PointA=point, PointB=move_24.Geometry, PointC=move.Geometry)  # -> Arc, Plane, Radius
Y_6 = UnitY(Factor=street_width)
Y_7 = UnitY(Factor=street_width)
Y_8 = UnitY(Factor=street_width)
Y_9 = UnitY(Factor=street_width)
pt_6 = Point(end_points.Start)
_3_2 = Number(3)
pt_7 = Point(end_points.End)
move_27 = Move(Geometry=move_20.Geometry, Motion=Y_6)  # -> Geometry, Transform
move_28 = Move(Geometry=move_3.Geometry, Motion=Y_7)  # -> Geometry, Transform
move_29 = Move(Geometry=move_21.Geometry, Motion=Y_8)  # -> Geometry, Transform
move_30 = Move(Geometry=move_22.Geometry, Motion=Y_9)  # -> Geometry, Transform
multiplication_13 = Multiplication(A=right_stair_height_3, B=_3_2)
join_curves_2 = JoinCurves(Curves=[line_5, line_3, line_2, arc_3pt.Arc, line_4, line_6], Preserve=False)
line_7 = Line(StartPoint=pt_6, EndPoint=pt_7)
Z_7 = UnitZ(Factor=multiplication_13)
_3_3 = Number(3)
multiplication_14 = Multiplication(A=left_stair_depth_5, B=_3_3)

street_width_4 = Number(bridge_width_2)
bridge_height_2 = Number(bridge_height)
elevation_difference_4 = Number(elevation_difference)
water_width_7 = Number(water_width_2)
plane_width_2 = Number(plane_length)
left_landing_5 = Number(left_landing_2)
right_landing_5 = Number(right_landing_2)
bridge_body_cluster = BridgeBodyCluster(
    bridge_width=street_width_4,
    plane_width=plane_width_2,
    bridgw_height=bridge_height_2,
    arc_crv=arc_crv,
    water_width=water_width_7,
    left_landing=left_landing_5,
    right_landing=right_landing_5,
    elevation_difference=elevation_difference_4)  # -> extrusion, bridge_body_crv_2
bridge_body_crv = Curve(bridge_body_cluster.bridge_body_crv_2)
brep_9 = Brep(bridge_body_cluster.extrusion)

boundary_surfaces = BoundarySurfaces(Edges=join_curves_2)
unit_y = UnitY(Factor=street_width)
join_curves_3 = JoinCurves(Curves=[join_curves, line_7], Preserve=False)
move_31 = Move(Geometry=move_28.Geometry, Motion=Z_7)  # -> Geometry, Transform
neg_7 = Negative(Value=multiplication_14)
boundary_surfaces_2 = BoundarySurfaces(Edges=join_curves_3)
X_8 = UnitX(Factor=neg_7)
move_32 = Move(Geometry=move_31.Geometry, Motion=X_8)  # -> Geometry, Transform
extrude = Extrude(Base=boundary_surfaces_2, Direction=X_2)
brep_10 = Brep(extrude)
preview = CustomPreview(Geometry=[brep_8, brep_10], Material=ColourSwatch(SwatchColor=RGB(176, 176, 176)))
brep_11 = Brep(flatten([brep_2, brep_4, brep_9, brep_5]))
preview_2 = CustomPreview(Geometry=brep_11, Material=ColourSwatch(SwatchColor=RGB(178, 178, 178)))
left_down_point = Point(move_20.Geometry)

_1_only_left_round_stair = _1OnlyLeftRoundStair(
    bottom_start_pt=left_down_point,
    step_height=left_stair_height,
    step_depth=left_stair_depth_3,
    street_width=bridge_width_2)
brep_12 = Brep(_1_only_left_round_stair)

right_down_point = Point(move_26.Geometry)

_1_only_right_round_stair_cluster = _1OnlyRightRoundStairCluster(
    bottom_start_pt=right_down_point,
    step_height=right_stair_height_2,
    step_depth=right_stair_depth_3,
    street_width=bridge_width_2)
brep_13 = Brep(_1_only_right_round_stair_cluster)

right_top_point = Point(move_21.Geometry)
left_top_point = Point(move_22.Geometry)
railing_width_4 = Number(railing_width_2)
number_2 = Number(railing_height_2)
extrude_2 = Extrude(Base=boundary_surfaces, Direction=unit_y)

right_top_point_2 = Point(move_21.Geometry)
right_down_point_2 = Point(move_26.Geometry)
left_top_point_2 = Point(move_22.Geometry)
left_down_point_2 = Point(move_20.Geometry)
railing_width_5 = Number(railing_width_2)
ralling_height = Number(railing_height)
line_8 = Line(StartPoint=left_down_point_2, EndPoint=left_top_point_2)
line_9 = Line(StartPoint=left_top_point_2, EndPoint=right_top_point_2)
line_10 = Line(StartPoint=right_down_point_2, EndPoint=right_top_point_2)
unit_z_4 = UnitZ(Factor=ralling_height)
curve = Curve([line_9, line_8, line_10])
unit_y_2 = UnitY(Factor=railing_width_5)
extrude_3 = Extrude(Base=curve, Direction=unit_z_4)
extrude_4 = Extrude(Base=extrude_3, Direction=unit_y_2)

right_down_point_3 = Point(move_32.Geometry)
left_down_point_3 = Point(move_27.Geometry)
right_top_point_3 = Point(move_29.Geometry)
left_top_point_3 = Point(move_30.Geometry)
railing_width_6 = Number(railing_width_2)
ralling_height_2 = Number(railing_height)
line_11 = Line(StartPoint=left_down_point_3, EndPoint=left_top_point_3)
line_12 = Line(StartPoint=left_top_point_3, EndPoint=right_top_point_3)
line_13 = Line(StartPoint=right_down_point_3, EndPoint=right_top_point_3)
unit_z_5 = UnitZ(Factor=ralling_height_2)
curve_2 = Curve([line_12, line_11, line_13])
unit_y_3 = UnitY(Factor=railing_width_6)
extrude_5 = Extrude(Base=curve_2, Direction=unit_z_5)
extrude_6 = Extrude(Base=extrude_5, Direction=unit_y_3)

extrude_7 = Extrude(Base=boundary_surfaces, Direction=unit_y)
riht_down_point = Point(right_down_point_3)
stair_depth = Number(right_stair_depth_3)

street_width_5 = Number(bridge_width_2)
plane_width_3 = Number(plane_length)
left_stair_height_3 = Number(left_stair_height)
railing_height_3 = Number(railing_height)
left_stair_num_2 = Number(left_stair_number_2)
railing_width_7 = Number(railing_width_2)
elevation_difference_5 = Number(elevation_difference)
right_landing_6 = Number(right_landing_2)
water_width_8 = Number(water_width_2)
left_landing_6 = Number(left_landing_2)
railing_cluster = RailingCluster(
    street_width=street_width_5,
    plane_width=plane_width_3,
    water_width=water_width_8,
    left_landing=left_landing_6,
    right_landing=right_landing_6,
    elevation_difference=elevation_difference_5,
    railing_height=railing_height_3,
    left_stair_height=left_stair_height_3,
    left_stair_num=left_stair_num_2,
    railing_width=railing_width_7)
brep_14 = Brep(railing_cluster)

negative_3 = Negative(Value=right_stair_depth_3)
unit_x_3 = UnitX(Factor=stair_depth)
move_33 = Move(Geometry=riht_down_point, Motion=unit_x_3)  # -> Geometry, Transform
area = Area(Geometry=extrude_2)  # -> Area, Centroid

street_width_6 = Number(bridge_width_2)
railding_width = Number(railing_width_2)
bridge_body_crv_2 = Curve(bridge_body_crv)
rialing_height = Number(railing_height)
railing_wall_cluster = RailingWallCluster(
    street_width=street_width_6,
    bridge_body_crv=bridge_body_crv_2,
    rialing_height=rialing_height,
    railding_width=railding_width)
railing_brep = Brep(railing_wall_cluster)

line_14 = Line(StartPoint=riht_down_point, EndPoint=move_33.Geometry)
area_2 = Area(Geometry=extrude_7)  # -> Area, Centroid
unit_z_6 = UnitZ(Factor=ralling_height_2)
neg_8 = Negative(Value=railing_width_6)
unit_y_4 = UnitY(Factor=neg_8)
extrude_8 = Extrude(Base=line_14, Direction=unit_z_6)
extrude_9 = Extrude(Base=extrude_8, Direction=unit_y_4)
_5 = Number(5)

line_15 = Line(StartPoint=left_top_point, EndPoint=right_top_point)
line_16 = Line(StartPoint=left_down_point, EndPoint=left_top_point)
line_17 = Line(StartPoint=right_down_point, EndPoint=right_top_point)
unit_z_7 = UnitZ(Factor=number_2)
unit_z_8 = UnitZ(Factor=number_2)
unit_z_9 = UnitZ(Factor=number_2)
move_34 = Move(Geometry=line_15, Motion=unit_z_7)  # -> Geometry, Transform
move_35 = Move(Geometry=line_17, Motion=unit_z_9)  # -> Geometry, Transform
move_36 = Move(Geometry=line_16, Motion=unit_z_8)  # -> Geometry, Transform
end_points_2 = EndPoints(Curve=move_34.Geometry)  # -> Start, End
end_points_3 = EndPoints(Curve=move_36.Geometry)  # -> Start, End
end_points_4 = EndPoints(Curve=move_35.Geometry)  # -> Start, End
line_18 = Line(StartPoint=end_points_2.Start, EndPoint=left_top_point)
line_19 = Line(StartPoint=end_points_4.Start, EndPoint=right_down_point)
line_20 = Line(StartPoint=left_down_point, EndPoint=end_points_3.Start)
join_curves_4 = JoinCurves(Curves=[move_34.Geometry, line_18], Preserve=False)
pipe = Pipe(Curve=line_18, Radius=railing_width_4, Caps=0)
join_curves_5 = JoinCurves(Curves=[move_36.Geometry, line_20], Preserve=False)
join_curves_6 = JoinCurves(Curves=[move_35.Geometry, line_19], Preserve=False)
pipe_2 = Pipe(Curve=line_20, Radius=railing_width_4, Caps=0)
pipe_3 = Pipe(Curve=line_19, Radius=railing_width_4, Caps=0)
curve_array = CurveArray(Geometry=pipe, Curve=move_34.Geometry, Count=_5)  # -> Geometry, Transform
curve_array_2 = CurveArray(Geometry=pipe_2, Curve=move_36.Geometry, Count=10)  # -> Geometry, Transform
curve_array_3 = CurveArray(Geometry=pipe_3, Curve=move_35.Geometry, Count=10)  # -> Geometry, Transform
pipe_4 = Pipe(Curve=join_curves_4, Radius=railing_width_4, Caps=0)
pipe_5 = Pipe(Curve=join_curves_5, Radius=railing_width_4, Caps=0)
pipe_6 = Pipe(Curve=join_curves_6, Radius=railing_width_4, Caps=0)

brep_15 = Brep(flatten(railing_brep))
xz_plane = XZPlane(Origin=area.Centroid)
preview_3 = CustomPreview(Geometry=brep_15, Material=ColourSwatch(SwatchColor=RGB(191, 160, 111)))
xz_plane_2 = XZPlane(Origin=area_2.Centroid)
brep_16 = Brep([curve_array.Geometry, pipe_4, curve_array_2.Geometry, pipe_5, curve_array_3.Geometry, pipe_6])
mirror = Mirror(Geometry=brep_16, Plane=xz_plane)  # -> Geometry, Transform
mirror_2 = Mirror(Geometry=extrude_4, Plane=xz_plane_2)  # -> Geometry, Transform
brep_17 = Brep(flatten([extrude_4, extrude_6]))
brep_18 = Brep([mirror.Geometry, brep_16])
brep_19 = Brep(brep_18)
preview_4 = CustomPreview(Geometry=brep_17, Material=ColourSwatch(SwatchColor=RGB(153, 117, 60)))
preview_5 = CustomPreview(Geometry=brep_19, Material=ColourSwatch(SwatchColor=RGB(156, 156, 156)))

# ==== cluster RightFrontStairsGenerator
step_height = ClusterInput()
round_step_num = ClusterInput()
step_length = ClusterInput()
step_height_2 = Number(step_height)
round_step_num_2 = Number(round_step_num)
number = Number(1)
step_length_2 = Number(step_length)
subtraction = Subtraction(A=round_step_num_2, B=number)
multiplication = Multiplication(A=round_step_num_2, B=step_length_2)
multiplication_2 = Multiplication(A=subtraction, B=step_height_2)
Z = UnitZ(Factor=step_height_2)
neg = Negative(Value=multiplication)
Z_2 = UnitZ(Factor=multiplication_2)
neg_2 = Negative(Value=step_length_2)
X = UnitX(Factor=neg)
Y = UnitY(Factor=neg)
Y_2 = UnitY(Factor=neg_2)
X_2 = UnitX(Factor=step_length_2)
bottom_start_pt = ClusterInput()
multiplication_3 = Multiplication(A=Z, B=round_step_num_2)
bottom_start_pt_2 = Point(bottom_start_pt)
move = Move(Geometry=bottom_start_pt_2, Motion=X)  # -> Geometry, Transform
pt = Point(move.Geometry)
move_2 = Move(Geometry=pt, Motion=Z_2)  # -> Geometry, Transform
move_3 = Move(Geometry=pt, Motion=Y)  # -> Geometry, Transform
bottom_endpt = Point(move_3.Geometry)
move_4 = Move(Geometry=pt, Motion=multiplication_3)  # -> Geometry, Transform
pt_2 = Point(move_2.Geometry)
move_5 = Move(Geometry=pt_2, Motion=Y_2)  # -> Geometry, Transform
move_6 = Move(Geometry=pt_2, Motion=X_2)  # -> Geometry, Transform
pt_3 = Point(move_5.Geometry)
pt_4 = Point(move_6.Geometry)
arc = ArcSED(Start=bottom_start_pt_2, End=bottom_endpt, Direction=Y)  # -> Arc, Plane, Radius
arc_2 = ArcSED(Start=pt_4, End=pt_3, Direction=Y)  # -> Arc, Plane, Radius
top_pt = Point(move_4.Geometry)
move_7 = Move(Geometry=top_pt, Motion=X_2)  # -> Geometry, Transform
move_8 = Move(Geometry=top_pt, Motion=Y_2)  # -> Geometry, Transform
top_end_pt = Point(move_8.Geometry)
top_start_pt = Point(move_7.Geometry)
second_crv = Curve(arc_2.Arc)
bottom_crv = Curve(arc.Arc)
arc_3 = ArcSED(Start=top_start_pt, End=top_end_pt, Direction=Y)  # -> Arc, Plane, Radius
range = Range(Domain=Domain(0, 1), Steps=subtraction)
ln = Line(StartPoint=top_start_pt, EndPoint=top_pt)
ln_2 = Line(StartPoint=top_pt, EndPoint=top_end_pt)
ln_3 = Line(StartPoint=pt, EndPoint=top_pt)
ln_4 = Line(StartPoint=pt, EndPoint=bottom_endpt)
ln_5 = Line(StartPoint=bottom_start_pt_2, EndPoint=pt)
ln_6 = Line(StartPoint=pt, EndPoint=bottom_endpt)
crv = Curve(arc_3.Arc)
tweencrv = TweenCurve(CurveA=second_crv, CurveB=bottom_crv, Factor=range, BlendType=0)
street_width = Number(10)
extr = Extrude(Base=tweencrv, Direction=Z)
join = JoinCurves(Curves=[ln_2, ln, crv], Preserve=False)
join_2 = JoinCurves(Curves=[ln_6, bottom_crv, ln_5], Preserve=False)
num = Number(2)
debrep = DeconstructBrep(Brep=extr)  # -> Faces, Edges, Vertices
item = ListItem(List=debrep.Edges, Index=0, Wrap=True)  # -> Item, Item1, Item2, Item3, Item4
crv_2 = Curve(flatten(item.Item4))
division = Division(A=street_width, B=num)
crv_3 = Curve(flatten(item.Item2))
crv_4 = Curve(flatten(item.Item3))
crv_5 = Curve(flatten(item.Item1))
Y_3 = UnitY(Factor=division)
boundary_surfaces = BoundarySurfaces(Edges=join)
cull_i = CullIndex(List=flatten(crv_4), Indices="-1", Wrap=True)  # -> graft(List)
boundary_surfaces_2 = BoundarySurfaces(Edges=join_2)
cull_i_2 = CullIndex(List=flatten(crv_5), Indices="0", Wrap=True)  # -> graft(List)
flip = FlipCurve(Curve=cull_i)  # -> Curve, Flag
crv_6 = Curve([cull_i_2, flip.Curve])
loft = Loft(Curves=crv_6, Options={Adjust=False, Closed=False, LoftEnds=0, LoftSimp=0, LoftType=0, Rebuild=10, Refit=0.01})
debrep_2 = DeconstructBrep(Brep=loft)  # -> Faces, Edges, Vertices
item_2 = ListItem(List=debrep_2.Edges, Index=0, Wrap=True)  # -> Item, Item1, Item2, Item3, Item4
crv_7 = Curve(flatten(item_2.Item4))
join_3 = JoinCurves(Curves=[crv_7, crv_2], Preserve=False)
crv_8 = Curve(join_3)
join_4 = JoinCurves(Curves=[crv_8, ln_5, ln_3, ln], Preserve=False)
crv_9 = Curve(flatten(item_2.Item2))
join_5 = JoinCurves(Curves=[crv_9, crv_3], Preserve=False)
crv_10 = Curve(join_5)
join_6 = JoinCurves(Curves=[ln_3, crv_10, ln_4, ln_2], Preserve=False)
boundary_surfaces_3 = BoundarySurfaces(Edges=join_6)
boundary_surfaces_4 = BoundarySurfaces(Edges=join_4)
extr_2 = Extrude(Base=boundary_surfaces_4, Direction=Y_3)
move_9 = Move(Geometry=boundary_surfaces_4, Motion=Y_3)  # -> Geometry, Transform
brep = Brep([extr, boundary_surfaces_3, loft, boundary_surfaces, boundary_surfaces_2])
mirror = Mirror(Geometry=[extr_2, brep], Plane=move_9.Geometry)  # -> Geometry, Transform
brep_2 = Brep(mirror.Geometry)
brep_3 = Brep([brep, brep_2, extr_2])
brep_4 = ClusterOutput(brep_3)

# ==== cluster RailingWallCluster
bridge_body_crv = ClusterInput()
railding_width = ClusterInput()
rialing_height = ClusterInput()
street_width = ClusterInput()
bridge_body_crv_2 = Curve(bridge_body_crv)
railding_width_2 = Number(railding_width)
rialing_height_2 = Number(rialing_height)
street_width_2 = Number(street_width)
unit_z = UnitZ(Factor=rialing_height_2)
unit_y = UnitY(Factor=railding_width_2)
extrude = Extrude(Base=bridge_body_crv_2, Direction=unit_z)
subtraction = Subtraction(A=street_width_2, B=railding_width_2)
extrude_2 = Extrude(Base=extrude, Direction=unit_y)
unit_y_2 = UnitY(Factor=subtraction)
move = Move(Geometry=extrude_2, Motion=unit_y_2)  # -> Geometry, Transform
brep = Brep([move.Geometry, extrude_2])
brep_2 = ClusterOutput(brep)

# ==== cluster CircleArcCluster
water_width = ClusterInput()
arc_height = ClusterInput()
water_width_2 = Number(water_width)
arc_height_2 = Number(arc_height)
construct_point = ConstructPoint(XCoordinate=0, YCoordinate=0, ZCoordinate=0)
_2 = Number(2)
unit_x = UnitX(Factor=water_width_2)
unit_z = UnitZ(Factor=arc_height_2)
division = Division(A=water_width_2, B=_2)
A = Point(construct_point)
move = Move(Geometry=A, Motion=unit_x)  # -> Geometry, Transform
unit_z_2 = UnitZ(Factor=division)
B = Point(move.Geometry)
line = Line(StartPoint=A, EndPoint=B)
curve_middle = CurveMiddle(Curve=line)
H = Point(curve_middle)
move_2 = Move(Geometry=curve_middle, Motion=unit_z)  # -> Geometry, Transform
move_3 = Move(Geometry=curve_middle, Motion=unit_z_2)  # -> Geometry, Transform
yz_plane = YZPlane(Origin=H)
C = Point(move_2.Geometry)
distance = Distance(PointA=C, PointB=move_3.Geometry)
xz_plane = XZPlane(Origin=C)
line_2 = Line(StartPoint=B, EndPoint=C)
line_3 = Line(StartPoint=A, EndPoint=C)
circle = Circle(Plane=xz_plane, Radius=distance)
curve_line = CurveLine(Curve=circle, Line=line_3)  # -> Points, Params, Count
curve_line_2 = CurveLine(Curve=circle, Line=line_2)  # -> Points, Params, Count
_1 = Number(1)
list_item = ListItem(List=curve_line.Points, Index=_1, Wrap=True)
list_item_2 = ListItem(List=curve_line_2.Points, Index=_1, Wrap=True)
M = Point(list_item)
N = Point(list_item_2)
line_4 = Line(StartPoint=N, EndPoint=B)
line_5 = Line(StartPoint=M, EndPoint=A)
curve_middle_2 = CurveMiddle(Curve=line_4)
curve_middle_3 = CurveMiddle(Curve=line_5)
curve_closest_point = CurveClosestPoint(Point=curve_middle_3, Curve=line)  # -> Point, Parameter, Distance
distance_2 = Distance(PointA=M, PointB=curve_middle_3)
square = Square(Value=curve_closest_point.Distance)
square_2 = Square(Value=distance_2)
subtraction = Subtraction(A=square_2, B=square)
square_root = SquareRoot(Value=subtraction)
division_2 = Division(A=square_2, B=square_root)
negative = Negative(Value=division_2)
unit_x_2 = UnitX(Factor=negative)
unit_x_3 = UnitX(Factor=division_2)
move_4 = Move(Geometry=A, Motion=unit_x_3)  # -> Geometry, Transform
move_5 = Move(Geometry=B, Motion=unit_x_2)  # -> Geometry, Transform
E = Point(move_4.Geometry)
line_6 = Line(StartPoint=move_4.Geometry, EndPoint=curve_middle_3)
line_7 = Line(StartPoint=move_5.Geometry, EndPoint=curve_middle_2)
xz_plane_2 = XZPlane(Origin=move_4.Geometry)
F = Point(move_5.Geometry)
line_line = LineLine(Line1=line_6, Line2=line_7)  # -> ParamA, ParamB, PointA, PointB
G = Point(line_line.PointA)
distance_3 = Distance(PointA=C, PointB=line_line.PointA)
xz_plane_3 = XZPlane(Origin=line_line.PointA)
circle_2 = Circle(Plane=xz_plane_2, Radius=division_2)
circle_3 = Circle(Plane=xz_plane_3, Radius=distance_3)
curve_curve = CurveCurve(CurveA=circle_2, CurveB=circle_3)  # -> Points, ParamsA, ParamsB
negative_2 = Negative(Value=Slider(1, range=0..1))
unit_x_4 = UnitX(Factor=negative_2)
unit_z_3 = UnitZ(Factor=1)
point = Point(curve_curve.Points)
arc_sed = ArcSED(Start=C, End=point, Direction=unit_x_4)  # -> Arc, Plane, Radius
arc_sed_2 = ArcSED(Start=A, End=point, Direction=unit_z_3)  # -> Arc, Plane, Radius
join_curves = JoinCurves(Curves=[arc_sed.Arc, arc_sed_2.Arc], Preserve=False)
mirror = Mirror(Geometry=join_curves, Plane=yz_plane)  # -> Geometry, Transform
join_curves_2 = JoinCurves(Curves=[join_curves, mirror.Geometry], Preserve=False)
curves = ClusterOutput(join_curves_2)

# ==== cluster LeftStairsCluster
left_landing = ClusterInput()
left_landing_2 = Number(left_landing)
construct_point = ConstructPoint(XCoordinate=0, YCoordinate=0, ZCoordinate=0)
negative = Negative(Value=left_landing_2)
num = Number(0)
num_2 = Number(0)
vector_xyz = VectorXYZ(XComponent=negative, YComponent=num, ZComponent=num_2)  # -> Vector, Length
stair_length = ClusterInput()
stair_height = ClusterInput()
stairs_number = ClusterInput()
point = Point(construct_point)
street_width = ClusterInput()
stair_length_2 = Number(stair_length)
stair_height_2 = Number(stair_height)
stairs_number_2 = Number(stairs_number)
street_width_2 = Number(street_width)
unit_x = UnitX(Factor=stair_length_2)
move = Move(Geometry=point, Motion=vector_xyz.Vector)  # -> Geometry, Transform
Y = UnitY(Factor=street_width_2)
unit_z = UnitZ(Factor=stair_height_2)
point_2 = Point(move.Geometry)
move_2 = Move(Geometry=point_2, Motion=unit_z)  # -> Geometry, Transform
series = Series(Start=0, Step=unit_x, Count=stairs_number_2)  # -> graft(Series)
series_2 = Series(Start=0, Step=unit_z, Count=stairs_number_2)  # -> graft(Series)
move_3 = Move(Geometry=move_2.Geometry, Motion=unit_x)  # -> Geometry, Transform
vector_xyz_2 = VectorXYZ(XComponent=series, YComponent=0, ZComponent=series_2)  # -> Vector, Length
polyline = PolyLine(Vertices=[point_2, move_2.Geometry, move_3.Geometry], Closed=False)
move_4 = Move(Geometry=polyline, Motion=vector_xyz_2.Vector)  # -> Geometry, Transform
join_curves = JoinCurves(Curves=flatten(move_4.Geometry), Preserve=False)
end_points = EndPoints(Curve=join_curves)  # -> Start, End
pt = Point(end_points.Start)
pt_2 = Point(end_points.End)
line = Line(StartPoint=pt, EndPoint=pt_2)
join_curves_2 = JoinCurves(Curves=[join_curves, line], Preserve=False)
boundary_surfaces = BoundarySurfaces(Edges=join_curves_2)
extrude = Extrude(Base=boundary_surfaces, Direction=Y)
extrusion = ClusterOutput(extrude)

# ==== cluster RightStairsCluster
water_width = ClusterInput()
right_landing = ClusterInput()
elevation_difference = ClusterInput()
water_width_2 = Number(water_width)
right_landing_2 = Number(right_landing)
elevation_difference_2 = Number(elevation_difference)
num = Number(0)
construct_point = ConstructPoint(XCoordinate=0, YCoordinate=0, ZCoordinate=0)
num_2 = Number(0)
vector_xyz = VectorXYZ(XComponent=water_width_2, YComponent=num, ZComponent=num)  # -> Vector, Length
vector_xyz_2 = VectorXYZ(XComponent=right_landing_2, YComponent=num_2, ZComponent=elevation_difference_2)  # -> Vector, Length
point = Point(construct_point)
move = Move(Geometry=point, Motion=vector_xyz.Vector)  # -> Geometry, Transform
stair_length = ClusterInput()
stairs_number = ClusterInput()
stair_height = ClusterInput()
stair_length_2 = Number(stair_length)
street_width = ClusterInput()
stairs_number_2 = Number(stairs_number)
stair_height_2 = Number(stair_height)
unit_x = UnitX(Factor=stair_length_2)
street_width_2 = Number(street_width)
move_2 = Move(Geometry=move.Geometry, Motion=vector_xyz_2.Vector)  # -> Geometry, Transform
unit_z = UnitZ(Factor=stair_height_2)
negative = Negative(Value=unit_x)
point_2 = Point(move_2.Geometry)
panel = Panel("stairs")
move_3 = Move(Geometry=point_2, Motion=unit_z)  # -> Geometry, Transform
Y = UnitY(Factor=street_width_2)
series = Series(Start=0, Step=unit_x, Count=stairs_number_2)  # -> graft(Series)
series_2 = Series(Start=0, Step=unit_z, Count=stairs_number_2)  # -> graft(Series)
move_4 = Move(Geometry=move_3.Geometry, Motion=negative)  # -> Geometry, Transform
negative_2 = Negative(Value=series)
polyline = PolyLine(Vertices=[point_2, move_3.Geometry, move_4.Geometry], Closed=False)
vector_xyz_3 = VectorXYZ(XComponent=negative_2, YComponent=0, ZComponent=series_2)  # -> Vector, Length
move_5 = Move(Geometry=polyline, Motion=vector_xyz_3.Vector)  # -> Geometry, Transform
join_curves = JoinCurves(Curves=flatten(move_5.Geometry), Preserve=False)
end_points = EndPoints(Curve=join_curves)  # -> Start, End
pt = Point(end_points.Start)
pt_2 = Point(end_points.End)
line = Line(StartPoint=pt, EndPoint=pt_2)
join_curves_2 = JoinCurves(Curves=[join_curves, line], Preserve=False)
boundary_surfaces = BoundarySurfaces(Edges=join_curves_2)
extrude = Extrude(Base=boundary_surfaces, Direction=Y)
extrusion = ClusterOutput(extrude)

# ==== cluster RailingCluster
elevation_difference = ClusterInput()
left_landing = ClusterInput()
right_landing = ClusterInput()
water_width = ClusterInput()
left_landing_2 = Number(left_landing)
left_stair_height = ClusterInput()
left_stair_num = ClusterInput()
plane_width = ClusterInput()
railing_height = ClusterInput()
water_width_2 = Number(water_width)
negative = Negative(Value=left_landing_2)
elevation_difference_2 = Number(elevation_difference)
construct_point = ConstructPoint(XCoordinate=0, YCoordinate=0, ZCoordinate=0)
right_landing_2 = Number(right_landing)
left_stair_height_2 = Number(left_stair_height)
left_stair_num_2 = Number(left_stair_num)
railing_height_2 = Number(railing_height)
street_width = ClusterInput()
vector_xyz = VectorXYZ(XComponent=water_width_2, YComponent=Slider(0, range=0..10), ZComponent=Slider(0, range=0..50))  # -> Vector, Length
plane_width_2 = Number(plane_width)
vector_xyz_2 = VectorXYZ(XComponent=negative, YComponent=Slider(0, range=0..10), ZComponent=Slider(0, range=0..10))  # -> Vector, Length
vector_xyz_3 = VectorXYZ(XComponent=right_landing_2, YComponent=Slider(0, range=0..10), ZComponent=elevation_difference_2)  # -> Vector, Length
street_width_2 = Number(street_width)
point = Point(construct_point)
_2 = Number(2)
multiplication = Multiplication(A=left_stair_height_2, B=left_stair_num_2)
division = Division(A=plane_width_2, B=_2)
move = Move(Geometry=point, Motion=vector_xyz.Vector)  # -> Geometry, Transform
move_2 = Move(Geometry=point, Motion=vector_xyz_2.Vector)  # -> Geometry, Transform
number = Number(multiplication)
line = Line(StartPoint=point, EndPoint=move.Geometry)
move_3 = Move(Geometry=move.Geometry, Motion=vector_xyz_3.Vector)  # -> Geometry, Transform
unit_z = UnitZ(Factor=number)
arch_height = Slider(15, range=0..30)
unit_x = UnitX(Factor=division)
curve_middle = CurveMiddle(Curve=line)
move_4 = Move(Geometry=curve_middle, Motion=unit_z)  # -> Geometry, Transform
negative_2 = Negative(Value=unit_x)
unit_z_2 = UnitZ(Factor=arch_height)
move_5 = Move(Geometry=move_4.Geometry, Motion=unit_x)  # -> Geometry, Transform
move_6 = Move(Geometry=move_4.Geometry, Motion=negative_2)  # -> Geometry, Transform
move_7 = Move(Geometry=unit_z_2, Motion=curve_middle)  # -> Geometry, Transform
right_down_point = Point(move_3.Geometry)
left_down_point = Point(move_2.Geometry)
right_top_point = Point(move_5.Geometry)
left_top_point = Point(move_6.Geometry)
number_2 = Number(railing_height_2)
line_2 = Line(StartPoint=move_3.Geometry, EndPoint=move_5.Geometry)
line_3 = Line(StartPoint=move_6.Geometry, EndPoint=move_2.Geometry)
line_4 = Line(StartPoint=point, EndPoint=move_2.Geometry)
line_5 = Line(StartPoint=move_6.Geometry, EndPoint=move_5.Geometry)
line_6 = Line(StartPoint=move.Geometry, EndPoint=move_3.Geometry)
arc_3pt = Arc3Pt(PointA=point, PointB=move_7.Geometry, PointC=move.Geometry)  # -> Arc, Plane, Radius
join_curves = JoinCurves(Curves=[line_5, line_3, line_2, arc_3pt.Arc, line_4, line_6], Preserve=False)
unit_y = UnitY(Factor=street_width_2)
boundary_surfaces = BoundarySurfaces(Edges=join_curves)
railing_width = ClusterInput()
railing_width_2 = Number(railing_width)
line_7 = Line(StartPoint=left_top_point, EndPoint=right_top_point)
line_8 = Line(StartPoint=left_down_point, EndPoint=left_top_point)
line_9 = Line(StartPoint=right_down_point, EndPoint=right_top_point)
extrude = Extrude(Base=boundary_surfaces, Direction=unit_y)
unit_z_3 = UnitZ(Factor=number_2)
unit_z_4 = UnitZ(Factor=number_2)
unit_z_5 = UnitZ(Factor=number_2)
move_8 = Move(Geometry=line_7, Motion=unit_z_3)  # -> Geometry, Transform
move_9 = Move(Geometry=line_9, Motion=unit_z_5)  # -> Geometry, Transform
move_10 = Move(Geometry=line_8, Motion=unit_z_4)  # -> Geometry, Transform
end_points = EndPoints(Curve=move_8.Geometry)  # -> Start, End
end_points_2 = EndPoints(Curve=move_10.Geometry)  # -> Start, End
end_points_3 = EndPoints(Curve=move_9.Geometry)  # -> Start, End
area = Area(Geometry=extrude)  # -> Area, Centroid
line_10 = Line(StartPoint=end_points.Start, EndPoint=left_top_point)
line_11 = Line(StartPoint=end_points_3.Start, EndPoint=right_down_point)
line_12 = Line(StartPoint=left_down_point, EndPoint=end_points_2.Start)
join_curves_2 = JoinCurves(Curves=[move_8.Geometry, line_10], Preserve=False)
pipe = Pipe(Curve=line_10, Radius=railing_width_2, Caps=0)
join_curves_3 = JoinCurves(Curves=[move_10.Geometry, line_12], Preserve=False)
join_curves_4 = JoinCurves(Curves=[move_9.Geometry, line_11], Preserve=False)
pipe_2 = Pipe(Curve=line_12, Radius=railing_width_2, Caps=0)
pipe_3 = Pipe(Curve=line_11, Radius=railing_width_2, Caps=0)
curve_array = CurveArray(Geometry=pipe, Curve=move_8.Geometry, Count=10)  # -> Geometry, Transform
curve_array_2 = CurveArray(Geometry=pipe_2, Curve=move_10.Geometry, Count=10)  # -> Geometry, Transform
curve_array_3 = CurveArray(Geometry=pipe_3, Curve=move_9.Geometry, Count=10)  # -> Geometry, Transform
pipe_4 = Pipe(Curve=join_curves_2, Radius=railing_width_2, Caps=0)
pipe_5 = Pipe(Curve=join_curves_3, Radius=railing_width_2, Caps=0)
pipe_6 = Pipe(Curve=join_curves_4, Radius=railing_width_2, Caps=0)
brep = Brep([curve_array.Geometry, pipe_4, curve_array_2.Geometry, pipe_5, curve_array_3.Geometry, pipe_6])
xz_plane = XZPlane(Origin=area.Centroid)
mirror = Mirror(Geometry=brep, Plane=xz_plane)  # -> Geometry, Transform
brep_2 = Brep([mirror.Geometry, brep])
brep_3 = ClusterOutput(brep_2)

# ==== cluster BridgeBodyCluster
elevation_difference = ClusterInput()
right_landing = ClusterInput()
plane_width = ClusterInput()
bridgw_height = ClusterInput()
water_width = ClusterInput()
bridge_width = ClusterInput()
left_landing = ClusterInput()
elevation_difference_2 = Number(elevation_difference)
right_landing_2 = Number(right_landing)
plane_width_2 = Number(plane_width)
bridgw_height_2 = Number(bridgw_height)
water_width_2 = Number(water_width)
bridge_width_2 = Number(bridge_width)
left_landing_2 = Number(left_landing)
_2 = Number(2)
negative = Negative(Value=left_landing_2)
num = Number(0)
num_2 = Number(0)
num_3 = Number(0)
num_4 = Number(0)
construct_point = ConstructPoint(XCoordinate=0, YCoordinate=0, ZCoordinate=0)
num_5 = Number(0)
vector_xyz = VectorXYZ(XComponent=water_width_2, YComponent=num, ZComponent=num_2)  # -> Vector, Length
division = Division(A=plane_width_2, B=_2)
vector_xyz_2 = VectorXYZ(XComponent=negative, YComponent=num_3, ZComponent=num_4)  # -> Vector, Length
vector_xyz_3 = VectorXYZ(XComponent=right_landing_2, YComponent=num_5, ZComponent=elevation_difference_2)  # -> Vector, Length
point = Point(construct_point)
move = Move(Geometry=point, Motion=vector_xyz.Vector)  # -> Geometry, Transform
move_2 = Move(Geometry=point, Motion=vector_xyz_2.Vector)  # -> Geometry, Transform
line = Line(StartPoint=point, EndPoint=move.Geometry)
unit_z = UnitZ(Factor=bridgw_height_2)
curve_middle = CurveMiddle(Curve=line)
move_3 = Move(Geometry=move.Geometry, Motion=vector_xyz_3.Vector)  # -> Geometry, Transform
unit_x = UnitX(Factor=division)
move_4 = Move(Geometry=curve_middle, Motion=unit_z)  # -> Geometry, Transform
negative_2 = Negative(Value=unit_x)
move_5 = Move(Geometry=move_4.Geometry, Motion=unit_x)  # -> Geometry, Transform
move_6 = Move(Geometry=move_4.Geometry, Motion=negative_2)  # -> Geometry, Transform
arc_crv = ClusterInput()
line_2 = Line(StartPoint=move_3.Geometry, EndPoint=move_5.Geometry)
line_3 = Line(StartPoint=move_6.Geometry, EndPoint=move_2.Geometry)
arc_crv_2 = Curve(arc_crv)
line_4 = Line(StartPoint=point, EndPoint=move_2.Geometry)
line_5 = Line(StartPoint=move.Geometry, EndPoint=move_3.Geometry)
line_6 = Line(StartPoint=move_6.Geometry, EndPoint=move_5.Geometry)
join_curves = JoinCurves(Curves=[line_6, line_2, line_3], Preserve=False)
unit_y = UnitY(Factor=bridge_width_2)
join_curves_2 = JoinCurves(Curves=[join_curves, line_4, line_5, arc_crv_2], Preserve=False)  # -> flatten(Curves)
boundary_surfaces = BoundarySurfaces(Edges=join_curves_2)
bridge_body_crv = Curve(join_curves)
extrude = Extrude(Base=boundary_surfaces, Direction=unit_y)
bridge_body_crv_2 = ClusterOutput(bridge_body_crv)
extrusion = ClusterOutput(extrude)

# ==== cluster _3PointArcCluster
construct_point = ConstructPoint(XCoordinate=0, YCoordinate=0, ZCoordinate=0)
x_component = ClusterInput()
vector_xyz = VectorXYZ(XComponent=x_component, YComponent=Slider(0, range=0..10), ZComponent=Slider(0, range=0..10))  # -> Vector, Length
point = Point(construct_point)
move = Move(Geometry=point, Motion=vector_xyz.Vector)  # -> Geometry, Transform
factor = ClusterInput()
line = Line(StartPoint=point, EndPoint=move.Geometry)
unit_z = UnitZ(Factor=factor)
curve_middle = CurveMiddle(Curve=line)
move_2 = Move(Geometry=unit_z, Motion=curve_middle)  # -> Geometry, Transform
arc_3pt = Arc3Pt(PointA=point, PointB=move_2.Geometry, PointC=move.Geometry)  # -> Arc, Plane, Radius
arc = ClusterOutput(arc_3pt.Arc)

# ==== cluster _1OnlyLeftRoundStair
street_width = ClusterInput()
step_depth = ClusterInput()
step_height = ClusterInput()
street_width_2 = Number(street_width)
step_depth_2 = Number(step_depth)
_0 = Number(1)
step_height_2 = Number(step_height)
subtraction = Subtraction(B=_0)
bottom_start_pt = ClusterInput()
multiplication = Multiplication(A=subtraction, B=step_height_2)
Z = UnitZ(Factor=step_height_2)
Z_2 = UnitZ(Factor=multiplication)
neg = Negative(Value=step_depth_2)
neg_2 = Negative(Value=step_depth_2)
bottom_start_pt_2 = Point(bottom_start_pt)
Y = UnitY(Factor=neg_2)
X = UnitX(Factor=step_depth_2)
Y_2 = UnitY(Factor=neg)
X_2 = UnitX(Factor=step_depth_2)
multiplication_2 = Multiplication(A=Z)
move = Move(Motion=Y)  # -> Geometry, Transform
move_2 = Move(Motion=X)  # -> Geometry, Transform
move_3 = Move(Geometry=bottom_start_pt_2, Motion=X_2)  # -> Geometry, Transform
pt = Point(move_3.Geometry)
move_4 = Move(Geometry=pt, Motion=Y_2)  # -> Geometry, Transform
bottom_endpt = Point(move_4.Geometry)
Z_3 = UnitZ(Factor=step_height_2)
move_5 = Move(Geometry=bottom_endpt, Motion=Z_3)  # -> Geometry, Transform
move_6 = Move(Geometry=bottom_start_pt_2, Motion=Z_3)  # -> Geometry, Transform
move_7 = Move(Geometry=pt, Motion=Z_3)  # -> Geometry, Transform
arc = ArcSED(Start=bottom_start_pt_2, End=bottom_endpt, Direction=Y_2)  # -> Arc, Plane, Radius
pt_2 = Point(move_5.Geometry)
pt_3 = Point(move_6.Geometry)
pt_4 = Point(move_7.Geometry)
bottom_crv = Curve(arc.Arc)
ln = Line(StartPoint=bottom_endpt, EndPoint=pt_2)
ln_2 = Line(StartPoint=pt_4, EndPoint=pt)
ln_3 = Line(StartPoint=pt_2, EndPoint=pt_4)
ln_4 = Line(StartPoint=pt, EndPoint=bottom_endpt)
ln_5 = Line(StartPoint=bottom_start_pt_2, EndPoint=pt)
ln_6 = Line(StartPoint=pt, EndPoint=bottom_endpt)
ln_7 = Line(StartPoint=pt_3, EndPoint=pt_4)
ln_8 = Line(StartPoint=bottom_start_pt_2, EndPoint=pt_3)
ln_9 = Line(StartPoint=pt_4, EndPoint=pt)
ln_10 = Line(StartPoint=bottom_start_pt_2, EndPoint=pt)
_2 = Number(2)
multiplication_3 = Multiplication(A=step_depth_2, B=_2)
join = JoinCurves(Curves=[ln, ln_2, ln_3, ln_4], Preserve=False)
join_2 = JoinCurves(Curves=[ln_8, ln_7, ln_10, ln_9], Preserve=False)
join_3 = JoinCurves(Curves=[ln_6, bottom_crv, ln_5], Preserve=False)
extr = Extrude(Base=bottom_crv, Direction=Z)
_2_2 = Number(2)
boundary_surfaces = BoundarySurfaces(Edges=join_2)
boundary_surfaces_2 = BoundarySurfaces(Edges=join)
X_3 = UnitX(Factor=multiplication_3)
division = Division(A=street_width_2, B=_2_2)
Y_3 = UnitY(Factor=division)
extr_2 = Extrude(Base=boundary_surfaces_2, Direction=X_3)
extr_3 = Extrude(Base=boundary_surfaces, Direction=Y_3)
brep = Brep(extr)
boundary_surfaces_3 = BoundarySurfaces(Edges=join_3)
move_8 = Move(Geometry=boundary_surfaces, Motion=Y_3)  # -> Geometry, Transform
extr_4 = Extrude(Base=boundary_surfaces_3, Direction=Z)
brep_2 = Brep(extr_4)
mirror = Mirror(Geometry=[extr_3, brep_2, extr_2], Plane=move_8.Geometry)  # -> Geometry, Transform
brep_3 = Brep(mirror.Geometry)
brep_4 = Brep([brep_3, extr_3, extr_4, extr_2])
brep_5 = ClusterOutput(brep_4)

# ==== cluster _1OnlyRightRoundStairCluster
bottom_start_pt = ClusterInput()
step_height = ClusterInput()
step_depth = ClusterInput()
street_width = ClusterInput()
bottom_start_pt_2 = Point(bottom_start_pt)
step_height_2 = Number(step_height)
step_depth_2 = Number(step_depth)
street_width_2 = Number(street_width)
_0 = Number(1)
subtraction = Subtraction(B=_0)
multiplication = Multiplication(A=subtraction, B=step_height_2)
Z = UnitZ(Factor=step_height_2)
neg = Negative(Value=step_depth_2)
Z_2 = UnitZ(Factor=multiplication)
neg_2 = Negative(Value=step_depth_2)
X = UnitX(Factor=neg)
Y = UnitY(Factor=neg_2)
X_2 = UnitX(Factor=step_depth_2)
Y_2 = UnitY(Factor=neg)
multiplication_2 = Multiplication(A=Z)
move = Move(Motion=Y)  # -> Geometry, Transform
move_2 = Move(Motion=X_2)  # -> Geometry, Transform
move_3 = Move(Geometry=bottom_start_pt_2, Motion=X)  # -> Geometry, Transform
pt = Point(move_3.Geometry)
move_4 = Move(Geometry=pt, Motion=Y_2)  # -> Geometry, Transform
bottom_endpt = Point(move_4.Geometry)
Z_3 = UnitZ(Factor=step_height_2)
move_5 = Move(Geometry=bottom_endpt, Motion=Z_3)  # -> Geometry, Transform
move_6 = Move(Geometry=bottom_start_pt_2, Motion=Z_3)  # -> Geometry, Transform
arc = ArcSED(Start=bottom_start_pt_2, End=bottom_endpt, Direction=Y_2)  # -> Arc, Plane, Radius
move_7 = Move(Geometry=pt, Motion=Z_3)  # -> Geometry, Transform
pt_2 = Point(move_5.Geometry)
pt_3 = Point(move_6.Geometry)
pt_4 = Point(move_7.Geometry)
bottom_crv = Curve(arc.Arc)
ln = Line(StartPoint=bottom_endpt, EndPoint=pt_2)
ln_2 = Line(StartPoint=pt_4, EndPoint=pt)
ln_3 = Line(StartPoint=pt_2, EndPoint=pt_4)
ln_4 = Line(StartPoint=pt, EndPoint=bottom_endpt)
ln_5 = Line(StartPoint=bottom_start_pt_2, EndPoint=pt)
ln_6 = Line(StartPoint=pt, EndPoint=bottom_endpt)
ln_7 = Line(StartPoint=pt_3, EndPoint=pt_4)
ln_8 = Line(StartPoint=bottom_start_pt_2, EndPoint=pt_3)
ln_9 = Line(StartPoint=pt_4, EndPoint=pt)
ln_10 = Line(StartPoint=bottom_start_pt_2, EndPoint=pt)
_2 = Number(2)
multiplication_3 = Multiplication(A=step_depth_2, B=_2)
join = JoinCurves(Curves=[ln, ln_4, ln_2, ln_3], Preserve=False)
join_2 = JoinCurves(Curves=[ln_8, ln_7, ln_10, ln_9], Preserve=False)
join_3 = JoinCurves(Curves=[ln_6, bottom_crv, ln_5], Preserve=False)
neg_3 = Negative(Value=multiplication_3)
_2_2 = Number(2)
boundary_surfaces = BoundarySurfaces(Edges=join_2)
boundary_surfaces_2 = BoundarySurfaces(Edges=join)
X_3 = UnitX(Factor=neg_3)
division = Division(A=street_width_2, B=_2_2)
extr = Extrude(Base=bottom_crv, Direction=Z)
Y_3 = UnitY(Factor=division)
extr_2 = Extrude(Base=boundary_surfaces_2, Direction=X_3)
extr_3 = Extrude(Base=boundary_surfaces, Direction=Y_3)
brep = Brep(extr)
boundary_surfaces_3 = BoundarySurfaces(Edges=join_3)
move_8 = Move(Geometry=boundary_surfaces, Motion=Y_3)  # -> Geometry, Transform
extr_4 = Extrude(Base=boundary_surfaces_3, Direction=Z)
brep_2 = Brep(extr_4)
mirror = Mirror(Geometry=[extr_3, brep_2, extr_2], Plane=move_8.Geometry)  # -> Geometry, Transform
brep_3 = Brep(mirror.Geometry)
brep_4 = Brep([brep_3, extr_4, extr_3, extr_2])
brep_5 = ClusterOutput(brep_4)

# ==== cluster RightRoundStairWallRailing
round_step_num = ClusterInput()
bottom_start_pt = ClusterInput()
step_height = ClusterInput()
street_width = ClusterInput()
step_length = ClusterInput()
round_step_num_2 = Number(round_step_num)
bottom_start_pt_2 = Point(bottom_start_pt)
step_height_2 = Number(step_height)
street_width_2 = Number(street_width)
step_length_2 = Number(step_length)
multiplication = Multiplication(A=step_length_2, B=round_step_num_2)
neg = Negative(Value=multiplication)
pt = Point(bottom_start_pt_2)
X = UnitX(Factor=neg)
multiplication_2 = Multiplication(A=step_height_2, B=round_step_num_2)
number = Number(1)
Y = UnitY(Factor=neg)
move = Move(Geometry=pt, Motion=X)  # -> Geometry, Transform
subtraction = Subtraction(A=round_step_num_2, B=number)
Z = UnitZ(Factor=multiplication_2)
move_2 = Move(Geometry=move.Geometry, Motion=Y)  # -> Geometry, Transform
move_3 = Move(Geometry=move.Geometry, Motion=Z)  # -> Geometry, Transform
multiplication_3 = Multiplication(A=round_step_num_2, B=step_length_2)
multiplication_4 = Multiplication(A=subtraction, B=step_height_2)
pt_2 = Point(move_2.Geometry)
pt_3 = Point(move_3.Geometry)
Z_2 = UnitZ(Factor=step_height_2)
neg_2 = Negative(Value=multiplication_3)
Z_3 = UnitZ(Factor=multiplication_4)
neg_3 = Negative(Value=step_length_2)
X_2 = UnitX(Factor=neg_2)
Y_2 = UnitY(Factor=neg_2)
Y_3 = UnitY(Factor=neg_3)
X_3 = UnitX(Factor=step_length_2)
multiplication_5 = Multiplication(A=Z_2, B=round_step_num_2)
move_4 = Move(Geometry=bottom_start_pt_2, Motion=X_2)  # -> Geometry, Transform
pt_4 = Point(move_4.Geometry)
move_5 = Move(Geometry=pt_4, Motion=Z_3)  # -> Geometry, Transform
move_6 = Move(Geometry=pt_4, Motion=Y_2)  # -> Geometry, Transform
bottom_endpt = Point(move_6.Geometry)
move_7 = Move(Geometry=pt_4, Motion=multiplication_5)  # -> Geometry, Transform
pt_5 = Point(move_5.Geometry)
move_8 = Move(Geometry=pt_5, Motion=Y_3)  # -> Geometry, Transform
move_9 = Move(Geometry=pt_5, Motion=X_3)  # -> Geometry, Transform
pt_6 = Point(move_8.Geometry)
pt_7 = Point(move_9.Geometry)
arc = ArcSED(Start=bottom_start_pt_2, End=bottom_endpt, Direction=Y_2)  # -> Arc, Plane, Radius
arc_2 = ArcSED(Start=pt_7, End=pt_6, Direction=Y_2)  # -> Arc, Plane, Radius
top_pt = Point(move_7.Geometry)
move_10 = Move(Geometry=top_pt, Motion=X_3)  # -> Geometry, Transform
move_11 = Move(Geometry=top_pt, Motion=Y_3)  # -> Geometry, Transform
top_end_pt = Point(move_11.Geometry)
top_start_pt = Point(move_10.Geometry)
railing_width = ClusterInput()
ralling_height = ClusterInput()
second_crv = Curve(arc_2.Arc)
bottom_crv = Curve(arc.Arc)
arc_3 = ArcSED(Start=top_start_pt, End=top_end_pt, Direction=Y_2)  # -> Arc, Plane, Radius

right_top_point = Point(pt_3)
right_down_point = Point(pt_2)
railing_width_2 = Number(railing_width)
ralling_height_2 = Number(ralling_height)
line = Line(StartPoint=right_down_point, EndPoint=right_top_point)
neg_4 = Negative(Value=railing_width_2)
unit_z = UnitZ(Factor=ralling_height_2)
curve = Curve(line)
X_4 = UnitX(Factor=neg_4)
extrude = Extrude(Base=curve, Direction=unit_z)
extrude_2 = Extrude(Base=extrude, Direction=X_4)

range = Range(Domain=Domain(0, 1), Steps=subtraction)
ln = Line(StartPoint=top_start_pt, EndPoint=top_pt)
ln_2 = Line(StartPoint=top_pt, EndPoint=top_end_pt)
ln_3 = Line(StartPoint=pt_4, EndPoint=top_pt)
ln_4 = Line(StartPoint=pt_4, EndPoint=bottom_endpt)
ln_5 = Line(StartPoint=bottom_start_pt_2, EndPoint=pt_4)
ln_6 = Line(StartPoint=pt_4, EndPoint=bottom_endpt)
crv = Curve(arc_3.Arc)
tweencrv = TweenCurve(CurveA=second_crv, CurveB=bottom_crv, Factor=range, BlendType=0)
extr = Extrude(Base=tweencrv, Direction=Z_2)
join = JoinCurves(Curves=[ln_2, ln, crv], Preserve=False)
join_2 = JoinCurves(Curves=[ln_6, bottom_crv, ln_5], Preserve=False)
num = Number(2)
debrep = DeconstructBrep(Brep=extr)  # -> Faces, Edges, Vertices
item = ListItem(List=debrep.Edges, Index=0, Wrap=True)  # -> Item, Item1, Item2, Item3, Item4
crv_2 = Curve(flatten(item.Item4))
division = Division(A=street_width_2, B=num)
crv_3 = Curve(flatten(item.Item2))
crv_4 = Curve(flatten(item.Item3))
crv_5 = Curve(flatten(item.Item1))
Y_4 = UnitY(Factor=division)
boundary_surfaces = BoundarySurfaces(Edges=join)
cull_i = CullIndex(List=flatten(crv_4), Indices="-1", Wrap=True)  # -> graft(List)
boundary_surfaces_2 = BoundarySurfaces(Edges=join_2)
cull_i_2 = CullIndex(List=flatten(crv_5), Indices="0", Wrap=True)  # -> graft(List)
flip = FlipCurve(Curve=cull_i)  # -> Curve, Flag
crv_6 = Curve([cull_i_2, flip.Curve])
loft = Loft(Curves=crv_6, Options={Adjust=False, Closed=False, LoftEnds=0, LoftSimp=0, LoftType=0, Rebuild=10, Refit=0.01})
debrep_2 = DeconstructBrep(Brep=loft)  # -> Faces, Edges, Vertices
item_2 = ListItem(List=debrep_2.Edges, Index=0, Wrap=True)  # -> Item, Item1, Item2, Item3, Item4
crv_7 = Curve(flatten(item_2.Item4))
join_3 = JoinCurves(Curves=[crv_7, crv_2], Preserve=False)
crv_8 = Curve(join_3)
join_4 = JoinCurves(Curves=[crv_8, ln_5, ln_3, ln], Preserve=False)
crv_9 = Curve(flatten(item_2.Item2))
join_5 = JoinCurves(Curves=[crv_9, crv_3], Preserve=False)
crv_10 = Curve(join_5)
join_6 = JoinCurves(Curves=[ln_3, crv_10, ln_4, ln_2], Preserve=False)
boundary_surfaces_3 = BoundarySurfaces(Edges=join_6)
boundary_surfaces_4 = BoundarySurfaces(Edges=join_4)
extr_2 = Extrude(Base=boundary_surfaces_4, Direction=Y_4)
move_12 = Move(Geometry=boundary_surfaces_4, Motion=Y_4)  # -> Geometry, Transform
brep = Brep(extrude_2)
brep_2 = Brep([extr, boundary_surfaces_3, loft, boundary_surfaces, boundary_surfaces_2])
mirror = Mirror(Geometry=[extr_2, brep_2, brep], Plane=move_12.Geometry)  # -> Geometry, Transform
brep_3 = Brep(mirror.Geometry)
brep_4 = Brep(flatten([brep_2, brep_3, extr_2, brep]))
brep_5 = ClusterOutput(brep_4)

# ==== cluster LeftRoundStairWallRailing
ralling_height = ClusterInput()
railing_width = ClusterInput()
round_step_num = ClusterInput()
bottom_start_pt = ClusterInput()
step_height = ClusterInput()
street_width = ClusterInput()
step_depth = ClusterInput()
round_step_num_2 = Number(round_step_num)
bottom_start_pt_2 = Point(bottom_start_pt)
step_height_2 = Number(step_height)
street_width_2 = Number(street_width)
step_depth_2 = Number(step_depth)
multiplication = Multiplication(A=step_depth_2, B=round_step_num_2)
pt = Point(bottom_start_pt_2)
neg = Negative(Value=multiplication)
X = UnitX(Factor=multiplication)
multiplication_2 = Multiplication(A=step_height_2, B=round_step_num_2)
number = Number(1)
Y = UnitY(Factor=neg)
move = Move(Geometry=pt, Motion=X)  # -> Geometry, Transform
subtraction = Subtraction(A=round_step_num_2, B=number)
Z = UnitZ(Factor=multiplication_2)
move_2 = Move(Geometry=move.Geometry, Motion=Y)  # -> Geometry, Transform
move_3 = Move(Geometry=move.Geometry, Motion=Z)  # -> Geometry, Transform
multiplication_3 = Multiplication(A=round_step_num_2, B=step_depth_2)
multiplication_4 = Multiplication(A=subtraction, B=step_height_2)
pt_2 = Point(move_2.Geometry)
pt_3 = Point(move_3.Geometry)

ralling_height_2 = Number(ralling_height)
railing_width_2 = Number(railing_width)
left_top_point = Point(pt_3)
left_down_point = Point(pt_2)
line = Line(StartPoint=left_down_point, EndPoint=left_top_point)
neg_2 = Negative(Value=railing_width_2)
unit_z = UnitZ(Factor=ralling_height_2)
curve = Curve(line)
X_2 = UnitX(Factor=railing_width_2)
extrude = Extrude(Base=curve, Direction=unit_z)
extrude_2 = Extrude(Base=extrude, Direction=X_2)

Z_2 = UnitZ(Factor=step_height_2)
neg_3 = Negative(Value=multiplication_3)
Z_3 = UnitZ(Factor=multiplication_4)
neg_4 = Negative(Value=step_depth_2)
X_3 = UnitX(Factor=step_depth_2)
X_4 = UnitX(Factor=multiplication_3)
Y_2 = UnitY(Factor=neg_3)
Y_3 = UnitY(Factor=neg_4)
neg_5 = Negative(Value=X_3)
multiplication_5 = Multiplication(A=Z_2, B=round_step_num_2)
move_4 = Move(Geometry=bottom_start_pt_2, Motion=X_4)  # -> Geometry, Transform
pt_4 = Point(move_4.Geometry)
move_5 = Move(Geometry=pt_4, Motion=Z_3)  # -> Geometry, Transform
move_6 = Move(Geometry=pt_4, Motion=Y_2)  # -> Geometry, Transform
bottom_endpt = Point(move_6.Geometry)
move_7 = Move(Geometry=pt_4, Motion=multiplication_5)  # -> Geometry, Transform
pt_5 = Point(move_5.Geometry)
move_8 = Move(Geometry=pt_5, Motion=Y_3)  # -> Geometry, Transform
move_9 = Move(Geometry=pt_5, Motion=neg_5)  # -> Geometry, Transform
pt_6 = Point(move_8.Geometry)
pt_7 = Point(move_9.Geometry)
arc = ArcSED(Start=bottom_start_pt_2, End=bottom_endpt, Direction=Y_2)  # -> Arc, Plane, Radius
arc_2 = ArcSED(Start=pt_7, End=pt_6, Direction=Y_2)  # -> Arc, Plane, Radius
top_pt = Point(move_7.Geometry)
move_10 = Move(Geometry=top_pt, Motion=neg_5)  # -> Geometry, Transform
move_11 = Move(Geometry=top_pt, Motion=Y_3)  # -> Geometry, Transform
top_end_pt = Point(move_11.Geometry)
top_start_pt = Point(move_10.Geometry)
second_crv = Curve(arc_2.Arc)
bottom_crv = Curve(arc.Arc)
arc_3 = ArcSED(Start=top_start_pt, End=top_end_pt, Direction=Y_2)  # -> Arc, Plane, Radius
range = Range(Domain=Domain(0, 1), Steps=subtraction)
ln = Line(StartPoint=top_start_pt, EndPoint=top_pt)
ln_2 = Line(StartPoint=top_pt, EndPoint=top_end_pt)
ln_3 = Line(StartPoint=pt_4, EndPoint=top_pt)
ln_4 = Line(StartPoint=pt_4, EndPoint=bottom_endpt)
ln_5 = Line(StartPoint=bottom_start_pt_2, EndPoint=pt_4)
ln_6 = Line(StartPoint=pt_4, EndPoint=bottom_endpt)
crv = Curve(arc_3.Arc)
tweencrv = TweenCurve(CurveA=second_crv, CurveB=bottom_crv, Factor=range, BlendType=0)
extr = Extrude(Base=tweencrv, Direction=Z_2)
join = JoinCurves(Curves=[ln_2, ln, crv], Preserve=False)
join_2 = JoinCurves(Curves=[ln_6, bottom_crv, ln_5], Preserve=False)
num = Number(2)
debrep = DeconstructBrep(Brep=extr)  # -> Faces, Edges, Vertices
item = ListItem(List=debrep.Edges, Index=0, Wrap=True)  # -> Item, Item1, Item2, Item3, Item4
crv_2 = Curve(flatten(item.Item4))
division = Division(A=street_width_2, B=num)
crv_3 = Curve(flatten(item.Item2))
crv_4 = Curve(flatten(item.Item3))
crv_5 = Curve(flatten(item.Item1))
Y_4 = UnitY(Factor=division)
boundary_surfaces = BoundarySurfaces(Edges=join)
cull_i = CullIndex(List=flatten(crv_4), Indices="-1", Wrap=True)  # -> graft(List)
boundary_surfaces_2 = BoundarySurfaces(Edges=join_2)
cull_i_2 = CullIndex(List=flatten(crv_5), Indices="0", Wrap=True)  # -> graft(List)
flip = FlipCurve(Curve=cull_i)  # -> Curve, Flag
crv_6 = Curve([cull_i_2, flip.Curve])
loft = Loft(Curves=crv_6, Options={Adjust=False, Closed=False, LoftEnds=0, LoftSimp=0, LoftType=0, Rebuild=10, Refit=0.01})
debrep_2 = DeconstructBrep(Brep=loft)  # -> Faces, Edges, Vertices
item_2 = ListItem(List=debrep_2.Edges, Index=0, Wrap=True)  # -> Item, Item1, Item2, Item3, Item4
crv_7 = Curve(flatten(item_2.Item4))
join_3 = JoinCurves(Curves=[crv_7, crv_2], Preserve=False)
crv_8 = Curve(join_3)
join_4 = JoinCurves(Curves=[crv_8, ln_5, ln, ln_3], Preserve=False)
crv_9 = Curve(flatten(item_2.Item2))
join_5 = JoinCurves(Curves=[crv_9, crv_3], Preserve=False)
crv_10 = Curve(join_5)
join_6 = JoinCurves(Curves=[ln_3, crv_10, ln_4, ln_2], Preserve=False)
boundary_surfaces_3 = BoundarySurfaces(Edges=join_6)
boundary_surfaces_4 = BoundarySurfaces(Edges=join_4)
extr_2 = Extrude(Base=boundary_surfaces_4, Direction=Y_4)
move_12 = Move(Geometry=boundary_surfaces_4, Motion=Y_4)  # -> Geometry, Transform
brep = Brep(extrude_2)
brep_2 = Brep(flatten([extr, boundary_surfaces_3, loft, boundary_surfaces, boundary_surfaces_2]))
mirror = Mirror(Geometry=[extr_2, brep_2, brep], Plane=move_12.Geometry)  # -> flatten(Geometry), Transform
brep_3 = Brep(mirror.Geometry)
brep_4 = Brep(flatten([brep_2, brep, brep_3, extr_2]))
brep_5 = ClusterOutput(brep_4)

# ==== cluster LeftRoundStairRailingCluster
round_step_num = ClusterInput()
bottom_start_pt = ClusterInput()
step_height = ClusterInput()
street_width = ClusterInput()
step_depth = ClusterInput()
round_step_num_2 = Number(round_step_num)
bottom_start_pt_2 = Point(bottom_start_pt)
step_height_2 = Number(step_height)
street_width_2 = Number(street_width)
step_depth_2 = Number(step_depth)
railing_height = ClusterInput()
railing_width = ClusterInput()
railing_height_2 = Number(railing_height)
railing_width_2 = Number(railing_width)
multiplication = Multiplication(A=step_depth_2, B=round_step_num_2)
pt = Point(bottom_start_pt_2)
neg = Negative(Value=multiplication)
X = UnitX(Factor=multiplication)
multiplication_2 = Multiplication(A=step_height_2, B=round_step_num_2)
number = Number(1)
Y = UnitY(Factor=neg)
move = Move(Geometry=pt, Motion=X)  # -> Geometry, Transform
subtraction = Subtraction(A=round_step_num_2, B=number)
Z = UnitZ(Factor=multiplication_2)
move_2 = Move(Geometry=move.Geometry, Motion=Y)  # -> Geometry, Transform
move_3 = Move(Geometry=move.Geometry, Motion=Z)  # -> Geometry, Transform
multiplication_3 = Multiplication(A=round_step_num_2, B=step_depth_2)
multiplication_4 = Multiplication(A=subtraction, B=step_height_2)
pt_2 = Point(move_2.Geometry)
left_down_point = Point(pt_2)
left_down_point_2 = Point(left_down_point)
pt_3 = Point(move_3.Geometry)
left_top_point = Point(pt_3)
left_top_point_2 = Point(left_top_point)
line = Line(StartPoint=left_down_point_2, EndPoint=left_top_point_2)
Z_2 = UnitZ(Factor=step_height_2)
neg_2 = Negative(Value=multiplication_3)
Z_3 = UnitZ(Factor=multiplication_4)
neg_3 = Negative(Value=step_depth_2)
X_2 = UnitX(Factor=step_depth_2)
X_3 = UnitX(Factor=multiplication_3)
Y_2 = UnitY(Factor=neg_2)
unit_z = UnitZ(Factor=railing_height_2)
unit_z_2 = UnitZ(Factor=railing_height_2)
Y_3 = UnitY(Factor=neg_3)
neg_4 = Negative(Value=X_2)
move_4 = Move(Motion=unit_z)  # -> Geometry, Transform
multiplication_5 = Multiplication(A=Z_2, B=round_step_num_2)
move_5 = Move(Geometry=bottom_start_pt_2, Motion=X_3)  # -> Geometry, Transform
move_6 = Move(Geometry=line, Motion=unit_z_2)  # -> Geometry, Transform
pt_4 = Point(move_5.Geometry)
move_7 = Move(Geometry=pt_4, Motion=Z_3)  # -> Geometry, Transform
move_8 = Move(Geometry=pt_4, Motion=Y_2)  # -> Geometry, Transform
bottom_endpt = Point(move_8.Geometry)
move_9 = Move(Geometry=pt_4, Motion=multiplication_5)  # -> Geometry, Transform
pt_5 = Point(move_7.Geometry)
move_10 = Move(Geometry=pt_5, Motion=Y_3)  # -> Geometry, Transform
move_11 = Move(Geometry=pt_5, Motion=neg_4)  # -> Geometry, Transform
pt_6 = Point(move_10.Geometry)
pt_7 = Point(move_11.Geometry)
end_points = EndPoints(Curve=move_4.Geometry)  # -> Start, End
end_points_2 = EndPoints(Curve=move_6.Geometry)  # -> Start, End
arc = ArcSED(Start=bottom_start_pt_2, End=bottom_endpt, Direction=Y_2)  # -> Arc, Plane, Radius
line_2 = Line(StartPoint=end_points.Start, EndPoint=left_top_point_2)
arc_2 = ArcSED(Start=pt_7, End=pt_6, Direction=Y_2)  # -> Arc, Plane, Radius
line_3 = Line(StartPoint=left_down_point_2, EndPoint=end_points_2.Start)
top_pt = Point(move_9.Geometry)
move_12 = Move(Geometry=top_pt, Motion=neg_4)  # -> Geometry, Transform
move_13 = Move(Geometry=top_pt, Motion=Y_3)  # -> Geometry, Transform
top_end_pt = Point(move_13.Geometry)
top_start_pt = Point(move_12.Geometry)
second_crv = Curve(arc_2.Arc)
bottom_crv = Curve(arc.Arc)
arc_3 = ArcSED(Start=top_start_pt, End=top_end_pt, Direction=Y_2)  # -> Arc, Plane, Radius
join_curves = JoinCurves(Curves=[move_6.Geometry, line_3], Preserve=False)
pipe = Pipe(Curve=line_3, Radius=railing_width_2, Caps=0)
pipe_2 = Pipe(Curve=line_2, Radius=railing_width_2, Caps=0)
range = Range(Domain=Domain(0, 1), Steps=subtraction)
ln = Line(StartPoint=top_start_pt, EndPoint=top_pt)
ln_2 = Line(StartPoint=top_pt, EndPoint=top_end_pt)
ln_3 = Line(StartPoint=pt_4, EndPoint=top_pt)
ln_4 = Line(StartPoint=pt_4, EndPoint=bottom_endpt)
ln_5 = Line(StartPoint=bottom_start_pt_2, EndPoint=pt_4)
ln_6 = Line(StartPoint=pt_4, EndPoint=bottom_endpt)
crv = Curve(arc_3.Arc)
_3 = Number(4)
curve_array = CurveArray(Geometry=pipe, Curve=move_6.Geometry, Count=_3)  # -> Geometry, Transform
tweencrv = TweenCurve(CurveA=second_crv, CurveB=bottom_crv, Factor=range, BlendType=0)
pipe_3 = Pipe(Curve=join_curves, Radius=railing_width_2, Caps=0)
extr = Extrude(Base=tweencrv, Direction=Z_2)
join = JoinCurves(Curves=[ln_2, ln, crv], Preserve=False)
join_2 = JoinCurves(Curves=[ln_6, bottom_crv, ln_5], Preserve=False)
num = Number(2)
debrep = DeconstructBrep(Brep=extr)  # -> Faces, Edges, Vertices
item = ListItem(List=debrep.Edges, Index=0, Wrap=True)  # -> Item, Item1, Item2, Item3, Item4
crv_2 = Curve(flatten(item.Item4))
division = Division(A=street_width_2, B=num)
crv_3 = Curve(flatten(item.Item2))
brep = Brep([curve_array.Geometry, pipe_3])
crv_4 = Curve(flatten(item.Item3))
crv_5 = Curve(flatten(item.Item1))
Y_4 = UnitY(Factor=division)
boundary_surfaces = BoundarySurfaces(Edges=join)
cull_i = CullIndex(List=flatten(crv_4), Indices="-1", Wrap=True)  # -> graft(List)
boundary_surfaces_2 = BoundarySurfaces(Edges=join_2)
cull_i_2 = CullIndex(List=flatten(crv_5), Indices="0", Wrap=True)  # -> graft(List)
flip = FlipCurve(Curve=cull_i)  # -> Curve, Flag
crv_6 = Curve([cull_i_2, flip.Curve])
loft = Loft(Curves=crv_6, Options={Adjust=False, Closed=False, LoftEnds=0, LoftSimp=0, LoftType=0, Rebuild=10, Refit=0.01})
debrep_2 = DeconstructBrep(Brep=loft)  # -> Faces, Edges, Vertices
item_2 = ListItem(List=debrep_2.Edges, Index=0, Wrap=True)  # -> Item, Item1, Item2, Item3, Item4
crv_7 = Curve(flatten(item_2.Item4))
join_3 = JoinCurves(Curves=[crv_7, crv_2], Preserve=False)
crv_8 = Curve(join_3)
join_4 = JoinCurves(Curves=[crv_8, ln_5, ln, ln_3], Preserve=False)
crv_9 = Curve(flatten(item_2.Item2))
join_5 = JoinCurves(Curves=[crv_9, crv_3], Preserve=False)
crv_10 = Curve(join_5)
join_6 = JoinCurves(Curves=[ln_3, crv_10, ln_4, ln_2], Preserve=False)
boundary_surfaces_3 = BoundarySurfaces(Edges=join_6)
boundary_surfaces_4 = BoundarySurfaces(Edges=join_4)
extr_2 = Extrude(Base=boundary_surfaces_4, Direction=Y_4)
move_14 = Move(Geometry=boundary_surfaces_4, Motion=Y_4)  # -> Geometry, Transform
brep_2 = Brep(flatten([extr, boundary_surfaces_3, loft, boundary_surfaces, boundary_surfaces_2]))
mirror = Mirror(Geometry=[extr_2, brep_2, brep], Plane=move_14.Geometry)  # -> flatten(Geometry), Transform
brep_3 = Brep(mirror.Geometry)
brep_4 = Brep(flatten([brep_2, brep_3, extr_2, brep]))
brep_5 = ClusterOutput(brep_4)
