# Grasshopper definition Bridge_single.gh (Grasshopper 1.0.7)

left_landing = Slider(14, range=0..20)
tread_height = Slider(2.059, range=0..10)
tread_depth = Slider(3, range=0..10)
stair_number = Slider(10, range=0..10)
street_width = Slider(10, range=0..10)
railing_height = Slider(7, range=0..10)
right_landing = Slider(14, range=0..20)
railing_width = Slider(1, range=0..10)
water_width = Slider(56, range=0..100)
negative = Negative(Value=left_landing)
construct_point = ConstructPoint(XCoordinate=0, YCoordinate=0, ZCoordinate=0)
number = Number(tread_height)
vector_xyz = VectorXYZ(XComponent=water_width, YComponent=Slider(0, range=0..10), ZComponent=Slider(0, range=0..50))  # -> Vector, Length
vector_xyz_2 = VectorXYZ(XComponent=negative, YComponent=Slider(0, range=0..10), ZComponent=Slider(0, range=0..10))  # -> Vector, Length
vector_xyz_3 = VectorXYZ(XComponent=right_landing, YComponent=Slider(0, range=0..10), ZComponent=Slider(0, range=0..10))  # -> Vector, Length
tread_height_2 = Slider(2.059, range=0..10)
tread_depth_2 = Slider(3, range=0..10)
stair_number_2 = Slider(10, range=0..10)
point = Point(construct_point)
unit_x = UnitX(Factor=tread_depth)
multiplication = Multiplication(A=number, B=stair_number)
move = Move(Geometry=point, Motion=vector_xyz.Vector)  # -> Geometry, Transform
number_2 = Number([3, 3, 3])
number_3 = Number([10, 5])
move_2 = Move(Geometry=point, Motion=vector_xyz_2.Vector)  # -> Geometry, Transform
arch_height = Slider(15, range=0..30)
number_4 = Number(tread_height_2)
plane_width = Slider(12, range=0..30)
number_5 = Number(multiplication)
line = Line(StartPoint=point, EndPoint=move.Geometry)
move_3 = Move(Geometry=move.Geometry, Motion=vector_xyz_3.Vector)  # -> Geometry, Transform
list_item = ListItem(List=number_2, Index=0, Wrap=True)
unit_z = UnitZ(Factor=number_5)
unit_z_2 = UnitZ(Factor=arch_height)
list_length = ListLength(List=number_2)
unit_x_2 = UnitX(Factor=plane_width)
curve_middle = CurveMiddle(Curve=line)
unit_x_3 = UnitX(Factor=tread_depth_2)
panel = Panel(number_3)
move_4 = Move(Geometry=curve_middle, Motion=unit_z)  # -> Geometry, Transform
move_5 = Move(Geometry=unit_z_2, Motion=curve_middle)  # -> Geometry, Transform
unit_z_3 = UnitZ(Factor=number)
negative_2 = Negative(Value=unit_x_2)
repeat_data = RepeatData()
point_2 = Point(move_2.Geometry)
move_6 = Move(Geometry=move_4.Geometry, Motion=unit_x_2)  # -> Geometry, Transform
move_7 = Move(Geometry=move_4.Geometry, Motion=negative_2)  # -> Geometry, Transform
move_8 = Move(Geometry=point_2, Motion=unit_z_3)  # -> Geometry, Transform
series = Series(Start=0, Step=unit_x_3, Count=number_2)  # -> graft(Series)
series_2 = Series(Start=0, Step=unit_z_3, Count=number_2)  # -> graft(Series)
line_2 = Line(StartPoint=move_3.Geometry, EndPoint=move_6.Geometry)
line_3 = Line(StartPoint=move_7.Geometry, EndPoint=move_2.Geometry)
line_4 = Line(StartPoint=point, EndPoint=move_2.Geometry)
line_5 = Line(StartPoint=move_7.Geometry, EndPoint=move_6.Geometry)
line_6 = Line(StartPoint=move.Geometry, EndPoint=move_3.Geometry)
arc_3pt = Arc3Pt(PointA=point, PointB=move_5.Geometry, PointC=move.Geometry)  # -> Arc, Plane, Radius
move_9 = Move(Geometry=move_8.Geometry, Motion=unit_x_3)  # -> Geometry, Transform
vector_xyz_4 = VectorXYZ(XComponent=series, YComponent=0, ZComponent=series_2)  # -> Vector, Length
polyline = PolyLine(Vertices=[point_2, move_8.Geometry, move_9.Geometry], Closed=False)

point_3 = Point(move_2.Geometry)
point_4 = Point(move_3.Geometry)
point_5 = Point(move_7.Geometry)
point_6 = Point(move_6.Geometry)
number_6 = Number(railing_height)
line_7 = Line(StartPoint=point_5, EndPoint=point_6)
line_8 = Line(StartPoint=point_3, EndPoint=point_5)
line_9 = Line(StartPoint=point_4, EndPoint=point_6)
number_slider = Slider(0.26, range=0..1)
number_slider_2 = Slider(0.26, range=0..1)
number_slider_3 = Slider(0.26, range=0..1)
unit_z_4 = UnitZ(Factor=number_6)
unit_z_5 = UnitZ(Factor=number_6)
unit_z_6 = UnitZ(Factor=number_6)
move_10 = Move(Geometry=line_7, Motion=unit_z_4)  # -> Geometry, Transform
move_11 = Move(Geometry=line_9, Motion=unit_z_6)  # -> Geometry, Transform
move_12 = Move(Geometry=line_8, Motion=unit_z_5)  # -> Geometry, Transform
end_points = EndPoints(Curve=move_10.Geometry)  # -> Start, End
end_points_2 = EndPoints(Curve=move_12.Geometry)  # -> Start, End
end_points_3 = EndPoints(Curve=move_11.Geometry)  # -> Start, End
line_10 = Line(StartPoint=end_points.Start, EndPoint=point_5)
line_11 = Line(StartPoint=end_points_3.Start, EndPoint=point_4)
line_12 = Line(StartPoint=point_3, EndPoint=end_points_2.Start)
join_curves = JoinCurves(Curves=[move_10.Geometry, line_10], Preserve=False)
pipe = Pipe(Curve=line_10, Radius=number_slider, Caps=0)
join_curves_2 = JoinCurves(Curves=[move_12.Geometry, line_12], Preserve=False)
join_curves_3 = JoinCurves(Curves=[move_11.Geometry, line_11], Preserve=False)
pipe_2 = Pipe(Curve=line_12, Radius=number_slider_2, Caps=0)
pipe_3 = Pipe(Curve=line_11, Radius=number_slider_3, Caps=0)
curve_array = CurveArray(Geometry=pipe, Curve=move_10.Geometry, Count=10)  # -> Geometry, Transform
curve_array_2 = CurveArray(Geometry=pipe_2, Curve=move_12.Geometry, Count=10)  # -> Geometry, Transform
curve_array_3 = CurveArray(Geometry=pipe_3, Curve=move_11.Geometry, Count=10)  # -> Geometry, Transform
pipe_4 = Pipe(Curve=join_curves, Radius=number_slider, Caps=0)
pipe_5 = Pipe(Curve=join_curves_2, Radius=number_slider_2, Caps=0)
pipe_6 = Pipe(Curve=join_curves_3, Radius=number_slider_3, Caps=0)
brep = Brep([curve_array.Geometry, pipe_4, curve_array_2.Geometry, pipe_5, curve_array_3.Geometry, pipe_6])

join_curves_4 = JoinCurves(Curves=[line_5, line_3, line_2, arc_3pt.Arc, line_4, line_6], Preserve=False)
move_13 = Move(Geometry=polyline, Motion=vector_xyz_4.Vector)  # -> Geometry, Transform
unit_y = UnitY(Factor=street_width)

unit_z_7 = UnitZ(Factor=number)
negative_3 = Negative(Value=unit_x)
point_7 = Point(move_3.Geometry)
move_14 = Move(Geometry=point_7, Motion=unit_z_7)  # -> Geometry, Transform
series_3 = Series(Start=0, Step=unit_x, Count=stair_number)  # -> graft(Series)
series_4 = Series(Start=0, Step=unit_z_7, Count=stair_number)  # -> graft(Series)
move_15 = Move(Geometry=move_14.Geometry, Motion=negative_3)  # -> Geometry, Transform
negative_4 = Negative(Value=series_3)
polyline_2 = PolyLine(Vertices=[point_7, move_14.Geometry, move_15.Geometry], Closed=False)
vector_xyz_5 = VectorXYZ(XComponent=negative_4, YComponent=0, ZComponent=series_4)  # -> Vector, Length
move_16 = Move(Geometry=polyline_2, Motion=vector_xyz_5.Vector)  # -> Geometry, Transform
join_curves_5 = JoinCurves(Curves=flatten(move_16.Geometry), Preserve=False)
end_points_4 = EndPoints(Curve=join_curves_5)  # -> Start, End
line_13 = Line(StartPoint=end_points_4.Start, EndPoint=end_points_4.End)
join_curves_6 = JoinCurves(Curves=[join_curves_5, line_13], Preserve=False)
boundary_surfaces = BoundarySurfaces(Edges=join_curves_6)
extrude = Extrude(Base=boundary_surfaces, Direction=unit_y)

unit_x_4 = UnitX(Factor=tread_depth)
unit_z_8 = UnitZ(Factor=number)
point_8 = Point(move_2.Geometry)
move_17 = Move(Geometry=point_8, Motion=unit_z_8)  # -> Geometry, Transform
series_5 = Series(Start=0, Step=unit_x_4, Count=stair_number)  # -> graft(Series)
series_6 = Series(Start=0, Step=unit_z_8, Count=stair_number)  # -> graft(Series)
move_18 = Move(Geometry=move_17.Geometry, Motion=unit_x_4)  # -> Geometry, Transform
vector_xyz_6 = VectorXYZ(XComponent=series_5, YComponent=0, ZComponent=series_6)  # -> Vector, Length
polyline_3 = PolyLine(Vertices=[point_8, move_17.Geometry, move_18.Geometry], Closed=False)
move_19 = Move(Geometry=polyline_3, Motion=vector_xyz_6.Vector)  # -> Geometry, Transform
join_curves_7 = JoinCurves(Curves=flatten(move_19.Geometry), Preserve=False)
end_points_5 = EndPoints(Curve=join_curves_7)  # -> Start, End
line_14 = Line(StartPoint=end_points_5.Start, EndPoint=end_points_5.End)
join_curves_8 = JoinCurves(Curves=[line_14, join_curves_7], Preserve=False)
boundary_surfaces_2 = BoundarySurfaces(Edges=join_curves_8)
extrude_2 = Extrude(Base=boundary_surfaces_2, Direction=unit_y)
brep_2 = Brep([extrude_2, extrude])  # disabled

boundary_surfaces_3 = BoundarySurfaces(Edges=join_curves_4)
join_curves_9 = JoinCurves(Curves=flatten(move_13.Geometry), Preserve=False)
end_points_6 = EndPoints(Curve=join_curves_9)  # -> Start, End
line_15 = Line(StartPoint=end_points_6.Start, EndPoint=end_points_6.End)
extrude_3 = Extrude(Base=boundary_surfaces_3, Direction=unit_y)
join_curves_10 = JoinCurves(Curves=[line_15, join_curves_9], Preserve=False)

# ---- group: Shoulder- Stone
join_curves_11 = JoinCurves(Curves=[line_5, line_3, line_2], Preserve=False)
unit_z_9 = UnitZ(Factor=railing_height)
unit_y_2 = UnitY(Factor=railing_width)
extrude_4 = Extrude(Base=join_curves_11, Direction=unit_z_9)
extrude_5 = Extrude(Base=extrude_4, Direction=unit_y_2)
subtraction = Subtraction(A=street_width, B=railing_width)
unit_y_3 = UnitY(Factor=subtraction)
move_20 = Move(Geometry=extrude_5, Motion=unit_y_3)  # -> Geometry, Transform

# ----
boundary_surfaces_4 = BoundarySurfaces(Edges=join_curves_10)
extrude_6 = Extrude(Base=boundary_surfaces_4, Direction=unit_y)
brep_3 = Brep(extrude_6)
area = Area(Geometry=extrude_3)  # -> Area, Centroid
xz_plane = XZPlane(Origin=area.Centroid)
mirror = Mirror(Geometry=brep, Plane=xz_plane)  # -> Geometry, Transform
brep_4 = Brep([mirror.Geometry, brep])
number_slider_4 = Slider(176, range=0..1000)
colour_rgb = ColourRGB(Alpha=255, Red=number_slider_4, Green=number_slider_4, Blue=number_slider_4)
brep_5 = Brep([brep_4, extrude_3])
create_material = CreateMaterial(Diffuse=colour_rgb, Specular=RGB(254, 255, 255), Emission=RGB(0, 0, 0), Transparency=0, Shine=Slider(10, range=0..10))
custom_preview = CustomPreview(Geometry=brep_5, Material=create_material)
