# Grasshopper definition Bridge_stairs.gh (Grasshopper 1.0.7)

stair_number = Slider(10, range=0..10)
tread_length = Slider(3, range=0..10)
number_slider = Slider(10, range=0..10)
tread_height = Slider(2, range=0..10)
left_landing = Slider(14, range=0..20)
street_width = Slider(10, range=0..10)
right_landing = Slider(14, range=0..20)
railing_width = Slider(1, range=0..10)
railing_height = Slider(7, range=0..10)
water_width = Slider(56, range=0..100)
negative = Negative(Value=left_landing)
construct_point = ConstructPoint(XCoordinate=0, YCoordinate=0, ZCoordinate=0)
vector_xyz = VectorXYZ(XComponent=water_width, YComponent=Slider(0, range=0..10), ZComponent=Slider(0, range=0..10))  # -> Vector, Length
vector_xyz_2 = VectorXYZ(XComponent=negative, YComponent=Slider(0, range=0..10), ZComponent=Slider(0, range=0..10))  # -> Vector, Length
vector_xyz_3 = VectorXYZ(XComponent=right_landing, YComponent=Slider(0, range=0..10), ZComponent=Slider(0, range=0..10))  # -> Vector, Length
point = Point(construct_point)
move = Move(Geometry=point, Motion=vector_xyz.Vector)  # -> Geometry, Transform
move_2 = Move(Geometry=point, Motion=vector_xyz_2.Vector)  # -> Geometry, Transform
bridge_height = Slider(20, range=0..40)
arch_height = Slider(16, range=0..30)
plane_width = Slider(12, range=0..30)
line = Line(StartPoint=point, EndPoint=move.Geometry)
move_3 = Move(Geometry=move.Geometry, Motion=vector_xyz_3.Vector)  # -> Geometry, Transform
unit_z = UnitZ(Factor=bridge_height)
unit_z_2 = UnitZ(Factor=arch_height)
unit_x = UnitX(Factor=plane_width)
curve_middle = CurveMiddle(Curve=line)
move_4 = Move(Geometry=curve_middle, Motion=unit_z)  # -> Geometry, Transform
move_5 = Move(Geometry=unit_z_2, Motion=curve_middle)  # -> Geometry, Transform
negative_2 = Negative(Value=unit_x)
move_6 = Move(Geometry=move_4.Geometry, Motion=unit_x)  # -> Geometry, Transform
move_7 = Move(Geometry=move_4.Geometry, Motion=negative_2)  # -> Geometry, Transform
line_2 = Line(StartPoint=move_3.Geometry, EndPoint=move_6.Geometry)
line_3 = Line(StartPoint=move_7.Geometry, EndPoint=move_2.Geometry)
line_4 = Line(StartPoint=point, EndPoint=move_2.Geometry)
line_5 = Line(StartPoint=move_7.Geometry, EndPoint=move_6.Geometry)

# ---- group: Shoulder- Stone
join_curves = JoinCurves(Curves=[line_5, line_3, line_2], Preserve=False)
unit_z_3 = UnitZ(Factor=railing_height)
unit_y = UnitY(Factor=railing_width)
extrude = Extrude(Base=join_curves, Direction=unit_z_3)
extrude_2 = Extrude(Base=extrude, Direction=unit_y)
subtraction = Subtraction(A=street_width, B=railing_width)
unit_y_2 = UnitY(Factor=subtraction)
move_8 = Move(Geometry=extrude_2, Motion=unit_y_2)  # -> Geometry, Transform

# ----
line_6 = Line(StartPoint=move.Geometry, EndPoint=move_3.Geometry)
arc_3pt = Arc3Pt(PointA=point, PointB=move_5.Geometry, PointC=move.Geometry)  # -> Arc, Plane, Radius
join_curves_2 = JoinCurves(Curves=[line_5, line_3, line_2, arc_3pt.Arc, line_4, line_6], Preserve=False)
unit_y_3 = UnitY(Factor=street_width)

# ---- group: Stairs
unit_x_2 = UnitX(Factor=tread_length)
negative_3 = Negative(Value=unit_x_2)
unit_x_3 = UnitX(Factor=number_slider)
move_9 = Move(Geometry=move_2.Geometry, Motion=negative_3)  # -> Geometry, Transform
unit_z_4 = UnitZ(Factor=tread_height)
negative_4 = Negative(Value=unit_x_3)
point_2 = Point(move_9.Geometry)
move_10 = Move(Geometry=point_2, Motion=unit_z_4)  # -> Geometry, Transform
move_11 = Move(Geometry=point_2, Motion=negative_4)  # -> Geometry, Transform
series = Series(Start=0, Step=unit_x_2, Count=stair_number)  # -> graft(Series)
series_2 = Series(Start=0, Step=unit_z_4, Count=stair_number)  # -> graft(Series)
move_12 = Move(Geometry=move_10.Geometry, Motion=unit_x_2)  # -> Geometry, Transform
vector_xyz_4 = VectorXYZ(XComponent=series, YComponent=0, ZComponent=series_2)  # -> Vector, Length
line_7 = Line(StartPoint=move_11.Geometry, EndPoint=point_2)
polyline = PolyLine(Vertices=[point_2, move_10.Geometry, move_12.Geometry], Closed=False)
move_13 = Move(Geometry=polyline, Motion=vector_xyz_4.Vector)  # -> Geometry, Transform
join_curves_3 = JoinCurves(Curves=flatten(move_13.Geometry), Preserve=False)
end_points = EndPoints(Curve=join_curves_3)  # -> Start, End
move_14 = Move(Geometry=end_points.Start, Motion=unit_x_2)  # -> Geometry, Transform
move_15 = Move(Geometry=end_points.End, Motion=unit_x_2)  # -> Geometry, Transform
line_8 = Line(StartPoint=end_points.End, EndPoint=move_15.Geometry)
line_9 = Line(StartPoint=end_points.Start, EndPoint=move_14.Geometry)
line_10 = Line(StartPoint=move_14.Geometry, EndPoint=move_15.Geometry)
join_curves_4 = JoinCurves(Curves=[join_curves_3, line_10, line_8, line_9], Preserve=False)
extrude_3 = Extrude(Base=line_7, Direction=unit_y_3)
boundary_surfaces = BoundarySurfaces(Edges=join_curves_4)
extrude_4 = Extrude(Base=boundary_surfaces, Direction=unit_y_3)

unit_x_4 = UnitX(Factor=tread_length)
unit_z_5 = UnitZ(Factor=tread_height)
move_16 = Move(Geometry=move_3.Geometry, Motion=unit_x_4)  # -> Geometry, Transform
unit_x_5 = UnitX(Factor=number_slider)
negative_5 = Negative(Value=unit_x_4)
point_3 = Point(move_16.Geometry)
move_17 = Move(Geometry=point_3, Motion=unit_z_5)  # -> Geometry, Transform
move_18 = Move(Geometry=point_3, Motion=unit_x_5)  # -> Geometry, Transform
series_3 = Series(Start=0, Step=unit_x_4, Count=stair_number)  # -> graft(Series)
series_4 = Series(Start=0, Step=unit_z_5, Count=stair_number)  # -> graft(Series)
move_19 = Move(Geometry=move_17.Geometry, Motion=negative_5)  # -> Geometry, Transform
negative_6 = Negative(Value=series_3)
line_11 = Line(StartPoint=move_18.Geometry, EndPoint=point_3)
polyline_2 = PolyLine(Vertices=[point_3, move_17.Geometry, move_19.Geometry], Closed=False)
vector_xyz_5 = VectorXYZ(XComponent=negative_6, YComponent=0, ZComponent=series_4)  # -> Vector, Length
move_20 = Move(Geometry=polyline_2, Motion=vector_xyz_5.Vector)  # -> Geometry, Transform
join_curves_5 = JoinCurves(Curves=flatten(move_20.Geometry), Preserve=False)
end_points_2 = EndPoints(Curve=join_curves_5)  # -> Start, End
move_21 = Move(Geometry=end_points_2.Start, Motion=negative_5)  # -> Geometry, Transform
move_22 = Move(Geometry=end_points_2.End, Motion=negative_5)  # -> Geometry, Transform
line_12 = Line(StartPoint=end_points_2.End, EndPoint=move_22.Geometry)
line_13 = Line(StartPoint=end_points_2.Start, EndPoint=move_21.Geometry)
line_14 = Line(StartPoint=move_21.Geometry, EndPoint=move_22.Geometry)
join_curves_6 = JoinCurves(Curves=[join_curves_5, line_14, line_12, line_13], Preserve=False)
extrude_5 = Extrude(Base=line_11, Direction=unit_y_3)
boundary_surfaces_2 = BoundarySurfaces(Edges=join_curves_6)
extrude_6 = Extrude(Base=boundary_surfaces_2, Direction=unit_y_3)

# ----
boundary_surfaces_3 = BoundarySurfaces(Edges=join_curves_2)
extrude_7 = Extrude(Base=boundary_surfaces_3, Direction=unit_y_3)

# ---- group: Shoulders-Iron
number_slider_2 = Slider(0.26, range=0..1)
number_slider_3 = Slider(0.26, range=0..1)
number_slider_4 = Slider(0.26, range=0..1)
unit_z_6 = UnitZ(Factor=railing_height)
unit_z_7 = UnitZ(Factor=railing_height)
unit_z_8 = UnitZ(Factor=railing_height)
move_23 = Move(Geometry=line_5, Motion=unit_z_6)  # -> Geometry, Transform
move_24 = Move(Geometry=line_10, Motion=unit_z_7)  # -> Geometry, Transform
move_25 = Move(Geometry=line_14, Motion=unit_z_8)  # -> Geometry, Transform
end_points_3 = EndPoints(Curve=move_23.Geometry)  # -> Start, End
end_points_4 = EndPoints(Curve=move_25.Geometry)  # -> Start, End
end_points_5 = EndPoints(Curve=move_24.Geometry)  # -> Start, End
line_15 = Line(StartPoint=end_points_3.Start, EndPoint=move_7.Geometry)
line_16 = Line(StartPoint=end_points_4.Start, EndPoint=move_3.Geometry)
line_17 = Line(StartPoint=move_2.Geometry, EndPoint=end_points_5.Start)
join_curves_7 = JoinCurves(Curves=[move_24.Geometry, line_17], Preserve=False)
join_curves_8 = JoinCurves(Curves=[move_23.Geometry, line_15], Preserve=False)
pipe = Pipe(Curve=line_15, Radius=number_slider_2, Caps=0)
area = Area(Geometry=extrude_7)  # -> Area, Centroid
join_curves_9 = JoinCurves(Curves=[move_25.Geometry, line_16], Preserve=False)
pipe_2 = Pipe(Curve=line_17, Radius=number_slider_3, Caps=0)
pipe_3 = Pipe(Curve=line_16, Radius=number_slider_4, Caps=0)
curve_array = CurveArray(Geometry=pipe, Curve=move_23.Geometry, Count=10)  # -> Geometry, Transform
curve_array_2 = CurveArray(Geometry=pipe_2, Curve=move_24.Geometry, Count=10)  # -> Geometry, Transform
xz_plane = XZPlane(Origin=area.Centroid)
curve_array_3 = CurveArray(Geometry=pipe_3, Curve=move_25.Geometry, Count=10)  # -> Geometry, Transform
pipe_4 = Pipe(Curve=join_curves_8, Radius=number_slider_2, Caps=0)
pipe_5 = Pipe(Curve=join_curves_7, Radius=number_slider_3, Caps=0)
pipe_6 = Pipe(Curve=join_curves_9, Radius=number_slider_4, Caps=0)
mirror = Mirror(Geometry=[curve_array.Geometry, pipe_4, curve_array_2.Geometry, pipe_5, curve_array_3.Geometry, pipe_6], Plane=xz_plane)  # -> Geometry, Transform
