# Grasshopper definition Bridge_test.gh (Grasshopper 1.0.7)

width = Slider(74, range=0..100)
landing = Slider(19, range=0..100)
street_width = Slider(17, range=0..20)
water_line = Slider(6, range=0..10)
arch_height = Slider(6, range=0..10)
base_extrusion = Slider(11, range=0..100)
location = Slider(25, range=0..100)
circle_middle = Slider(10, range=0..20)
circle_2 = Slider(7, range=0..20)
bridge_width = Slider(15, range=0..20)

unit_x = UnitX(Factor=width)
unit_x_2 = UnitX(Factor=landing)
construct_point = ConstructPoint(XCoordinate=0, YCoordinate=0, ZCoordinate=0)
division = Division(A=street_width, B=2)
unit_y = UnitY(Factor=division)
negative = Negative(Value=unit_x_2)
point = Point(construct_point)
move = Move(Geometry=point, Motion=unit_x)  # -> Geometry, Transform
move_2 = Move(Geometry=point, Motion=negative)  # -> Geometry, Transform
negative_2 = Negative(Value=unit_y)
line = Line(StartPoint=point, EndPoint=move.Geometry)
move_3 = Move(Geometry=point, Motion=unit_y)  # -> Geometry, Transform
move_4 = Move(Geometry=point, Motion=negative_2)  # -> Geometry, Transform
line_2 = Line(StartPoint=point, EndPoint=move_2.Geometry)
unit_z = UnitZ(Factor=water_line)
unit_z_2 = UnitZ(Factor=arch_height)
curve_middle = CurveMiddle(Curve=line)
line_3 = Line(StartPoint=move_3.Geometry, EndPoint=move_4.Geometry)
yz_plane = YZPlane(Origin=curve_middle)
negative_3 = Negative(Value=unit_z)
move_5 = Move(Geometry=curve_middle, Motion=unit_z_2)  # -> Geometry, Transform
unit_z_3 = UnitZ(Factor=base_extrusion)
extrude = Extrude(Base=line_3, Direction=negative)
mirror = Mirror(Geometry=line_2, Plane=yz_plane)  # -> Geometry, Transform
move_6 = Move(Geometry=line_3, Motion=negative_3)  # -> Geometry, Transform
negative_4 = Negative(Value=unit_z_3)
arc_3pt = Arc3Pt(PointA=point, PointB=move_5.Geometry, PointC=move.Geometry)  # -> Arc, Plane, Radius
fillet = Slider(15, range=-11..100)
extrude_2 = Extrude(Base=extrude, Direction=negative_4)
join_curves = JoinCurves(Curves=flatten([mirror.Geometry, arc_3pt.Arc, line_2]), Preserve=False)
mirror_2 = Mirror(Geometry=extrude_2, Plane=yz_plane)  # -> Geometry, Transform
fillet_2 = Fillet(Curve=join_curves, Radius=fillet)
extrude_3 = Extrude(Base=move_6.Geometry, Direction=unit_x)
brep = Brep([mirror_2.Geometry, extrude_2])
end_points = EndPoints(Curve=fillet_2)  # -> Start, End
custom_preview = CustomPreview(Geometry=brep, Material=ColourSwatch(SwatchColor=RGB(125, 125, 125)))
custom_preview_2 = CustomPreview(Geometry=extrude_3, Material=ColourSwatch(SwatchColor=RGB(45, 173, 252)))
area = Area(Geometry=extrude_3)  # -> Area, Centroid
move_7 = Move(Geometry=end_points.Start, Motion=negative_4)  # -> Geometry, Transform
move_8 = Move(Geometry=end_points.End, Motion=negative_4)  # -> Geometry, Transform
unit_x_3 = UnitX(Factor=location)
xz_plane = XZPlane(Origin=area.Centroid)
line_4 = Line(StartPoint=end_points.Start, EndPoint=move_7.Geometry)
line_5 = Line(StartPoint=move_7.Geometry, EndPoint=move_8.Geometry)
line_6 = Line(StartPoint=end_points.End, EndPoint=move_8.Geometry)
move_9 = Move(Geometry=xz_plane, Motion=unit_x_3)  # -> Geometry, Transform
circle = Circle(Plane=xz_plane, Radius=circle_middle)
join_curves_2 = JoinCurves(Curves=flatten([line_5, line_6, line_4, fillet_2]), Preserve=False)
circle_3 = Circle(Plane=move_9.Geometry, Radius=circle_2)
circle_4 = Circle(Plane=move_9.Geometry, Radius=circle_2)
negative_5 = Negative(Value=bridge_width)
boundary_surfaces = BoundarySurfaces(Edges=circle)
division_2 = Division(A=bridge_width, B=2)
boundary_surfaces_2 = BoundarySurfaces(Edges=join_curves_2)
boundary_surfaces_3 = BoundarySurfaces(Edges=circle_4)
amplitude = Amplitude(Vector=boundary_surfaces_2, Amplitude=division_2)
amplitude_2 = Amplitude(Vector=boundary_surfaces_2, Amplitude=negative_5)
amplitude_3 = Amplitude(Vector=boundary_surfaces, Amplitude=negative_5)
amplitude_4 = Amplitude(Vector=boundary_surfaces, Amplitude=division_2)
move_10 = Move(Geometry=boundary_surfaces_2, Motion=amplitude)  # -> Geometry, Transform
move_11 = Move(Geometry=fillet_2, Motion=amplitude)  # -> Geometry, Transform
unit_z_4 = UnitZ(Factor=Slider(4, range=0..10))
move_12 = Move(Geometry=boundary_surfaces_3, Motion=amplitude_4)  # -> Geometry, Transform
move_13 = Move(Geometry=boundary_surfaces, Motion=amplitude_4)  # -> Geometry, Transform
unit_z_5 = UnitZ(Factor=circle_2)
extrude_4 = Extrude(Base=move_11.Geometry, Direction=unit_z_4)
extrude_5 = Extrude(Base=move_10.Geometry, Direction=amplitude_2)
unit_z_6 = UnitZ(Factor=circle_middle)
extrude_6 = Extrude(Base=move_12.Geometry, Direction=amplitude_3)
amplitude_5 = Amplitude(Vector=extrude_4, Amplitude=Slider(1, range=0..10))
extrude_7 = Extrude(Base=move_13.Geometry, Direction=amplitude_3)
solid_difference = SolidDifference(BrepsA=extrude_5, BrepsB=brep)
negative_6 = Negative(Value=unit_z_5)
negative_7 = Negative(Value=amplitude_5)
box = Box(extrude_6)
negative_8 = Negative(Value=unit_z_6)
box_2 = Box(extrude_7)
extrude_8 = Extrude(Base=extrude_4, Direction=negative_7)
move_14 = Move(Geometry=box, Motion=negative_6)  # -> Geometry, Transform
move_15 = Move(Geometry=box_2, Motion=negative_8)  # -> Geometry, Transform
mirror_3 = Mirror(Geometry=extrude_8, Plane=xz_plane)  # -> Geometry, Transform
solid_union = SolidUnion(Breps=[move_14.Geometry, extrude_6])
solid_union_2 = SolidUnion(Breps=[move_15.Geometry, extrude_7])
merge_faces = MergeFaces(Brep=solid_union)  # -> Breps, Before, After
merge_faces_2 = MergeFaces(Brep=solid_union_2)  # -> Breps, Before, After
mirror_4 = Mirror(Geometry=merge_faces.Breps, Plane=yz_plane)  # -> Geometry, Transform
solid_difference_2 = SolidDifference(BrepsA=solid_difference, BrepsB=[mirror_4.Geometry, merge_faces.Breps, merge_faces_2.Breps])
