# Grasshopper definition poly_test.gh (Grasshopper 1.0.7)

number_slider = Slider(50, range=0..100)
construct_point = ConstructPoint(XCoordinate=0, YCoordinate=0, ZCoordinate=0)
unit_x = UnitX(Factor=number_slider)
unit_z = UnitZ(Factor=Slider(19, range=0..100))
division = Division(A=number_slider, B=Slider(2, range=0..100))
A = Point(construct_point)
unit_z_2 = UnitZ(Factor=division)
move = Move(Geometry=A, Motion=unit_x)  # -> Geometry, Transform
B = Point(move.Geometry)
line = Line(StartPoint=A, EndPoint=B)
curve_middle = CurveMiddle(Curve=line)
H = Point(curve_middle)
move_2 = Move(Geometry=curve_middle, Motion=unit_z)  # -> Geometry, Transform
move_3 = Move(Geometry=curve_middle, Motion=unit_z_2)  # -> Geometry, Transform
yz_plane = YZPlane(Origin=H)
C = Point(move_2.Geometry)
distance = Distance(PointA=C, PointB=move_3.Geometry)
xz_plane = XZPlane(Origin=C)
number_slider_2 = Slider(1, range=0..1)
line_2 = Line(StartPoint=B, EndPoint=C)
line_3 = Line(StartPoint=A, EndPoint=C)
circle = Circle(Plane=xz_plane, Radius=distance)
curve_line = CurveLine(Curve=circle, Line=line_3)  # -> Points, Params, Count
curve_line_2 = CurveLine(Curve=circle, Line=line_2)  # -> Points, Params, Count
list_item = ListItem(List=curve_line.Points, Index=number_slider_2, Wrap=True)
list_item_2 = ListItem(List=curve_line_2.Points, Index=number_slider_2, Wrap=True)
M = Point(list_item)
N = Point(list_item_2)
line_4 = Line(StartPoint=N, EndPoint=B)
line_5 = Line(StartPoint=M, EndPoint=A)
curve_middle_2 = CurveMiddle(Curve=line_4)
curve_middle_3 = CurveMiddle(Curve=line_5)
curve_closest_point = CurveClosestPoint(Point=curve_middle_3, Curve=line)  # -> Point, Parameter, Distance
distance_2 = Distance(PointA=M, PointB=curve_middle_3)
square = Square(Value=curve_closest_point.Distance)
square_2 = Square(Value=distance_2)
subtraction = Subtraction(A=square_2, B=square)
square_root = SquareRoot(Value=subtraction)
division_2 = Division(A=square_2, B=square_root)
negative = Negative(Value=division_2)
unit_x_2 = UnitX(Factor=negative)
unit_x_3 = UnitX(Factor=division_2)
move_4 = Move(Geometry=A, Motion=unit_x_3)  # -> Geometry, Transform
move_5 = Move(Geometry=B, Motion=unit_x_2)  # -> Geometry, Transform
E = Point(move_4.Geometry)
line_6 = Line(StartPoint=move_4.Geometry, EndPoint=curve_middle_3)
line_7 = Line(StartPoint=move_5.Geometry, EndPoint=curve_middle_2)
xz_plane_2 = XZPlane(Origin=move_4.Geometry)
F = Point(move_5.Geometry)
line_line = LineLine(Line1=line_6, Line2=line_7)  # -> ParamA, ParamB, PointA, PointB
G = Point(line_line.PointA)
distance_3 = Distance(PointA=C, PointB=line_line.PointA)
xz_plane_3 = XZPlane(Origin=line_line.PointA)
circle_2 = Circle(Plane=xz_plane_2, Radius=division_2)
circle_3 = Circle(Plane=xz_plane_3, Radius=distance_3)
curve_curve = CurveCurve(CurveA=circle_2, CurveB=circle_3)  # -> Points, ParamsA, ParamsB
negative_2 = Negative(Value=Slider(1, range=0..1))
unit_x_4 = UnitX(Factor=negative_2)
unit_z_3 = UnitZ(Factor=1)
point = Point(curve_curve.Points)
arc_sed = ArcSED(Start=C, End=point, Direction=unit_x_4)  # -> Arc, Plane, Radius
arc_sed_2 = ArcSED(Start=A, End=point, Direction=unit_z_3)  # -> Arc, Plane, Radius
join_curves = JoinCurves(Curves=[arc_sed.Arc, arc_sed_2.Arc], Preserve=False)
mirror = Mirror(Geometry=join_curves, Plane=yz_plane)  # -> Geometry, Transform
join_curves_2 = JoinCurves(Curves=[join_curves, mirror.Geometry], Preserve=False)
