# Grasshopper definition round_stair_with_long_edges.gh (Grasshopper 1.0.7)

_1_only_right_round_stair_cluster = _1OnlyRightRoundStairCluster(street_width=178)
brep = Brep(_1_only_right_round_stair_cluster)

_1_only_left_round_stair = _1OnlyLeftRoundStair(street_width=178)
brep_2 = Brep(_1_only_left_round_stair)

# ==== cluster _1OnlyLeftRoundStair
street_width = ClusterInput()
step_depth = ClusterInput()
step_height = ClusterInput()
street_width_2 = Number(street_width)
step_depth_2 = Number(step_depth)
_0 = Number(1)
step_height_2 = Number(step_height)
subtraction = Subtraction(B=_0)
bottom_start_pt = ClusterInput()
multiplication = Multiplication(A=subtraction, B=step_height_2)
Z = UnitZ(Factor=step_height_2)
Z_2 = UnitZ(Factor=multiplication)
neg = Negative(Value=step_depth_2)
neg_2 = Negative(Value=step_depth_2)
bottom_start_pt_2 = Point(bottom_start_pt)
Y = UnitY(Factor=neg_2)
X = UnitX(Factor=step_depth_2)
Y_2 = UnitY(Factor=neg)
X_2 = UnitX(Factor=step_depth_2)
multiplication_2 = Multiplication(A=Z)
move = Move(Motion=Y)  # -> Geometry, Transform
move_2 = Move(Motion=X)  # -> Geometry, Transform
move_3 = Move(Geometry=bottom_start_pt_2, Motion=X_2)  # -> Geometry, Transform
pt = Point(move_3.Geometry)
move_4 = Move(Geometry=pt, Motion=Y_2)  # -> Geometry, Transform
bottom_endpt = Point(move_4.Geometry)
Z_3 = UnitZ(Factor=step_height_2)
move_5 = Move(Geometry=bottom_endpt, Motion=Z_3)  # -> Geometry, Transform
move_6 = Move(Geometry=bottom_start_pt_2, Motion=Z_3)  # -> Geometry, Transform
move_7 = Move(Geometry=pt, Motion=Z_3)  # -> Geometry, Transform
arc = ArcSED(Start=bottom_start_pt_2, End=bottom_endpt, Direction=Y_2)  # -> Arc, Plane, Radius
pt_2 = Point(move_5.Geometry)
pt_3 = Point(move_6.Geometry)
pt_4 = Point(move_7.Geometry)
bottom_crv = Curve(arc.Arc)
ln = Line(StartPoint=bottom_endpt, EndPoint=pt_2)
ln_2 = Line(StartPoint=pt_4, EndPoint=pt)
ln_3 = Line(StartPoint=pt_2, EndPoint=pt_4)
ln_4 = Line(StartPoint=pt, EndPoint=bottom_endpt)
ln_5 = Line(StartPoint=bottom_start_pt_2, EndPoint=pt)
ln_6 = Line(StartPoint=pt, EndPoint=bottom_endpt)
ln_7 = Line(StartPoint=pt_3, EndPoint=pt_4)
ln_8 = Line(StartPoint=bottom_start_pt_2, EndPoint=pt_3)
ln_9 = Line(StartPoint=pt_4, EndPoint=pt)
ln_10 = Line(StartPoint=bottom_start_pt_2, EndPoint=pt)
_2 = Number(2)
multiplication_3 = Multiplication(A=step_depth_2, B=_2)
join = JoinCurves(Curves=[ln, ln_2, ln_3, ln_4], Preserve=False)
join_2 = JoinCurves(Curves=[ln_8, ln_7, ln_10, ln_9], Preserve=False)
join_3 = JoinCurves(Curves=[ln_6, bottom_crv, ln_5], Preserve=False)
extr = Extrude(Base=bottom_crv, Direction=Z)
_2_2 = Number(2)
boundary_surfaces = BoundarySurfaces(Edges=join_2)
boundary_surfaces_2 = BoundarySurfaces(Edges=join)
X_3 = UnitX(Factor=multiplication_3)
division = Division(A=street_width_2, B=_2_2)
Y_3 = UnitY(Factor=division)
extr_2 = Extrude(Base=boundary_surfaces_2, Direction=X_3)
extr_3 = Extrude(Base=boundary_surfaces, Direction=Y_3)
brep = Brep(extr)
boundary_surfaces_3 = BoundarySurfaces(Edges=join_3)
move_8 = Move(Geometry=boundary_surfaces, Motion=Y_3)  # -> Geometry, Transform
extr_4 = Extrude(Base=boundary_surfaces_3, Direction=Z)
brep_2 = Brep(extr_4)
mirror = Mirror(Geometry=[extr_3, brep_2, extr_2], Plane=move_8.Geometry)  # -> Geometry, Transform
brep_3 = Brep(mirror.Geometry)
brep_4 = Brep([brep_3, extr_3, extr_4, extr_2])
brep_5 = ClusterOutput(brep_4)

# ==== cluster _1OnlyRightRoundStairCluster
bottom_start_pt = ClusterInput()
step_height = ClusterInput()
step_depth = ClusterInput()
street_width = ClusterInput()
bottom_start_pt_2 = Point(bottom_start_pt)
step_height_2 = Number(step_height)
step_depth_2 = Number(step_depth)
street_width_2 = Number(street_width)
_0 = Number(1)
subtraction = Subtraction(B=_0)
multiplication = Multiplication(A=subtraction, B=step_height_2)
Z = UnitZ(Factor=step_height_2)
neg = Negative(Value=step_depth_2)
Z_2 = UnitZ(Factor=multiplication)
neg_2 = Negative(Value=step_depth_2)
X = UnitX(Factor=neg)
Y = UnitY(Factor=neg_2)
X_2 = UnitX(Factor=step_depth_2)
Y_2 = UnitY(Factor=neg)
multiplication_2 = Multiplication(A=Z)
move = Move(Motion=Y)  # -> Geometry, Transform
move_2 = Move(Motion=X_2)  # -> Geometry, Transform
move_3 = Move(Geometry=bottom_start_pt_2, Motion=X)  # -> Geometry, Transform
pt = Point(move_3.Geometry)
move_4 = Move(Geometry=pt, Motion=Y_2)  # -> Geometry, Transform
bottom_endpt = Point(move_4.Geometry)
Z_3 = UnitZ(Factor=step_height_2)
move_5 = Move(Geometry=bottom_endpt, Motion=Z_3)  # -> Geometry, Transform
move_6 = Move(Geometry=bottom_start_pt_2, Motion=Z_3)  # -> Geometry, Transform
arc = ArcSED(Start=bottom_start_pt_2, End=bottom_endpt, Direction=Y_2)  # -> Arc, Plane, Radius
move_7 = Move(Geometry=pt, Motion=Z_3)  # -> Geometry, Transform
pt_2 = Point(move_5.Geometry)
pt_3 = Point(move_6.Geometry)
pt_4 = Point(move_7.Geometry)
bottom_crv = Curve(arc.Arc)
ln = Line(StartPoint=bottom_endpt, EndPoint=pt_2)
ln_2 = Line(StartPoint=pt_4, EndPoint=pt)
ln_3 = Line(StartPoint=pt_2, EndPoint=pt_4)
ln_4 = Line(StartPoint=pt, EndPoint=bottom_endpt)
ln_5 = Line(StartPoint=bottom_start_pt_2, EndPoint=pt)
ln_6 = Line(StartPoint=pt, EndPoint=bottom_endpt)
ln_7 = Line(StartPoint=pt_3, EndPoint=pt_4)
ln_8 = Line(StartPoint=bottom_start_pt_2, EndPoint=pt_3)
ln_9 = Line(StartPoint=pt_4, EndPoint=pt)
ln_10 = Line(StartPoint=bottom_start_pt_2, EndPoint=pt)
_2 = Number(2)
multiplication_3 = Multiplication(A=step_depth_2, B=_2)
join = JoinCurves(Curves=[ln, ln_4, ln_2, ln_3], Preserve=False)
join_2 = JoinCurves(Curves=[ln_8, ln_7, ln_10, ln_9], Preserve=False)
join_3 = JoinCurves(Curves=[ln_6, bottom_crv, ln_5], Preserve=False)
neg_3 = Negative(Value=multiplication_3)
_2_2 = Number(2)
boundary_surfaces = BoundarySurfaces(Edges=join_2)
boundary_surfaces_2 = BoundarySurfaces(Edges=join)
X_3 = UnitX(Factor=neg_3)
division = Division(A=street_width_2, B=_2_2)
extr = Extrude(Base=bottom_crv, Direction=Z)
Y_3 = UnitY(Factor=division)
extr_2 = Extrude(Base=boundary_surfaces_2, Direction=X_3)
extr_3 = Extrude(Base=boundary_surfaces, Direction=Y_3)
brep = Brep(extr)
boundary_surfaces_3 = BoundarySurfaces(Edges=join_3)
move_8 = Move(Geometry=boundary_surfaces, Motion=Y_3)  # -> Geometry, Transform
extr_4 = Extrude(Base=boundary_surfaces_3, Direction=Z)
brep_2 = Brep(extr_4)
mirror = Mirror(Geometry=[extr_3, brep_2, extr_2], Plane=move_8.Geometry)  # -> Geometry, Transform
brep_3 = Brep(mirror.Geometry)
brep_4 = Brep([brep_3, extr_4, extr_3, extr_2])
brep_5 = ClusterOutput(brep_4)
