# Grasshopper definition round_stairs_with_railings.gh (Grasshopper 1.0.7)

_2 = Number(2)
left_round_stair_railing_cluster = LeftRoundStairRailingCluster(round_step_num=_2, street_width=10)
brep = Brep(left_round_stair_railing_cluster)

_4 = Number(4)
left_round_stair_wall_railing = LeftRoundStairWallRailing(round_step_num=_4, street_width=10)
brep_2 = Brep(left_round_stair_wall_railing)

_2_2 = Number(2)
right_round_stair_wall_railing = RightRoundStairWallRailing(round_step_num=_2_2, street_width=10)
brep_3 = Brep(right_round_stair_wall_railing)

# ==== cluster RightRoundStairWallRailing
round_step_num = ClusterInput()
bottom_start_pt = ClusterInput()
step_height = ClusterInput()
street_width = ClusterInput()
step_length = ClusterInput()
round_step_num_2 = Number(round_step_num)
bottom_start_pt_2 = Point(bottom_start_pt)
step_height_2 = Number(step_height)
street_width_2 = Number(street_width)
step_length_2 = Number(step_length)
multiplication = Multiplication(A=step_length_2, B=round_step_num_2)
neg = Negative(Value=multiplication)
pt = Point(bottom_start_pt_2)
X = UnitX(Factor=neg)
multiplication_2 = Multiplication(A=step_height_2, B=round_step_num_2)
number = Number(1)
Y = UnitY(Factor=neg)
move = Move(Geometry=pt, Motion=X)  # -> Geometry, Transform
subtraction = Subtraction(A=round_step_num_2, B=number)
Z = UnitZ(Factor=multiplication_2)
move_2 = Move(Geometry=move.Geometry, Motion=Y)  # -> Geometry, Transform
move_3 = Move(Geometry=move.Geometry, Motion=Z)  # -> Geometry, Transform
multiplication_3 = Multiplication(A=round_step_num_2, B=step_length_2)
multiplication_4 = Multiplication(A=subtraction, B=step_height_2)
pt_2 = Point(move_2.Geometry)
pt_3 = Point(move_3.Geometry)
Z_2 = UnitZ(Factor=step_height_2)
neg_2 = Negative(Value=multiplication_3)
Z_3 = UnitZ(Factor=multiplication_4)
neg_3 = Negative(Value=step_length_2)
X_2 = UnitX(Factor=neg_2)
Y_2 = UnitY(Factor=neg_2)
Y_3 = UnitY(Factor=neg_3)
X_3 = UnitX(Factor=step_length_2)
multiplication_5 = Multiplication(A=Z_2, B=round_step_num_2)
move_4 = Move(Geometry=bottom_start_pt_2, Motion=X_2)  # -> Geometry, Transform
pt_4 = Point(move_4.Geometry)
move_5 = Move(Geometry=pt_4, Motion=Z_3)  # -> Geometry, Transform
move_6 = Move(Geometry=pt_4, Motion=Y_2)  # -> Geometry, Transform
bottom_endpt = Point(move_6.Geometry)
move_7 = Move(Geometry=pt_4, Motion=multiplication_5)  # -> Geometry, Transform
pt_5 = Point(move_5.Geometry)
move_8 = Move(Geometry=pt_5, Motion=Y_3)  # -> Geometry, Transform
move_9 = Move(Geometry=pt_5, Motion=X_3)  # -> Geometry, Transform
pt_6 = Point(move_8.Geometry)
pt_7 = Point(move_9.Geometry)
arc = ArcSED(Start=bottom_start_pt_2, End=bottom_endpt, Direction=Y_2)  # -> Arc, Plane, Radius
arc_2 = ArcSED(Start=pt_7, End=pt_6, Direction=Y_2)  # -> Arc, Plane, Radius
top_pt = Point(move_7.Geometry)
move_10 = Move(Geometry=top_pt, Motion=X_3)  # -> Geometry, Transform
move_11 = Move(Geometry=top_pt, Motion=Y_3)  # -> Geometry, Transform
top_end_pt = Point(move_11.Geometry)
top_start_pt = Point(move_10.Geometry)
railing_width = ClusterInput()
ralling_height = ClusterInput()
second_crv = Curve(arc_2.Arc)
arc_3 = ArcSED(Start=top_start_pt, End=top_end_pt, Direction=Y_2)  # -> Arc, Plane, Radius
bottom_crv = Curve(arc.Arc)

right_top_point = Point(pt_3)
right_down_point = Point(pt_2)
railing_width_2 = Number(railing_width)
ralling_height_2 = Number(ralling_height)
ln = Line(StartPoint=right_down_point, EndPoint=right_top_point)
neg_4 = Negative(Value=railing_width_2)
Z_4 = UnitZ(Factor=ralling_height_2)
crv = Curve(ln)
X_4 = UnitX(Factor=neg_4)
extr = Extrude(Base=crv, Direction=Z_4)
extr_2 = Extrude(Base=extr, Direction=X_4)

ln_2 = Line(StartPoint=pt_4, EndPoint=bottom_endpt)
range = Range(Domain=Domain(0, 1), Steps=subtraction)
ln_3 = Line(StartPoint=bottom_start_pt_2, EndPoint=pt_4)
ln_4 = Line(StartPoint=pt_4, EndPoint=bottom_endpt)
ln_5 = Line(StartPoint=top_start_pt, EndPoint=top_pt)
crv_2 = Curve(arc_3.Arc)
ln_6 = Line(StartPoint=top_pt, EndPoint=top_end_pt)
ln_7 = Line(StartPoint=pt_4, EndPoint=top_pt)
tweencrv = TweenCurve(CurveA=second_crv, CurveB=bottom_crv, Factor=range, BlendType=0)
extr_3 = Extrude(Base=tweencrv, Direction=Z_2)
join = JoinCurves(Curves=[ln_6, ln_5, crv_2], Preserve=False)
join_2 = JoinCurves(Curves=[ln_4, bottom_crv, ln_3], Preserve=False)
num = Number(2)
debrep = DeconstructBrep(Brep=extr_3)  # -> Faces, Edges, Vertices
division = Division(A=street_width_2, B=num)
item = ListItem(List=debrep.Edges, Index=0, Wrap=True)  # -> Item, Item1, Item2, Item3, Item4
crv_3 = Curve(flatten(item.Item4))
crv_4 = Curve(flatten(item.Item2))
Y_4 = UnitY(Factor=division)
crv_5 = Curve(flatten(item.Item3))
crv_6 = Curve(flatten(item.Item1))
boundary = BoundarySurfaces(Edges=join)
boundary_2 = BoundarySurfaces(Edges=join_2)
cull_i = CullIndex(List=flatten(crv_5), Indices="-1", Wrap=True)  # -> graft(List)
cull_i_2 = CullIndex(List=flatten(crv_6), Indices="0", Wrap=True)  # -> graft(List)
flip = FlipCurve(Curve=cull_i)  # -> Curve, Flag
crv_7 = Curve([cull_i_2, flip.Curve])
loft = Loft(Curves=crv_7, Options={Adjust=False, Closed=False, LoftEnds=0, LoftSimp=0, LoftType=0, Rebuild=10, Refit=0.01})
debrep_2 = DeconstructBrep(Brep=loft)  # -> Faces, Edges, Vertices
item_2 = ListItem(List=debrep_2.Edges, Index=0, Wrap=True)  # -> Item, Item1, Item2, Item3, Item4
crv_8 = Curve(flatten(item_2.Item4))
join_3 = JoinCurves(Curves=[crv_8, crv_3], Preserve=False)
crv_9 = Curve(join_3)
join_4 = JoinCurves(Curves=[crv_9, ln_3, ln_7, ln_5], Preserve=False)
crv_10 = Curve(flatten(item_2.Item2))
boundary_3 = BoundarySurfaces(Edges=join_4)
join_5 = JoinCurves(Curves=[crv_10, crv_4], Preserve=False)
crv_11 = Curve(join_5)
join_6 = JoinCurves(Curves=[ln_7, crv_11, ln_2, ln_6], Preserve=False)
boundary_4 = BoundarySurfaces(Edges=join_6)
extr_4 = Extrude(Base=boundary_3, Direction=Y_4)
move_12 = Move(Geometry=boundary_3, Motion=Y_4)  # -> Geometry, Transform
brep = Brep(extr_2)
brep_2 = Brep([extr_3, boundary_4, loft, boundary, boundary_2])
mirror = Mirror(Geometry=[extr_4, brep_2], Plane=move_12.Geometry)  # -> Geometry, Transform
brep_3 = Brep(mirror.Geometry)
col = Colour()
brep_4 = Brep(flatten([brep_2, brep_3, extr_4]))
brep_5 = ClusterOutput(brep_4)
preview = CustomPreview(Geometry=brep_4, Material=ColourSwatch(SwatchColor=RGB(230, 209, 119)))

# ==== cluster LeftRoundStairWallRailing
ralling_height = ClusterInput()
railing_width = ClusterInput()
round_step_num = ClusterInput()
bottom_start_pt = ClusterInput()
step_height = ClusterInput()
street_width = ClusterInput()
step_depth = ClusterInput()
round_step_num_2 = Number(round_step_num)
bottom_start_pt_2 = Point(bottom_start_pt)
step_height_2 = Number(step_height)
street_width_2 = Number(street_width)
step_depth_2 = Number(step_depth)
multiplication = Multiplication(A=step_depth_2, B=round_step_num_2)
pt = Point(bottom_start_pt_2)
neg = Negative(Value=multiplication)
X = UnitX(Factor=multiplication)
multiplication_2 = Multiplication(A=step_height_2, B=round_step_num_2)
number = Number(1)
Y = UnitY(Factor=neg)
move = Move(Geometry=pt, Motion=X)  # -> Geometry, Transform
subtraction = Subtraction(A=round_step_num_2, B=number)
Z = UnitZ(Factor=multiplication_2)
move_2 = Move(Geometry=move.Geometry, Motion=Y)  # -> Geometry, Transform
move_3 = Move(Geometry=move.Geometry, Motion=Z)  # -> Geometry, Transform
multiplication_3 = Multiplication(A=round_step_num_2, B=step_depth_2)
multiplication_4 = Multiplication(A=subtraction, B=step_height_2)
pt_2 = Point(move_2.Geometry)
pt_3 = Point(move_3.Geometry)

ralling_height_2 = Number(ralling_height)
railing_width_2 = Number(railing_width)
left_top_point = Point(pt_3)
left_down_point = Point(pt_2)
line = Line(StartPoint=left_down_point, EndPoint=left_top_point)
neg_2 = Negative(Value=railing_width_2)
unit_z = UnitZ(Factor=ralling_height_2)
curve = Curve(line)
X_2 = UnitX(Factor=railing_width_2)
extrude = Extrude(Base=curve, Direction=unit_z)
extrude_2 = Extrude(Base=extrude, Direction=X_2)

Z_2 = UnitZ(Factor=step_height_2)
neg_3 = Negative(Value=multiplication_3)
Z_3 = UnitZ(Factor=multiplication_4)
neg_4 = Negative(Value=step_depth_2)
X_3 = UnitX(Factor=step_depth_2)
X_4 = UnitX(Factor=multiplication_3)
Y_2 = UnitY(Factor=neg_3)
Y_3 = UnitY(Factor=neg_4)
neg_5 = Negative(Value=X_3)
multiplication_5 = Multiplication(A=Z_2, B=round_step_num_2)
move_4 = Move(Geometry=bottom_start_pt_2, Motion=X_4)  # -> Geometry, Transform
pt_4 = Point(move_4.Geometry)
move_5 = Move(Geometry=pt_4, Motion=Z_3)  # -> Geometry, Transform
move_6 = Move(Geometry=pt_4, Motion=Y_2)  # -> Geometry, Transform
bottom_endpt = Point(move_6.Geometry)
move_7 = Move(Geometry=pt_4, Motion=multiplication_5)  # -> Geometry, Transform
pt_5 = Point(move_5.Geometry)
move_8 = Move(Geometry=pt_5, Motion=Y_3)  # -> Geometry, Transform
move_9 = Move(Geometry=pt_5, Motion=neg_5)  # -> Geometry, Transform
pt_6 = Point(move_8.Geometry)
pt_7 = Point(move_9.Geometry)
arc = ArcSED(Start=bottom_start_pt_2, End=bottom_endpt, Direction=Y_2)  # -> Arc, Plane, Radius
arc_2 = ArcSED(Start=pt_7, End=pt_6, Direction=Y_2)  # -> Arc, Plane, Radius
top_pt = Point(move_7.Geometry)
move_10 = Move(Geometry=top_pt, Motion=neg_5)  # -> Geometry, Transform
move_11 = Move(Geometry=top_pt, Motion=Y_3)  # -> Geometry, Transform
top_end_pt = Point(move_11.Geometry)
top_start_pt = Point(move_10.Geometry)
second_crv = Curve(arc_2.Arc)
bottom_crv = Curve(arc.Arc)
arc_3 = ArcSED(Start=top_start_pt, End=top_end_pt, Direction=Y_2)  # -> Arc, Plane, Radius
range = Range(Domain=Domain(0, 1), Steps=subtraction)
ln = Line(StartPoint=top_start_pt, EndPoint=top_pt)
ln_2 = Line(StartPoint=top_pt, EndPoint=top_end_pt)
ln_3 = Line(StartPoint=pt_4, EndPoint=top_pt)
ln_4 = Line(StartPoint=pt_4, EndPoint=bottom_endpt)
ln_5 = Line(StartPoint=bottom_start_pt_2, EndPoint=pt_4)
ln_6 = Line(StartPoint=pt_4, EndPoint=bottom_endpt)
crv = Curve(arc_3.Arc)
tweencrv = TweenCurve(CurveA=second_crv, CurveB=bottom_crv, Factor=range, BlendType=0)
extr = Extrude(Base=tweencrv, Direction=Z_2)
join = JoinCurves(Curves=[ln_2, ln, crv], Preserve=False)
join_2 = JoinCurves(Curves=[ln_6, bottom_crv, ln_5], Preserve=False)
num = Number(2)
debrep = DeconstructBrep(Brep=extr)  # -> Faces, Edges, Vertices
item = ListItem(List=debrep.Edges, Index=0, Wrap=True)  # -> Item, Item1, Item2, Item3, Item4
crv_2 = Curve(flatten(item.Item4))
division = Division(A=street_width_2, B=num)
crv_3 = Curve(flatten(item.Item2))
crv_4 = Curve(flatten(item.Item3))
crv_5 = Curve(flatten(item.Item1))
Y_4 = UnitY(Factor=division)
boundary_surfaces = BoundarySurfaces(Edges=join)
cull_i = CullIndex(List=flatten(crv_4), Indices="-1", Wrap=True)  # -> graft(List)
boundary_surfaces_2 = BoundarySurfaces(Edges=join_2)
cull_i_2 = CullIndex(List=flatten(crv_5), Indices="0", Wrap=True)  # -> graft(List)
flip = FlipCurve(Curve=cull_i)  # -> Curve, Flag
crv_6 = Curve([cull_i_2, flip.Curve])
loft = Loft(Curves=crv_6, Options={Adjust=False, Closed=False, LoftEnds=0, LoftSimp=0, LoftType=0, Rebuild=10, Refit=0.01})
debrep_2 = DeconstructBrep(Brep=loft)  # -> Faces, Edges, Vertices
item_2 = ListItem(List=debrep_2.Edges, Index=0, Wrap=True)  # -> Item, Item1, Item2, Item3, Item4
crv_7 = Curve(flatten(item_2.Item4))
join_3 = JoinCurves(Curves=[crv_7, crv_2], Preserve=False)
crv_8 = Curve(join_3)
join_4 = JoinCurves(Curves=[crv_8, ln_5, ln, ln_3], Preserve=False)
crv_9 = Curve(flatten(item_2.Item2))
join_5 = JoinCurves(Curves=[crv_9, crv_3], Preserve=False)
crv_10 = Curve(join_5)
join_6 = JoinCurves(Curves=[ln_3, crv_10, ln_4, ln_2], Preserve=False)
boundary_surfaces_3 = BoundarySurfaces(Edges=join_6)
boundary_surfaces_4 = BoundarySurfaces(Edges=join_4)
extr_2 = Extrude(Base=boundary_surfaces_4, Direction=Y_4)
move_12 = Move(Geometry=boundary_surfaces_4, Motion=Y_4)  # -> Geometry, Transform
brep = Brep(extrude_2)
brep_2 = Brep(flatten([extr, boundary_surfaces_3, loft, boundary_surfaces, boundary_surfaces_2]))
mirror = Mirror(Geometry=[extr_2, brep_2, brep], Plane=move_12.Geometry)  # -> flatten(Geometry), Transform
brep_3 = Brep(mirror.Geometry)
brep_4 = Brep(flatten([brep_2, brep, brep_3, extr_2]))
brep_5 = ClusterOutput(brep_4)
preview = CustomPreview(Geometry=brep_4, Material=ColourSwatch(SwatchColor=RGB(201, 189, 165)))

# ==== cluster LeftRoundStairRailingCluster
round_step_num = ClusterInput()
bottom_start_pt = ClusterInput()
step_height = ClusterInput()
street_width = ClusterInput()
step_depth = ClusterInput()
round_step_num_2 = Number(round_step_num)
bottom_start_pt_2 = Point(bottom_start_pt)
step_height_2 = Number(step_height)
street_width_2 = Number(street_width)
step_depth_2 = Number(step_depth)
railing_height = ClusterInput()
railing_width = ClusterInput()
railing_height_2 = Number(railing_height)
railing_width_2 = Number(railing_width)
multiplication = Multiplication(A=step_depth_2, B=round_step_num_2)
pt = Point(bottom_start_pt_2)
neg = Negative(Value=multiplication)
X = UnitX(Factor=multiplication)
multiplication_2 = Multiplication(A=step_height_2, B=round_step_num_2)
number = Number(1)
Y = UnitY(Factor=neg)
move = Move(Geometry=pt, Motion=X)  # -> Geometry, Transform
subtraction = Subtraction(A=round_step_num_2, B=number)
Z = UnitZ(Factor=multiplication_2)
move_2 = Move(Geometry=move.Geometry, Motion=Y)  # -> Geometry, Transform
move_3 = Move(Geometry=move.Geometry, Motion=Z)  # -> Geometry, Transform
multiplication_3 = Multiplication(A=round_step_num_2, B=step_depth_2)
multiplication_4 = Multiplication(A=subtraction, B=step_height_2)
pt_2 = Point(move_2.Geometry)
left_down_point = Point(pt_2)
left_down_point_2 = Point(left_down_point)
pt_3 = Point(move_3.Geometry)
left_top_point = Point(pt_3)
left_top_point_2 = Point(left_top_point)
line = Line(StartPoint=left_down_point_2, EndPoint=left_top_point_2)
Z_2 = UnitZ(Factor=step_height_2)
neg_2 = Negative(Value=multiplication_3)
Z_3 = UnitZ(Factor=multiplication_4)
neg_3 = Negative(Value=step_depth_2)
X_2 = UnitX(Factor=step_depth_2)
X_3 = UnitX(Factor=multiplication_3)
Y_2 = UnitY(Factor=neg_2)
unit_z = UnitZ(Factor=railing_height_2)
unit_z_2 = UnitZ(Factor=railing_height_2)
Y_3 = UnitY(Factor=neg_3)
neg_4 = Negative(Value=X_2)
move_4 = Move(Motion=unit_z)  # -> Geometry, Transform
multiplication_5 = Multiplication(A=Z_2, B=round_step_num_2)
move_5 = Move(Geometry=bottom_start_pt_2, Motion=X_3)  # -> Geometry, Transform
move_6 = Move(Geometry=line, Motion=unit_z_2)  # -> Geometry, Transform
pt_4 = Point(move_5.Geometry)
move_7 = Move(Geometry=pt_4, Motion=Z_3)  # -> Geometry, Transform
move_8 = Move(Geometry=pt_4, Motion=Y_2)  # -> Geometry, Transform
bottom_endpt = Point(move_8.Geometry)
move_9 = Move(Geometry=pt_4, Motion=multiplication_5)  # -> Geometry, Transform
pt_5 = Point(move_7.Geometry)
move_10 = Move(Geometry=pt_5, Motion=Y_3)  # -> Geometry, Transform
move_11 = Move(Geometry=pt_5, Motion=neg_4)  # -> Geometry, Transform
pt_6 = Point(move_10.Geometry)
pt_7 = Point(move_11.Geometry)
end_points = EndPoints(Curve=move_4.Geometry)  # -> Start, End
end_points_2 = EndPoints(Curve=move_6.Geometry)  # -> Start, End
arc = ArcSED(Start=bottom_start_pt_2, End=bottom_endpt, Direction=Y_2)  # -> Arc, Plane, Radius
line_2 = Line(StartPoint=end_points.Start, EndPoint=left_top_point_2)
arc_2 = ArcSED(Start=pt_7, End=pt_6, Direction=Y_2)  # -> Arc, Plane, Radius
line_3 = Line(StartPoint=left_down_point_2, EndPoint=end_points_2.Start)
top_pt = Point(move_9.Geometry)
move_12 = Move(Geometry=top_pt, Motion=neg_4)  # -> Geometry, Transform
move_13 = Move(Geometry=top_pt, Motion=Y_3)  # -> Geometry, Transform
top_end_pt = Point(move_13.Geometry)
top_start_pt = Point(move_12.Geometry)
second_crv = Curve(arc_2.Arc)
bottom_crv = Curve(arc.Arc)
arc_3 = ArcSED(Start=top_start_pt, End=top_end_pt, Direction=Y_2)  # -> Arc, Plane, Radius
join_curves = JoinCurves(Curves=[move_6.Geometry, line_3], Preserve=False)
pipe = Pipe(Curve=line_3, Radius=railing_width_2, Caps=0)
pipe_2 = Pipe(Curve=line_2, Radius=railing_width_2, Caps=0)
range = Range(Domain=Domain(0, 1), Steps=subtraction)
ln = Line(StartPoint=top_start_pt, EndPoint=top_pt)
ln_2 = Line(StartPoint=top_pt, EndPoint=top_end_pt)
ln_3 = Line(StartPoint=pt_4, EndPoint=top_pt)
ln_4 = Line(StartPoint=pt_4, EndPoint=bottom_endpt)
ln_5 = Line(StartPoint=bottom_start_pt_2, EndPoint=pt_4)
ln_6 = Line(StartPoint=pt_4, EndPoint=bottom_endpt)
crv = Curve(arc_3.Arc)
_3 = Number(4)
curve_array = CurveArray(Geometry=pipe, Curve=move_6.Geometry, Count=_3)  # -> Geometry, Transform
tweencrv = TweenCurve(CurveA=second_crv, CurveB=bottom_crv, Factor=range, BlendType=0)
pipe_3 = Pipe(Curve=join_curves, Radius=railing_width_2, Caps=0)
preview = CustomPreview(Material=ColourSwatch(SwatchColor=RGB(178, 178, 178)))
preview_2 = CustomPreview(Material=ColourSwatch(SwatchColor=RGB(178, 178, 178)))
preview_3 = CustomPreview(Material=ColourSwatch(SwatchColor=RGB(178, 178, 178)))
preview_4 = CustomPreview(Material=ColourSwatch(SwatchColor=RGB(178, 178, 178)))
preview_5 = CustomPreview(Material=ColourSwatch(SwatchColor=RGB(178, 178, 178)))
preview_6 = CustomPreview(Material=ColourSwatch(SwatchColor=RGB(178, 178, 178)))
extr = Extrude(Base=tweencrv, Direction=Z_2)
join = JoinCurves(Curves=[ln_2, ln, crv], Preserve=False)
join_2 = JoinCurves(Curves=[ln_6, bottom_crv, ln_5], Preserve=False)
num = Number(2)
debrep = DeconstructBrep(Brep=extr)  # -> Faces, Edges, Vertices
item = ListItem(List=debrep.Edges, Index=0, Wrap=True)  # -> Item, Item1, Item2, Item3, Item4
crv_2 = Curve(flatten(item.Item4))
division = Division(A=street_width_2, B=num)
crv_3 = Curve(flatten(item.Item2))
brep = Brep([curve_array.Geometry, pipe_3])
crv_4 = Curve(flatten(item.Item3))
crv_5 = Curve(flatten(item.Item1))
Y_4 = UnitY(Factor=division)
boundary_surfaces = BoundarySurfaces(Edges=join)
cull_i = CullIndex(List=flatten(crv_4), Indices="-1", Wrap=True)  # -> graft(List)
boundary_surfaces_2 = BoundarySurfaces(Edges=join_2)
cull_i_2 = CullIndex(List=flatten(crv_5), Indices="0", Wrap=True)  # -> graft(List)
flip = FlipCurve(Curve=cull_i)  # -> Curve, Flag
crv_6 = Curve([cull_i_2, flip.Curve])
loft = Loft(Curves=crv_6, Options={Adjust=False, Closed=False, LoftEnds=0, LoftSimp=0, LoftType=0, Rebuild=10, Refit=0.01})
debrep_2 = DeconstructBrep(Brep=loft)  # -> Faces, Edges, Vertices
item_2 = ListItem(List=debrep_2.Edges, Index=0, Wrap=True)  # -> Item, Item1, Item2, Item3, Item4
crv_7 = Curve(flatten(item_2.Item4))
join_3 = JoinCurves(Curves=[crv_7, crv_2], Preserve=False)
crv_8 = Curve(join_3)
join_4 = JoinCurves(Curves=[crv_8, ln_5, ln, ln_3], Preserve=False)
crv_9 = Curve(flatten(item_2.Item2))
join_5 = JoinCurves(Curves=[crv_9, crv_3], Preserve=False)
crv_10 = Curve(join_5)
join_6 = JoinCurves(Curves=[ln_3, crv_10, ln_4, ln_2], Preserve=False)
boundary_surfaces_3 = BoundarySurfaces(Edges=join_6)
boundary_surfaces_4 = BoundarySurfaces(Edges=join_4)
extr_2 = Extrude(Base=boundary_surfaces_4, Direction=Y_4)
move_14 = Move(Geometry=boundary_surfaces_4, Motion=Y_4)  # -> Geometry, Transform
brep_2 = Brep(flatten([extr, boundary_surfaces_3, loft, boundary_surfaces, boundary_surfaces_2]))
mirror = Mirror(Geometry=[extr_2, brep_2, brep], Plane=move_14.Geometry)  # -> flatten(Geometry), Transform
brep_3 = Brep(mirror.Geometry)
brep_4 = Brep(flatten([brep_2, brep_3, extr_2, brep, extr]))
brep_5 = ClusterOutput(brep_4)
preview_7 = CustomPreview(Geometry=brep_4, Material=ColourSwatch(SwatchColor=RGB(199, 187, 139)))
